# Grasshopper definition 170314_Spatial_Clustering_01.gh (Grasshopper 0.9.76)
# plug-ins: Weaverbird

# ---- group: Boundary 02
crv = Curve(<curve referenced from the Rhino model>)

# ---- group: Boundary 01
crv_2 = Curve(<curve referenced from the Rhino model>)

# ---- group: Boundary 03
crv_3 = Curve(<curve referenced from the Rhino model>)

# ----
Z = UnitZ(Factor=Slider(21, range=0..100))
crv_4 = Curve(crv)
move = Move(Geometry=crv_4, Motion=Z)  # -> Geometry, Transform
meshloft = MeshLoft(polyA=crv_4, polyB=move.Geometry)  # -> out, result; inputs polyA: Polyline, polyB: Polyline
# ---------- meshloft: C# ----------
    result = MeshLoft(polyA, polyB);
# ---------- meshloft: C# additional code ----------
  //
  Mesh MeshLoft(Polyline polyA, Polyline polyB)
  {
    if(polyA.IsClosed && polyB.IsClosed)
      return MeshLoftClosed(polyA, polyB);
    else
      return MeshLoftOpen(polyA, polyB);
  }


  //
  Mesh MeshLoftOpen(Polyline polyA, Polyline polyB)
  {
    Mesh result = new Mesh();
    var verts = result.Vertices;
    var faces = result.Faces;

    int n = polyA.Count;

    // add vertices
    verts.AddVertices(polyA);
    verts.AddVertices(polyB);

    // add faces
    for(int i = 0; i < n - 1; i++)
      faces.AddFace(i, i + 1, i + n + 1, i + n);
    
    return result;
  }


  //
  Mesh MeshLoftClosed(Polyline polyA, Polyline polyB)
  {
    Mesh result = new Mesh();
    var verts = result.Vertices;
    var faces = result.Faces;

    int n = polyA.Count - 1;

    verts.AddVertices(polyA.Skip(1));
    verts.AddVertices(polyB.Skip(1));

    // add faces
    for(int i = 0, j = 1; i < n; i++, j++)
    {
      if(j == n) j = 0;
      faces.AddFace(i, j, j + n, i + n);
    }
    
    return result;
  }
# ---------- end meshloft ----------
mjoin = MeshJoin(Meshes=meshloft.result)
mesh = Mesh(mjoin)
mesh_2 = Mesh(mesh)
bbox = BoundingBox(Content=mesh_2, Plane=PlaneXY(0, 0, 0))  # -> Box, Box_2
box = Box(bbox.Box)
num = Number("1")
num_2 = Number("1")
box_2 = Box(box)
num_3 = Number(num_2)
num_4 = Number(num)
num_5 = Number("3")
box_3 = Box(box)
num_6 = Number(num_2)
num_7 = Number(num)

# ---- group: CreateScalarField3d
c_script = CSharpScript(
    box=box_2,
    scaleX=num_3,
    scaleY=num_4,
    scaleZ=num_5,
    Reference=["C:\Users\david.re\AppData\Roaming\Grasshopper\Libraries\SpatialSlur\SpatialSlur.dll", "C:\Users\david.re\AppData\Roaming\Grasshopper\Libraries\SpatialSlur\SlurRhino.dll"])  # -> out, result; inputs box: Box, scaleX: Double, scaleY: Double, scaleZ: Double
# ---------- c_script: C# ----------
    BoundingBox bbox = box.BoundingBox;
    Domain3d domain = bbox.ToDomain3d();

    Vec3d span = domain.Span;
    int nx = (int) Math.Ceiling(span.X / scaleX);
    int ny = (int) Math.Ceiling(span.Y / scaleY);
    int nz = (int) Math.Ceiling(span.Z / scaleZ);

    // center the domain
    double dx = (scaleX * nx - span.X) * 0.5;
    double dy = (scaleY * ny - span.Y) * 0.5;
    double dz = (scaleZ * nz - span.Z) * 0.5;
    domain.Expand(new Vec3d(dx, dy, dz));

    result = new GridScalarField3d(domain, nx + 1, ny + 1, nz + 1);
    _boxes.Add(domain.ToBoundingBox());
# ---------- c_script: C# additional code ----------
  List<BoundingBox> _boxes;
  BoundingBox _clippingBox;


  /// <summary>
  /// This method will be called once every solution, before any calls to RunScript.
  /// </summary>
  public override void BeforeRunScript()
  {
    _boxes = new List<BoundingBox>();
  }


  /// <summary>
  /// This method will be called once every solution, after any calls to RunScript.
  /// </summary>
  public override void AfterRunScript()
  {
    _clippingBox = BoundingBox.Empty;

    for(int i = 0; i < _boxes.Count; i++)
      _clippingBox.Union(_boxes[i]);
  }


  //Return a BoundingBox that contains all the geometry you are about to draw.
  public override BoundingBox ClippingBox
  {
    get
    {
      return _clippingBox;
    }
  }


  //Draw all wires and points in this method.
  public override void DrawViewportWires(IGH_PreviewArgs args)
  {
    base.DrawViewportWires(args);

    Color c = Color.Black;
    foreach(BoundingBox b in _boxes)
      args.Display.DrawBoxCorners(b, c);
  }
# ---------- end c_script ----------

# ---- group: CreateScalarField2d
c_script_2 = CSharpScript(
    box=box_3,
    scaleX=num_6,
    scaleY=num_7,
    Reference=["C:\USERS\DAVID.RE\APPDATA\ROAMING\GRASSHOPPER\LIBRARIES\SPATIALSLUR\SpatialSlur.dll", "C:\USERS\DAVID.RE\APPDATA\ROAMING\GRASSHOPPER\LIBRARIES\SPATIALSLUR\SlurRhino.dll"])  # -> out, result; inputs box: Box, scaleX: Double, scaleY: Double
# ---------- c_script_2: C# ----------
    BoundingBox bbox = box.BoundingBox;
    Domain3d domain = bbox.ToDomain2d();


    Vec2d span = domain.Span;
    int nx = (int) Math.Ceiling(span.X / scaleX);
    int ny = (int) Math.Ceiling(span.Y / scaleY);


    // center the domain
    double dx = (scaleX * nx - span.X) * 0.5;
    double dy = (scaleY * ny - span.Y) * 0.5;
    domain.Expand(new Vec2d(dx, dy));

    result = new GridScalarField2d(domain, nx + 1, ny + 1);
    _boxes.Add(domain.ToBoundingBox());
# ---------- c_script_2: C# additional code ----------
  List<BoundingBox> _boxes;
  BoundingBox _clippingBox;


  /// <summary>
  /// This method will be called once every solution, before any calls to RunScript.
  /// </summary>
  public override void BeforeRunScript()
  {
    _boxes = new List<BoundingBox>();
  }


  /// <summary>
  /// This method will be called once every solution, after any calls to RunScript.
  /// </summary>
  public override void AfterRunScript()
  {
    _clippingBox = BoundingBox.Empty;

    for(int i = 0; i < _boxes.Count; i++)
      _clippingBox.Union(_boxes[i]);
  }


  //Return a BoundingBox that contains all the geometry you are about to draw.
  public override BoundingBox ClippingBox
  {
    get
    {
      return _clippingBox;
    }
  }


  //Draw all wires and points in this method.
  public override void DrawViewportWires(IGH_PreviewArgs args)
  {
    base.DrawViewportWires(args);

    Color c = Color.Black;
    foreach(BoundingBox b in _boxes)
      args.Display.DrawBoxCorners(b, c);
  }
# ---------- end c_script_2 ----------

# ----
pt = Point([<point referenced from the Rhino model> x7])
mesh_3 = Mesh(mesh)
data = Data(c_script.result)
pdecon = Deconstruct(Point=pt)  # -> XComponent, YComponent, ZComponent
panel = Panel(c_script.out)

# ---- group: Distance Weighted Average
c_script_3 = CSharpScript(
    field=c_script_2.result,
    points=pt,
    values=pdecon.ZComponent,
    power=Slider(4, range=0.1..10),
    Reference=["C:\USERS\DAVID.RE\APPDATA\ROAMING\GRASSHOPPER\LIBRARIES\SPATIALSLUR\SpatialSlur.dll", "C:\USERS\DAVID.RE\APPDATA\ROAMING\GRASSHOPPER\LIBRARIES\SPATIALSLUR\SlurRhino.dll"])  # -> out, result; inputs points: list of Point3d, values: list of Double, power: Double
# ---------- c_script_3: C# ----------
    var f = new GridScalarField2d((GridField2d) field);

    _points = points.Convert(p => new Vec2d(p.X, p.Y));
    _values = values;
    _power = power;
    f.SpatialFunctionXY(DistanceWeightedMean);

    result = f;
# ---------- c_script_3: C# additional code ----------
  Vec2d[] _points;
  List<double> _values;
  double _power = 2.0;
  double _epsilon = 1.0e-8;


  /// <summary>
  ///
  /// </summary>
  double DistanceWeightedMean(Vec2d point)
  {
    double sum = 0.0;
    double wsum = 0.0;

    for(int i = 0; i < _points.Length; i++)
    {
      var d = point.DistanceTo(_points[i]);
      double w = 1.0 / Math.Pow(d + _epsilon, _power);

      sum += _values[i] * w;
      wsum += w;
    }

    return sum / wsum;
  }
# ---------- end c_script_3 ----------

# ---- group: Closest Normal
c_script_4 = CSharpScript(
    field=c_script_2.result,
    mesh=mesh_3,
    Reference=["C:\USERS\DAVID.RE\APPDATA\ROAMING\GRASSHOPPER\LIBRARIES\SPATIALSLUR\SpatialSlur.dll", "C:\USERS\DAVID.RE\APPDATA\ROAMING\GRASSHOPPER\LIBRARIES\SPATIALSLUR\SlurRhino.dll"])  # -> out, result; inputs mesh: Mesh
# ---------- c_script_4: C# ----------
    var f = new GridVectorField2d((GridField2d) field);

    _mesh = mesh;
    _mesh.Normals.ComputeNormals();
    f.SpatialFunctionXY(ClosestNormal);

    result = f;
# ---------- c_script_4: C# additional code ----------
  Mesh _mesh;

  //
  Vec2d ClosestNormal(Vec2d point)
  {
    Point3d p = new Point3d(point.X, point.Y, 0.0);
    Point3d cp;
    Vector3d cn;

    _mesh.ClosestPoint(p, out cp, out cn, 0.0);
    return new Vec2d(cn.X, cn.Y);
  }
# ---------- end c_script_4 ----------

# ---- group: Signed Distance
c_script_5 = CSharpScript(
    field=c_script_2.result,
    mesh=mesh_3,
    Reference=["C:\USERS\DAVID.RE\APPDATA\ROAMING\GRASSHOPPER\LIBRARIES\SPATIALSLUR\SpatialSlur.dll", "C:\USERS\DAVID.RE\APPDATA\ROAMING\GRASSHOPPER\LIBRARIES\SPATIALSLUR\SlurRhino.dll"])  # -> out, result; inputs mesh: Mesh
# ---------- c_script_5: C# ----------
    var f = new GridScalarField2d((GridField2d) field);

    _mesh = mesh;
    _mesh.Normals.ComputeNormals();
    f.SpatialFunctionXY(SignedDistance);

    result = f;
# ---------- c_script_5: C# additional code ----------
  Mesh _mesh;

  //
  double SignedDistance(Vec2d point)
  {
    Point3d p = new Point3d(point.X, point.Y, 0.0);
    Point3d cp;
    Vector3d cn;

    _mesh.ClosestPoint(p, out cp, out cn, 0.0);
    Vector3d d = p - cp;

    d.Z = 0.0;
    cn.Z = 0.0;

    return d.Length * Math.Sign(d * cn);
  }
# ---------- end c_script_5 ----------

# ---- group: Signed Projected Distance
c_script_6 = CSharpScript(
    field=c_script_2.result,
    mesh=mesh_3,
    Reference=["C:\USERS\DAVID.RE\APPDATA\ROAMING\GRASSHOPPER\LIBRARIES\SPATIALSLUR\SpatialSlur.dll", "C:\USERS\DAVID.RE\APPDATA\ROAMING\GRASSHOPPER\LIBRARIES\SPATIALSLUR\SlurRhino.dll"])  # -> out, result; inputs mesh: Mesh; disabled
# ---------- c_script_6: C# ----------
    var f = new ScalarField2d((Field2d) field);

    _mesh = mesh;
    _mesh.Normals.ComputeNormals();
    f.SpatialFunction(SignedDistanceProjected);

    result = f;
# ---------- c_script_6: C# additional code ----------
  Mesh _mesh;


  //
  double SignedDistanceProjected(Vec2d point)
  {
    Point3d p = new Point3d(point.x, point.y, 0.0);
    Point3d cp;
    Vector3d cn;

    _mesh.ClosestPoint(p, out cp, out cn, 0.0);
    cp.Z = 0;
    cn.Z = 0;
    
    return (p - cp) * cn;
  }
# ---------- end c_script_6 ----------

# ----
data_2 = Data(c_script_3.result)
data_3 = Data(c_script_5.result)
data_4 = Data(c_script_4.result)
merge = Merge(Data1=ColourSwatch(SwatchColor=RGB(102, 102, 102)), Data2=ColourSwatch(SwatchColor=RGB(255, 255, 255)))
merge_2 = Merge(Data1=ColourSwatch(SwatchColor=RGB(102, 102, 102)), Data2=ColourSwatch(SwatchColor=RGB(230, 230, 230)))
dom = ConstructDomain(DomainStart=Slider(0, range=0..1000), DomainEnd=Slider(25, range=0..100))
dom_2 = ConstructDomain(DomainStart=Slider(9, range=0..1000), DomainEnd=Slider(21, range=0..100))

# ---- group: Field2d to Mesh 2
c_script_7 = CSharpScript(
    field=data_3,
    range=dom,
    colors=merge,
    Reference=["C:\USERS\DAVID.RE\APPDATA\ROAMING\GRASSHOPPER\LIBRARIES\SPATIALSLUR\SpatialSlur.dll", "C:\USERS\DAVID.RE\APPDATA\ROAMING\GRASSHOPPER\LIBRARIES\SPATIALSLUR\SlurRhino.dll"])  # -> out, result; inputs colors: list of Color
# ---------- c_script_7: C# ----------
    var f = (GridScalarField2d) field;
    var d = range.ToDomain();

    result = f.ToPolySoup(x => colors.Lerp(d.Normalize(x)));
# ---------- end c_script_7 ----------

c_script_8 = CSharpScript(
    field=data_2,
    range=dom_2,
    colors=merge_2,
    Reference=["C:\USERS\DAVID.RE\APPDATA\ROAMING\GRASSHOPPER\LIBRARIES\SPATIALSLUR\SpatialSlur.dll", "C:\USERS\DAVID.RE\APPDATA\ROAMING\GRASSHOPPER\LIBRARIES\SPATIALSLUR\SlurRhino.dll"])  # -> out, result; inputs colors: list of Color; same code as c_script_7

# ----
data_5 = Data(data_3)

# ---- group: Smooth2d
c_script_9 = CSharpScript(
    field=data_5,
    strength=Slider(0.1, range=0..1),
    steps=Slider(100, range=0..100),
    Reference="C:\USERS\DAVID.RE\APPDATA\ROAMING\GRASSHOPPER\LIBRARIES\SPATIALSLUR\SpatialSlur.dll")  # -> out, result; inputs strength: Double, steps: Double
# ---------- c_script_9: C# ----------
    var f = ((GridScalarField2d) field).Duplicate();
    var deltas = new double[f.Count];

    double d = Math.Min(f.ScaleX, f.ScaleY);
    strength *= d * d;

    for(int i = 0; i < steps; i++)
    {
      FieldSim.Diffuse(f, deltas, strength, true);
      FieldSim.Update(f, deltas, 1.0, true);
    }

    result = f;
# ---------- end c_script_9 ----------

# ---- group: Smooth Pulse
c_script_10 = CSharpScript(
    field=c_script_9.result,
    t0=Slider(12, range=0..100),
    d0=Slider(0, range=0..100),
    d1=Slider(15, range=0..100),
    Reference=["C:\USERS\DAVID.RE\APPDATA\ROAMING\GRASSHOPPER\LIBRARIES\SPATIALSLUR\SpatialSlur.dll", "C:\USERS\DAVID.RE\APPDATA\ROAMING\GRASSHOPPER\LIBRARIES\SPATIALSLUR\SlurRhino.dll"])  # -> out, result; inputs t0: Double, d0: Double, d1: Double
# ---------- c_script_10: C# ----------
    var f = ((GridScalarField2d) field).Duplicate();
    f.Function(t => SlurMath.SmoothStep(Math.Abs(t - t0), d1, d0),f,true);
    result = f;
# ---------- end c_script_10 ----------

# ----
data_6 = Data(data)
merge_3 = Merge(Data1=ColourSwatch(SwatchColor=RGB(102, 102, 102)), Data2=ColourSwatch(SwatchColor=RGB(255, 255, 255)))
dom_3 = ConstructDomain(DomainStart=Slider(0, range=0..1000), DomainEnd=Slider(1, range=0..100))
number_slider = Slider(-5, range=-10..10)
data_7 = Data(data)
data_8 = Data(data_2)

# ---- group: LoftZ
c_script_11 = CSharpScript(
    field3d=data_6,
    field2d=c_script_10.result,
    Reference=["C:\USERS\DAVID.RE\APPDATA\ROAMING\GRASSHOPPER\LIBRARIES\SPATIALSLUR\SpatialSlur.dll", "C:\USERS\DAVID.RE\APPDATA\ROAMING\GRASSHOPPER\LIBRARIES\SPATIALSLUR\SlurRhino.dll"])  # -> out, result
# ---------- c_script_11: C# ----------
    var f3 = new GridScalarField3d((GridField3d) field3d);
    var f2 = (GridScalarField2d) field2d;

    int nx = f2.CountX;
    f3.SpatialFunctionIJK((i,j,k) => f2.Values[i + j * nx]);

    result = f3;
# ---------- end c_script_11 ----------

# ---- group: Field2d to Mesh 2
c_script_12 = CSharpScript(
    field=c_script_10.result,
    range=dom_3,
    colors=merge_3,
    Reference=["C:\USERS\DAVID.RE\APPDATA\ROAMING\GRASSHOPPER\LIBRARIES\SPATIALSLUR\SpatialSlur.dll", "C:\USERS\DAVID.RE\APPDATA\ROAMING\GRASSHOPPER\LIBRARIES\SPATIALSLUR\SlurRhino.dll"])  # -> out, result; inputs colors: list of Color; same code as c_script_7

# ---- group: Expand HeightField
c_script_13 = CSharpScript(
    field3d=data_7,
    field2d=data_8,
    Reference=["C:\USERS\DAVID.RE\APPDATA\ROAMING\GRASSHOPPER\LIBRARIES\SPATIALSLUR\SpatialSlur.dll", "C:\USERS\DAVID.RE\APPDATA\ROAMING\GRASSHOPPER\LIBRARIES\SPATIALSLUR\SlurRhino.dll"])  # -> out, result
# ---------- c_script_13: C# ----------
    var f3 = new GridScalarField3d((GridField3d) field3d);
    var f2 = (GridScalarField2d) field2d;

    double dz = f3.ScaleZ;
    int nx = f2.CountX;

    f3.SpatialFunctionIJK((i,j,k) => f2.Values[i + j * nx] - k * dz);


    result = f3;
# ---------- end c_script_13 ----------

# ----
data_9 = Data(data_4)
data_10 = Data(data_3)
num_8 = Number(expr("-x", number_slider))
data_11 = Data(c_script_11.result)

# ---- group: Smooth2d
c_script_14 = CSharpScript(
    field=data_10,
    strength=Slider(0.1, range=0..1),
    steps=Slider(100, range=0..100),
    Reference="C:\USERS\DAVID.RE\APPDATA\ROAMING\GRASSHOPPER\LIBRARIES\SPATIALSLUR\SpatialSlur.dll")  # -> out, result; inputs strength: Double, steps: Double; same code as c_script_9

c_script_15 = CSharpScript(
    field=data_9,
    strength=Slider(0.1, range=0..1),
    steps=Slider(10, range=0..100),
    Reference="C:\USERS\DAVID.RE\APPDATA\ROAMING\GRASSHOPPER\LIBRARIES\SPATIALSLUR\SpatialSlur.dll")  # -> out, result; inputs strength: Double, steps: Double
# ---------- c_script_15: C# ----------
    var f = ((GridVectorField2d) field).Duplicate();
    var deltas = new Vec2d[f.Count];

    double d = Math.Min(f.ScaleX, f.ScaleY);
    strength *= d * d;

    for(int i = 0; i < steps; i++)
    {
      f.GetLaplacian(deltas, true);
      ArrayMath.AddScaled(f.Values, deltas, strength, f.Values);
    }

    result = f;
# ---------- end c_script_15 ----------

# ---- group: SmoothStep
c_script_16 = CSharpScript(
    field=c_script_13.result,
    t0=number_slider,
    t1=num_8,
    Reference=["C:\USERS\DAVID.RE\APPDATA\ROAMING\GRASSHOPPER\LIBRARIES\SPATIALSLUR\SpatialSlur.dll", "C:\USERS\DAVID.RE\APPDATA\ROAMING\GRASSHOPPER\LIBRARIES\SPATIALSLUR\SlurRhino.dll"])  # -> out, result; inputs t0: Double, t1: Double
# ---------- c_script_16: C# ----------
    var f = ((GridScalarField3d) field).Duplicate();
    f.Function(t => SlurMath.SmoothStep(t, t0, t1), f, true);
    result = f;
# ---------- end c_script_16 ----------

# ----
number_slider_2 = Slider(0.532, range=0..1)  # disabled
int = Integer(1)
data_12 = Data(c_script_15.result)

# ---- group: Mult
c_script_17 = CSharpScript(
    fieldA=c_script_16.result,
    fieldB=data_11,
    Reference="C:\USERS\DAVID.RE\APPDATA\ROAMING\GRASSHOPPER\LIBRARIES\SPATIALSLUR\SpatialSlur.dll")  # -> out, result
# ---------- c_script_17: C# ----------
    var f0 = (GridScalarField3d) fieldA;
    var f1 = (GridScalarField3d) fieldB;
    var f2 = new GridScalarField3d(f0);

    

    f0.Function(f1, (x,y) => x * y, f2, true);
    result = f2;
# ---------- end c_script_17 ----------

# ----
data_13 = Data(c_script_17.result)  # disabled

# ---- group: Get Gradient
c_script_18 = CSharpScript(field=data_13, Reference="C:\USERS\DAVID.RE\APPDATA\ROAMING\GRASSHOPPER\LIBRARIES\SPATIALSLUR\SpatialSlur.dll")  # -> out, result; disabled
# ---------- c_script_18: C# ----------
    var f = (GridScalarField3d) field;
    result = f.GetGradient();
# ---------- end c_script_18 ----------

# ---- group: Min
c_script_19 = CSharpScript(
    fieldA=c_script_16.result,
    fieldB=data_11,
    Reference="C:\USERS\DAVID.RE\APPDATA\ROAMING\GRASSHOPPER\LIBRARIES\SPATIALSLUR\SpatialSlur.dll")  # -> out, result
# ---------- c_script_19: C# ----------
    var f0 = (GridScalarField3d) fieldA;
    var f1 = (GridScalarField3d) fieldB;
    var f2 = new GridScalarField3d(f0);

    f0.Function(f1, (x,y) => Math.Min(x, y), f2, true);
    result = f2;
# ---------- end c_script_19 ----------

# ---- group: Display VectorField2d
c_script_20 = CSharpScript(
    vectorField=data_12,
    color=ColourSwatch(SwatchColor=RGB(0, 0, 0)),
    weight=int,
    scale=Slider(2, range=0..2),
    Reference=["C:\USERS\DAVID.RE\APPDATA\ROAMING\GRASSHOPPER\LIBRARIES\SPATIALSLUR\SpatialSlur.dll", "C:\USERS\DAVID.RE\APPDATA\ROAMING\GRASSHOPPER\LIBRARIES\SPATIALSLUR\SlurRhino.dll"])  # -> out; inputs color: Color, weight: Int32, scale: Double
# ---------- c_script_20: C# ----------
    var f = (GridVectorField2d) vectorField;
    var vecs = f.Values;

    List<Line> lines = new List<Line>();
    int index = 0;

    foreach(var p0 in f.Coordinates)
    {
      var v = vecs[index++];

      if(v.SquareLength < _tolerance)
      {
        index++;
        continue;
      }

      Vec2d p1 = p0 + v * scale;
      lines.Add(new Line(p0.X, p0.Y, 0.0, p1.X, p1.Y, 0.0));
    }

    _lines.Add(lines);
    _colors.Add(color);
    _weights.Add(weight);
    _clippingBox.Union(f.Domain.ToBoundingBox());
# ---------- c_script_20: C# additional code ----------
  List<List<Line>> _lines;
  List<Color> _colors;
  List<int> _weights;

  BoundingBox _clippingBox;
  double _tolerance = 1.0e-8;


  /// <summary>
  /// This method will be called once every solution, before any calls to RunScript.
  /// </summary>
  public override void BeforeRunScript()
  {
    _lines = new List<List<Line>>();
    _colors = new List<Color>();
    _weights = new List<int>();
    _clippingBox = BoundingBox.Empty;
  }


  //Return a BoundingBox that contains all the geometry you are about to draw.
  public override BoundingBox ClippingBox
  {
    get{return _clippingBox;}
  }


  //Draw all wires and points in this method.
  public override void DrawViewportWires(IGH_PreviewArgs args)
  {
    for(int i = 0; i < _lines.Count; i++)
      args.Display.DrawLines(_lines[i], _colors[i], _weights[i]);
  }
# ---------- end c_script_20 ----------

# ----
data_14 = Data(data)
data_15 = Data(c_script_14.result)
data_16 = Data(c_script_15.result)

# ---- group: Isosurface 2
c_script_21 = CSharpScript(
    field=data_13,
    grad=c_script_18.result,
    thresh=number_slider_2,
    Reference=["C:\USERS\DAVID.RE\APPDATA\ROAMING\GRASSHOPPER\LIBRARIES\SPATIALSLUR\SpatialSlur.dll", "C:\USERS\DAVID.RE\APPDATA\ROAMING\GRASSHOPPER\LIBRARIES\SPATIALSLUR\SlurRhino.dll"])  # -> out, result; inputs thresh: Double; disabled
# ---------- c_script_21: C# ----------
    var f = (GridScalarField3d) field;
    var df = (GridVectorField3d) grad;
    result = Isosurface.Evaluate(f, df, thresh);
# ---------- end c_script_21 ----------

# ----
number_slider_3 = Slider(0.5, range=0..10)
swatch = ColourSwatch(SwatchColor=RGB(0, 0, 0))  # disabled
swatch_2 = ColourSwatch(SwatchColor=RGB(50, 175, 255))  # disabled
swatch_3 = ColourSwatch(SwatchColor=RGB(255, 255, 255))  # disabled

# ---- group: Select
c_script_22 = CSharpScript(
    scalarField=c_script_17.result,
    t0=Slider(0.5, range=0..1),
    t1=Slider(1, range=0..1),
    Reference=["C:\USERS\DAVID.RE\APPDATA\ROAMING\GRASSHOPPER\LIBRARIES\SPATIALSLUR\SpatialSlur.dll", "C:\USERS\DAVID.RE\APPDATA\ROAMING\GRASSHOPPER\LIBRARIES\SPATIALSLUR\SlurRhino.dll"])  # -> out, result; inputs t0: Double, t1: Double
# ---------- c_script_22: C# ----------
    var sf = (GridScalarField3d) scalarField;
    var vals = sf.Values;

    var d = new Domain1d(t0, t1);
    var selection = new List<int>();

    for(int i = 0; i < vals.Length; i++)
    {
      if(d.Contains(vals[i]))
        selection.Add(i);
    }

    result = new GH_ObjectWrapper(selection);
# ---------- end c_script_22 ----------

# ---- group: LoftZ
c_script_23 = CSharpScript(
    field3d=data_14,
    field2d=data_15,
    Reference=["C:\USERS\DAVID.RE\APPDATA\ROAMING\GRASSHOPPER\LIBRARIES\SPATIALSLUR\SpatialSlur.dll", "C:\USERS\DAVID.RE\APPDATA\ROAMING\GRASSHOPPER\LIBRARIES\SPATIALSLUR\SlurRhino.dll"])  # -> out, result; same code as c_script_11

c_script_24 = CSharpScript(
    field3d=data_14,
    field2d=data_16,
    Reference=["C:\USERS\DAVID.RE\APPDATA\ROAMING\GRASSHOPPER\LIBRARIES\SPATIALSLUR\SpatialSlur.dll", "C:\USERS\DAVID.RE\APPDATA\ROAMING\GRASSHOPPER\LIBRARIES\SPATIALSLUR\SlurRhino.dll"])  # -> out, result
# ---------- c_script_24: C# ----------
    var f3 = new GridVectorField3d((GridField3d) field3d);
    var f2 = (GridVectorField2d) field2d;

    int nx = f2.CountX;
    f3.SpatialFunctionIJK((i,j,k) => f2.Values[i + j * nx]);

    result = f3;
# ---------- end c_script_24 ----------

# ----
number_slider_4 = Slider(10, range=0..10)  # disabled
merge_4 = Merge(Data1=swatch, Data2=swatch_2, Data3=swatch_3)  # disabled
swatch_4 = ColourSwatch(SwatchColor=RGB(0, 0, 0))  # disabled
num_9 = Number(1)  # disabled
number_slider_5 = Slider(1, range=0..1)  # disabled
data_17 = Data(c_script_18.result)  # disabled
int_2 = Integer(1)  # disabled
merge_5 = Merge(Data1=Slider(0.1, range=0..10), Data2=number_slider_3, Data3=number_slider_3)
data_18 = Data(c_script_22.result)
data_19 = Data(c_script_23.result)
data_20 = Data(c_script_24.result)
vec = VectorXYZ(XComponent=num_9, YComponent=num_9, ZComponent=num_9)  # -> Vector, Length; disabled
swatch_5 = ColourSwatch(SwatchColor=RGB(255, 255, 255))  # disabled
mcol = MeshColours(Mesh=c_script_21.result, Colours=swatch_4)  # disabled
Z_2 = UnitZ(Factor=1)  # disabled
dispgridvecf = DisplayGridVectorField(
    field=data_17,
    colors=merge_4,
    weight=int_2,
    scale=number_slider_4,
    Reference=["C:\USERS\DAVID.RE\APPDATA\ROAMING\GRASSHOPPER\LIBRARIES\SPATIALSLUR\SpatialSlur.dll", "C:\USERS\DAVID.RE\APPDATA\ROAMING\GRASSHOPPER\LIBRARIES\SPATIALSLUR\SlurRhino.dll"])  # -> out; inputs colors: list of Color, weight: Int32, scale: Double; disabled
# ---------- dispgridvecf: C# ----------
    var vf = (GridVectorField3d) field;
    var d = vf.Domain;
    int index = 0;

    for(int k = 0; k < vf.CountZ; k++)
    {
      for(int j = 0; j < vf.CountY; j++)
      {
        for(int i = 0; i < vf.CountX; i++)
        {
          var p = vf.CoordinateAt(i, j, k);

          _lines.Add(new Line(p.ToPoint3d(), vf.Values[index++].ToVector3d() * scale));
          _colors.Add(colors.Lerp(FieldFunc(d.Normalize(p))));
          _weights.Add(weight);
        }
      }
    }

    _clippingBox.Union(vf.Domain.ToBoundingBox());
# ---------- dispgridvecf: C# additional code ----------
  List<Line> _lines;
  List<Color> _colors;
  List<int> _weights;

  BoundingBox _clippingBox;


  /// <summary>
  /// This method will be called once every solution, before any calls to RunScript.
  /// </summary>
  public override void BeforeRunScript()
  {
    _lines = new List<Line>();
    _colors = new List<Color>();
    _weights = new List<int>();

    _clippingBox = BoundingBox.Empty;
  }


  //
  double FieldFunc(Vec3d point)
  {
    double x = 2.0 * (Math.Abs(point.X - 0.5));
    double y = 2.0 * (Math.Abs(point.Y - 0.5));
    double z = 2.0 * (Math.Abs(point.Z - 0.5));

    x = 1.0 - x * x * x;
    y = 1.0 - y * y * y;
    z = 1.0 - z * z * z;

    return x * y * z;
  }


  //Return a BoundingBox that contains all the geometry you are about to draw.
  public override BoundingBox ClippingBox
  {
    get{return _clippingBox;}
  }


  //Draw all wires and points in this method.
  public override void DrawViewportWires(IGH_PreviewArgs args)
  {
    for(int i = 0; i < _lines.Count; i++)
      args.Display.DrawLine(_lines[i], _colors[i], _weights[i]);
  }
# ---------- end dispgridvecf ----------
number_slider_6 = Slider(2, range=0..10)
number_slider_7 = Slider(1, range=0..1)
normshade = NormalShader(
    mesh=mcol,
    direction=vec.Vector,
    color=swatch_5,
    intensity=number_slider_5,
    Reference="C:\USERS\DAVID.RE\APPDATA\ROAMING\GRASSHOPPER\LIBRARIES\SPATIALSLUR\SpatialSlur.dll")  # -> out, result; inputs mesh: Mesh, direction: Vector3d, color: Color, intensity: Double; disabled
# ---------- normshade: C# ----------
    if(mesh.Normals.Count != mesh.Vertices.Count)
      mesh.Normals.ComputeNormals();

    if(mesh.VertexColors.Count != mesh.Vertices.Count)
      mesh.VertexColors.CreateMonotoneMesh(Color.White);

    NormalShader(mesh, direction, color, intensity);
    result = mesh;
# ---------- normshade: C# additional code ----------
  //
  void NormalShader(Mesh mesh, Vector3d direction, Color color, double intensity)
  {
    if(!direction.Unitize())
      throw new System.ArgumentException("the direction vector cannot be zero length");

    Color[] vc = mesh.VertexColors.ToArray();

    var chunks = System.Collections.Concurrent.Partitioner.Create(0, mesh.Vertices.Count);
    System.Threading.Tasks.Parallel.ForEach(chunks, range =>
      {
      for (int i = range.Item1; i < range.Item2; i++)
      {
        double t = direction * mesh.Normals[i] * 0.5 + 0.5;
        vc[i] = vc[i].LerpTo(color, t * intensity);
      }
      });

    mesh.VertexColors.SetColors(vc);
  }
# ---------- end normshade ----------
# References: K-Means with equal sized clusters
# 
# https://elki-project.github.io/tutorial/same-size_k_means
merge_6 = Merge(Data1=Slider(0.2, range=0..1), Data2=number_slider_7, Data3=number_slider_7)
merge_7 = Merge(Data1=Slider(0.1, range=0..10), Data2=number_slider_6, Data3=number_slider_6)
todo = Panel("Select by area")
data_21 = Data(data_19)
data_22 = Data(data_20)
num_10 = Number(merge_7)
data_23 = Data(data_18)
c_script_25 = CSharpScript(
    scalarField0=data_21,
    vectorField0=data_22,
    selection=data_23,
    scale=num_10,
    clusterCount=Slider(16, range=0..200),
    maxSteps=Slider(100, range=0..1000),
    seed=Slider(1, range=0..100),
    Reference=["C:\USERS\DAVID.RE\APPDATA\ROAMING\GRASSHOPPER\LIBRARIES\SPATIALSLUR\SpatialSlur.dll", "C:\USERS\DAVID.RE\APPDATA\ROAMING\GRASSHOPPER\LIBRARIES\SPATIALSLUR\SlurRhino.dll"])  # -> out, result, meshes; inputs scale: list of Double, clusterCount: Int32, maxSteps: Int32, seed: Int32
# ---------- c_script_25: C# ----------
    var sf0 = (GridScalarField3d) scalarField0;
    var vf0 = (GridVectorField3d) vectorField0;
    var parent = (List<int>) selection;

    var points = InitDataPoints(sf0.Values, vf0.Values, parent, scale);
    var kmeans = new KMeans(points, clusterCount, seed);

    // cluster points
    int steps = kmeans.Cluster(maxSteps);

    if(steps == -1)
      Print("Clustering did not converge after the maximum number of steps");
    else
      Print(String.Format("Clustering converged in {0} steps", steps));

    var children = SelectClusters(kmeans, parent);

    result = children;
    meshes = children.Convert(ids => sf0.MeshSelection(ids));
# ---------- c_script_25: C# additional code ----------
  /// <summary>
  /// Initializes all data points in the given selection
  /// </summary>
  IEnumerable<double[]> InitDataPoints(double[] vals0, Vec3d[] vals1, List<int> selection, List<double> scale)
  {
    for (int i = 0; i < selection.Count; i++)
    {
      int index = selection[i];
      var v0 = vals0[index];
      var v1 = vals1[index];

      yield return new double[]
        {
        v0 * scale[0],
        v1.X * scale[1],
        v1.Y * scale[2]
        };
    }
  }


  /// <summary>
  /// Creates a new selection for each cluster
  /// </summary>
  /// <returns></returns>
  List<int>[] SelectClusters(KMeans kmeans, List<int> selection)
  {
    var result = new List<int>[kmeans.ClusterCount];

    for(int i = 0; i < result.Length; i++)
      result[i] = new List<int>();

    for(int i = 0; i < kmeans.PointCount; i++)
      result[kmeans.GetNearestCluster(i)].Add(selection[i]);

    return result;
  }
# ---------- end c_script_25 ----------
# TODO: Heightfield
# 
# Recursive clustering (heirarchical neighbourhoods)
number_slider_8 = Slider(0.1, range=0..10)
number_slider_9 = Slider(1.184, range=0..10)
panel_2 = Panel(c_script_25.out)
data_24 = Data(c_script_25.result)
mesh_4 = Mesh(c_script_25.meshes)
merge_8 = Merge(Data1=number_slider_8, Data2=number_slider_9, Data3=number_slider_9)
num_11 = Number(merge_8)
data_25 = Data(data_19)
data_26 = Data(data_20)
data_27 = Data(data_24)
c_script_26 = CSharpScript(
    scalarField0=data_25,
    vectorField0=data_26,
    selection=data_27,
    scale=num_11,
    clusterCount=Slider(4, range=0..100),
    maxSteps=Slider(100, range=0..1000),
    seed=Slider(50, range=0..100),
    Reference=["C:\USERS\DAVID.RE\APPDATA\ROAMING\GRASSHOPPER\LIBRARIES\SPATIALSLUR\SpatialSlur.dll", "C:\USERS\DAVID.RE\APPDATA\ROAMING\GRASSHOPPER\LIBRARIES\SPATIALSLUR\SlurRhino.dll"])  # -> out, result, meshes; inputs scale: list of Double, clusterCount: Int32, maxSteps: Int32, seed: Int32; same code as c_script_25
panel_3 = Panel(c_script_26.out)
mesh_5 = Mesh(c_script_26.meshes)
data_28 = Data(c_script_26.result)
mesh_6 = Mesh(flatten(mesh_5))
lng = ListLength(List=mesh_6)
range = Range(Domain=Domain(0, 1), Steps=expr("x-1", lng))
merge_9 = Merge(
    Data1=ColourSwatch(SwatchColor=RGB(255, 255, 150)),
    Data2=ColourSwatch(SwatchColor=RGB(0, 255, 150)),
    Data3=ColourSwatch(SwatchColor=RGB(0, 0, 150)),
    Data4=ColourSwatch(SwatchColor=RGB(255, 0, 150)))
interp = InterpolateData(Data=merge_9, Parameter=range, Interpolation=2)
mcol_2 = MeshColours(Mesh=graft(mesh_6), Colours=graft(interp))
trim = TrimTree(Tree=mcol_2, Depth=1)
wbnaked = WeaverbirdsNakedBoundary(MeshClosedPolylines=trim)
mesh_7 = Mesh(trim)
mesh_8 = Mesh(mesh_7)  # disabled
mesh_9 = Mesh(mesh_7)  # disabled
mesh_10 = Mesh(mesh_7)
item = ListItem(List=mesh_8, Index=Slider(0, range=0..100), Wrap=True)
bbox_2 = BoundingBox(Content=mesh_10, Plane=PlaneXY(0, 0, 0))  # -> Box, Box_2
box_4 = Box(box)
lng_2 = ListLength(List=mesh_9)
wbnaked_2 = WeaverbirdsNakedBoundary(MeshClosedPolylines=item)
box_5 = EvaluateBox(Box=bbox_2.Box, UParameter=0.5, VParameter=0.5, WParameter=0.5)  # -> Plane, Point, Include
box_6 = EvaluateBox(Box=box_4, UParameter=0.5, VParameter=0.5, WParameter=Slider(0, range=-1..1))  # -> Plane, Point, Include
series = Series(Start=0, Step=Slider(25.238, range=0..100), Count=lng_2)
Z_3 = UnitZ(Factor=series)
vec_2 = VectorXYZ(XComponent=0, YComponent=Slider(100, range=0..100), ZComponent=series)  # -> Vector, Length
scale = Scale(Geometry=box_5.Point, Center=box_6.Plane, Factor=Slider(1.179, range=1..2))  # -> Geometry, Transform
move_2 = Move(Geometry=mesh_9, Motion=vec_2.Vector)  # -> Geometry, Transform
vec2pt = Vector2Pt(PointA=box_5.Point, PointB=scale.Geometry, Unitize=False)  # -> Vector, Length
wbnaked_3 = WeaverbirdsNakedBoundary(MeshClosedPolylines=move_2.Geometry)
move_3 = Move(Geometry=mesh_10, Motion=vec2pt.Vector)  # -> Geometry, Transform
wbnaked_4 = WeaverbirdsNakedBoundary(MeshClosedPolylines=move_3.Geometry)
