# Grasshopper definition 170717_Dynamic_Remesher_01.gh (Grasshopper 0.9.76)
# plug-ins: SpatialSlur.SlurGH

pt = Point([<point referenced from the Rhino model> x6])
# Notes: Field defined by inverse distance weighting
# 
# https://en.wikipedia.org/wiki/Inverse_distance_weighting
long = LongestList(ListA=pt, ListB=Slider(0, range=0..1), PaddingMode=2)  # -> ListA, ListB
pt_2 = Point(long.ListA)
num = Number(long.ListB)

dom = ConstructDomain(DomainStart=Slider(0.1, range=0.1..10), DomainEnd=Slider(3, range=0.1..20))

# ---- group: IDWScalarField
c_script = CSharpScript(
    points=pt_2,
    values=num,
    power=Slider(3, range=0..10),
    defaultValue=Slider(1, range=0..1),
    defaultWeight=Slider(0.01, range=0..0.1),
    Reference=["C:\Users\david.re\AppData\Roaming\Grasshopper\Libraries\SpatialSlur\SpatialSlur.dll", "C:\Users\david.re\AppData\Roaming\Grasshopper\Libraries\SpatialSlur\SlurRhino.dll"])  # -> out, result; inputs points: list of Point3d, values: list of Double, power: Double, defaultValue: Double, defaultWeight: Double
# ---------- c_script: C# ----------
    var field = new IDWScalarField3d(power);
    field.DefaultValue = defaultValue;
    field.DefaultWeight = defaultWeight;

    var pts = field.Points;
    for(int i = 0 ; i < points.Count; i++)
      pts.Add(IDWPoint3d.Create(values[i], points[i].ToVec3d()));

    result = (IField3d<double>) field;
# ---------- end c_script ----------

# ----
crv = Curve(<curve referenced from the Rhino model>)  # disabled

# ---- group: Create Point Features
c_script_2 = CSharpScript(
    polyline=crv,
    Reference=["C:\USERS\DAVID.RE\APPDATA\ROAMING\GRASSHOPPER\LIBRARIES\SPATIALSLUR\SlurRhino.dll", "C:\USERS\DAVID.RE\APPDATA\ROAMING\GRASSHOPPER\LIBRARIES\SPATIALSLUR\SpatialSlur.dll"])  # -> out, result; inputs polyline: Polyline; disabled
# ---------- c_script_2: C# ----------
    if(polyline.IsClosed)
      polyline.RemoveAt(polyline.Count - 1);

    result = polyline.Select(p => new PointFeature(p.ToVec3d()));
# ---------- end c_script_2 ----------

# ----
data = Data(c_script.result)

# ---- group: Input Mesh
mesh = Mesh(<mesh referenced from the Rhino model>)

# ----
settings = DynamicRemesherSettings(
    LengthRange=dom,
    LengthTolerance=Slider(0.1, range=0..1),
    FeatureWeight=Slider(100, range=0..100),
    SmoothWeight=Slider(1, range=0..10),
    TimeStep=1,
    Damping=0.5,
    SubSteps=Slider(5, range=0..10),
    RefineFrequency=Slider(3, range=0..10))
list = ValueList({"Reset": 0, "Play": 1, "Pause": 2}, selected="Pause")
hemesh = HeMesh(mesh)
mesh_2 = Mesh(mesh)
data_2 = Data(c_script_2.result)
data_3 = Data(data)
data_4 = Data(settings)
remesher = DynamicRemesher(Source=hemesh, Target=mesh_2, Features=data_2, LengthField=data_3, Settings=data_4, SimState=list)  # -> Out, Result
hemesh_2 = HeMesh(remesher.Result)
panel = Panel(remesher.Result)
merge = Merge(
    Data1=ColourSwatch(SwatchColor=RGB(255, 255, 255)),
    Data2=ColourSwatch(SwatchColor=RGB(255, 0, 150)),
    Data3=ColourSwatch(SwatchColor=RGB(0, 0, 0)))
data_5 = Data(data)
mesh_3 = Mesh(hemesh_2)

# ---- group: Field Painter
c_script_3 = CSharpScript(
    field3d=data_5,
    mesh=mesh_3,
    colors=merge,
    Reference=["C:\USERS\DAVID.RE\APPDATA\ROAMING\GRASSHOPPER\LIBRARIES\SPATIALSLUR\SpatialSlur.dll", "C:\USERS\DAVID.RE\APPDATA\ROAMING\GRASSHOPPER\LIBRARIES\SPATIALSLUR\SlurRhino.dll"])  # -> out, result; inputs mesh: Mesh, colors: list of Color
# ---------- c_script_3: C# ----------
    var f = (IField3d<double>) field3d;
    var verts = mesh.Vertices;

    mesh.ColorVertices(i => colors.Lerp(f.ValueAt(verts[i].ToVec3d())), true);
    
    result = mesh;
# ---------- end c_script_3 ----------
