# Grasshopper definition 170718_HeMesh_Unroll_01.gh (Grasshopper 0.9.76)
# plug-ins: SpatialSlur.SlurGH

# ---- group: PQ Mesh
mesh = Mesh(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)

# ----
hemesh = HeMesh(mesh)

# ---- group: Unroll
c_script = CSharpScript(
    heMesh=hemesh,
    startFace=Slider(0, range=0..15),
    Reference=["C:\Users\David\Google Drive\Visual Studio\Repos\SpatialSlur\SlurRhino\bin\Debug\SlurRhino.dll", "C:\Users\David\Google Drive\Visual Studio\Repos\SpatialSlur\SpatialSlur\bin\Debug\SpatialSlur.dll"])  # -> out, result; inputs startFace: Int32
# ---------- c_script: C# ----------
    var hem = HeMesh3d.TryCast(heMesh).Duplicate();
    var f = hem.Faces[startFace];

    // unroll
    HeMeshUnroller.Unroll(hem, f);

    // set normals
    var n = f.GetNormal(v => v.Position);
    hem.Vertices.Action(v => v.Normal = n);

    result = hem;
# ---------- end c_script ----------

# ----
hemesh_2 = HeMesh(c_script.result)

# ---- group: Get Hole Boundaries
c_script_2 = CSharpScript(
    heMesh=hemesh_2,
    Reference=["C:\Users\David\Google Drive\Visual Studio\Repos\SpatialSlur\SlurRhino\bin\Debug\SlurRhino.dll", "C:\Users\David\Google Drive\Visual Studio\Repos\SpatialSlur\SpatialSlur\bin\Debug\SpatialSlur.dll"])  # -> out, result
# ---------- c_script_2: C# ----------
    var hem = HeMesh3d.TryCast(heMesh);

    result = hem.GetHoles().Select(he0 =>
      {
      var poly = new Polyline();
      poly.AddRange(he0.CirculateFace.Select(he1 => he1.Start.Position.ToPoint3d()));
      poly.Add(poly[0]);
      return poly;
      });
# ---------- end c_script_2 ----------

# ----
mesh_2 = Mesh(hemesh_2)
preview = CustomPreview(Geometry=mesh_2, Shader=ColourSwatch(SwatchColor=RGBA(204, 202, 202, 150)))
preview_2 = CustomPreview(Geometry=c_script_2.result, Shader=ColourSwatch(SwatchColor=RGB(0, 0, 0)))
