# Grasshopper definition 170722_Funicular_Network_01.gh (Grasshopper 0.9.76)
# plug-ins: SpatialSlur.SlurGH

num = Number(0.001)
crv = Curve([<curve referenced from the Rhino model> x103])

# ---- group: HeGraph From Lines
c_script = CSharpScript(
    lines=crv,
    tolerance=num,
    Reference=["C:\USERS\DAVID.RE\APPDATA\ROAMING\GRASSHOPPER\LIBRARIES\SPATIALSLUR\SpatialSlur.dll", "C:\USERS\DAVID.RE\APPDATA\ROAMING\GRASSHOPPER\LIBRARIES\SPATIALSLUR\SlurRhino.dll"])  # -> out, result; inputs lines: list of Line, tolerance: Double
# ---------- c_script: C# ----------
    result = lines.ToHeGraph(tolerance);
# ---------- end c_script ----------

# ---- group: Split Edges
c_script_2 = CSharpScript(
    heGraph=c_script.result,
    targetLength=Slider(0.5, range=0.01..1),
    Reference=["C:\USERS\DAVID.RE\APPDATA\ROAMING\GRASSHOPPER\LIBRARIES\SPATIALSLUR\SpatialSlur.dll", "C:\USERS\DAVID.RE\APPDATA\ROAMING\GRASSHOPPER\LIBRARIES\SPATIALSLUR\SlurRhino.dll"])  # -> out, result; inputs targetLength: Double
# ---------- c_script_2: C# ----------
    var heg = HeGraph3d.TryCast(heGraph).Duplicate();

    var edges = heg.Edges;
    var ne = edges.Count;

    for(int i = 0; i < ne; i++)
    {
      var he = edges[i];

      var p = he.Start.Position;
      var d = he.End.Position - p;

      var n = (int) Math.Round(d.Length / targetLength) - 1;
      if(n < 1) continue;

      heg.DivideEdge(he, n);

      // set vertex positions
      var t = 1.0 / (n + 1);
      for(int j = 0; j <= n; j++)
      {
        he.Start.Position = p + d * (t * j);
        he = he.Twin.NextAtStart;
      }
    }

    result = heg;
# ---------- end c_script_2 ----------

# ----
hegraph = HeGraph(c_script_2.result)
hegraph_2 = HeGraph(hegraph)
Z = UnitZ(Factor=Slider(0.046, range=-0.1..0.1))

# ---- group: Particle Positions
c_script_3 = CSharpScript(
    heGraph=hegraph_2,
    Reference=["C:\Users\david.re\AppData\Roaming\Grasshopper\Libraries\SpatialSlur\SpatialSlur.dll", "C:\Users\david.re\AppData\Roaming\Grasshopper\Libraries\SpatialSlur\SlurRhino.dll"])  # -> out, result
# ---------- c_script_3: C# ----------
    var heg = HeGraph3d.TryCast(heGraph);
    result = new GH_ObjectWrapper(heg.Vertices.Select(v => v.Position));
# ---------- end c_script_3 ----------

# ---- group: Length Constraints
c_script_4 = CSharpScript(
    heGraph=hegraph_2,
    lengthFactor=Slider(1, range=0..2),
    weight=Slider(2, range=0..10),
    Reference=["C:\USERS\DAVID.RE\APPDATA\ROAMING\GRASSHOPPER\LIBRARIES\SPATIALSLUR\SpatialSlur.dll", "C:\USERS\DAVID.RE\APPDATA\ROAMING\GRASSHOPPER\LIBRARIES\SPATIALSLUR\SlurRhino.dll"])  # -> out, result; inputs lengthFactor: Double, weight: Double
# ---------- c_script_4: C# ----------
    var heg = HeGraph3d.TryCast(heGraph);
    Func<HeGraph3d.V, Vec3d> getPos = v => v.Position;

    result = heg.Edges.Select(he =>
      {
      var length = he.GetLength(getPos) * lengthFactor;
      return new LengthConstraint(he.Start, he.End, length, weight);
      });
# ---------- end c_script_4 ----------

# ---- group: Degree 1 Constraints
c_script_5 = CSharpScript(
    heGraph=hegraph_2,
    weight=Slider(100, range=0..1000),
    Reference=["C:\USERS\DAVID.RE\APPDATA\ROAMING\GRASSHOPPER\LIBRARIES\SPATIALSLUR\SpatialSlur.dll", "C:\USERS\DAVID.RE\APPDATA\ROAMING\GRASSHOPPER\LIBRARIES\SPATIALSLUR\SlurRhino.dll"])  # -> out, result; inputs weight: Double
# ---------- c_script_5: C# ----------
    var heg = HeGraph3d.TryCast(heGraph);
    result = heg.Vertices.Where(v => v.IsDegree1).Select(v => new OnPoint(v.Index.Yield(), v.Position, weight));
# ---------- end c_script_5 ----------

# ---- group: Linear Weights
c_script_6 = CSharpScript(
    heGraph=hegraph_2,
    direction=Z,
    weight=Slider(1, range=0..10),
    Reference=["C:\USERS\DAVID.RE\APPDATA\ROAMING\GRASSHOPPER\LIBRARIES\SPATIALSLUR\SpatialSlur.dll", "C:\USERS\DAVID.RE\APPDATA\ROAMING\GRASSHOPPER\LIBRARIES\SPATIALSLUR\SlurRhino.dll"])  # -> out, result; inputs direction: Vector3d, weight: Double
# ---------- c_script_6: C# ----------
    var heg = HeGraph3d.TryCast(heGraph);
    var d = direction.ToVec3d();

    result = heg.Edges.Select(he => new LinearWeight(he.Start, he.End, d, 1.0, weight));
# ---------- end c_script_6 ----------

# ----
num_2 = Number(0.0001)

# ---- group: Gather Constraints
c_script_7 = CSharpScript(
    constraints=flatten([c_script_4.result, c_script_6.result, c_script_5.result]),
    Reference=["C:\USERS\DAVID.RE\APPDATA\ROAMING\GRASSHOPPER\LIBRARIES\SPATIALSLUR\SpatialSlur.dll", "C:\USERS\DAVID.RE\APPDATA\ROAMING\GRASSHOPPER\LIBRARIES\SPATIALSLUR\SlurRhino.dll"])  # -> out, result; inputs constraints: list
# ---------- c_script_7: C# ----------
    result = new GH_ObjectWrapper(constraints.Select(obj => (IConstraint) obj));
# ---------- end c_script_7 ----------

# ---- group: Settings
c_script_8 = CSharpScript(
    timeStep=Slider(1, range=0..2),
    damping=Slider(0.95, range=0..1),
    tolerance=num_2,
    Reference=["C:\USERS\DAVID.RE\APPDATA\ROAMING\GRASSHOPPER\LIBRARIES\SPATIALSLUR\SpatialSlur.dll", "C:\USERS\DAVID.RE\APPDATA\ROAMING\GRASSHOPPER\LIBRARIES\SPATIALSLUR\SlurRhino.dll"])  # -> out, result; inputs timeStep: Double, damping: Double, tolerance: Double
# ---------- c_script_8: C# ----------
    result = new ConstraintSolverSettings(){TimeStep = timeStep, Damping = damping, Tolerance = tolerance};
# ---------- end c_script_8 ----------

# ----
list = ValueList({"Reset": 0, "Play": 1, "Pause": 2}, selected="Pause")
data = Data(c_script_7.result)
data_2 = Data(c_script_8.result)
data_3 = Data(c_script_3.result)
c_script_9 = CSharpScript(
    positions=data_3,
    constraints=data,
    settings=data_2,
    subSteps=Slider(10, range=0..100),
    simState=list,
    Reference=["C:\USERS\DAVID.RE\APPDATA\ROAMING\GRASSHOPPER\LIBRARIES\SPATIALSLUR\SpatialSlur.dll", "C:\USERS\DAVID.RE\APPDATA\ROAMING\GRASSHOPPER\LIBRARIES\SPATIALSLUR\SlurRhino.dll"])  # -> out, result; inputs subSteps: Int32, simState: Int32
# ---------- c_script_9: C# ----------
    //reset
    if(simState == 0)
    {
      Reset();
      return;
    }

    // setup
    if(IsReset)
    {
      Init((IEnumerable<Vec3d>) positions);
    }

    // update constraints & settings
    _constraints = ((IEnumerable<IConstraint>) constraints).ToList();
    _solver.Settings = (ConstraintSolverSettings) settings;

    // step solver
    for(int i = 0; i < subSteps; i++)
      _solver.StepParallel(_particles, _constraints);

    // output
    Print(String.Format("Step {0}", _solver.StepCount));

    if(_solver.IsConverged)
      Print("Converged!");
    else
      Print("Solving...");

    result = new GH_ObjectWrapper(_particles.Select(p => p.Position));

    // expire solution
    if(simState == 1)
      Component.ExpireSolution(true);
# ---------- c_script_9: C# additional code ----------
  List<IBody> _particles;
  List<IConstraint> _constraints;
  ConstraintSolver _solver;


  /// <summary>
  ///
  /// </summary>
  bool IsReset
  {
    get{return _solver == null;}
  }


  /// <summary>
  ///
  /// </summary>
  void Reset()
  {
    _solver = null;
  }


  /// <summary>
  ///
  /// </summary>
  void Init(IEnumerable<Vec3d> particlePositions)
  {
    _particles = particlePositions.Select(p => (IBody) new SpatialSlur.SlurDynamics.Particle(p)).ToList();
    _solver = new ConstraintSolver();
  }
# ---------- end c_script_9 ----------
data_4 = Data(c_script_9.result)
panel = Panel(c_script_9.out)
hegraph_3 = HeGraph(hegraph_2)
data_5 = Data(data_4)
panel_2 = Panel("""0.1
0.5
0.9""")

# ---- group: Set Vertex Positions
c_script_10 = CSharpScript(
    heGraph=hegraph_3,
    positions=data_5,
    Reference=["C:\USERS\DAVID.RE\APPDATA\ROAMING\GRASSHOPPER\LIBRARIES\SPATIALSLUR\SpatialSlur.dll", "C:\USERS\DAVID.RE\APPDATA\ROAMING\GRASSHOPPER\LIBRARIES\SPATIALSLUR\SlurRhino.dll"])  # -> out, result
# ---------- c_script_10: C# ----------
    var heg = HeGraph3d.TryCast(heGraph).Duplicate();
    var vpos = (IEnumerable<Vec3d>) positions;

    var verts = heg.Vertices;
    int i = 0;
    
    foreach(var p in vpos)
      verts[i++].Position = p;
    
    result = heg;
# ---------- end c_script_10 ----------

# ----
merge = Merge(
    Data1=ColourSwatch(SwatchColor=RGB(255, 255, 255)),
    Data2=ColourSwatch(SwatchColor=RGB(255, 0, 150)),
    Data3=ColourSwatch(SwatchColor=RGB(0, 0, 0)))
num_3 = Number(panel_2)
interp = InterpolateData(Data=merge, Parameter=num_3, Interpolation=2)
merge_2 = Merge(
    Data1=ColourSwatch(SwatchColor=RGB(255, 255, 255)),
    Data2=ColourSwatch(SwatchColor=RGB(255, 0, 150)),
    Data3=ColourSwatch(SwatchColor=RGB(0, 0, 0)))

# ---- group: Display Edge Depth
c_script_11 = CSharpScript(
    heGraph=c_script_10.result,
    minWeight=Slider(1, range=0..10),
    maxWeight=Slider(22, range=0..100),
    colors=merge_2,
    Reference=["C:\USERS\DAVID.RE\APPDATA\ROAMING\GRASSHOPPER\LIBRARIES\SPATIALSLUR\SpatialSlur.dll", "C:\USERS\DAVID.RE\APPDATA\ROAMING\GRASSHOPPER\LIBRARIES\SPATIALSLUR\SlurRhino.dll"])  # -> out, result; inputs minWeight: Int32, maxWeight: Int32, colors: list of Color
# ---------- c_script_11: C# ----------
    var graph = HeGraph3d.TryCast(heGraph);
    var verts = graph.Vertices;
    var edges = graph.Edges;

    Func<HeGraph3d.V, Vec3d> getPos = v => v.Position;

    var depths = new int[verts.Count];
    graph.GetVertexDepths(verts.Where(v => v.IsDegree1), v => depths[v], (v, d) => depths[v] = d);

    var domain = new Domain(depths.Select(d => (double) d));

    foreach(var he in edges)
    {
      if(he.IsRemoved) continue;
      var t = domain.Normalize(Math.Min(depths[he.Start], depths[he.End]));

      _lines.Add(he.ToLine(getPos));
      _colors.Add(colors.Lerp(t));
      _weights.Add((int) SlurMath.Lerp(minWeight, maxWeight, t));
    }
# ---------- c_script_11: C# additional code ----------
  List<Line> _lines;
  List<Color> _colors;
  List<int> _weights;
  BoundingBox _clippingBox;


  /// <summary>
  ///
  /// </summary>
  public override void BeforeRunScript()
  {
    _lines = new List<Line>();
    _colors = new List<Color>();
    _weights = new List<int>();
    _clippingBox = BoundingBox.Empty;
  }


  /// <summary>
  ///
  /// </summary>
  public override BoundingBox ClippingBox
  {
    get {return _clippingBox;}
  }


  /// <summary>
  ///
  /// </summary>
  public override void DrawViewportWires(IGH_PreviewArgs args)
  {
    if(_lines == null) return;

    for(int i = 0; i < _lines.Count; i++)
      args.Display.DrawLine(_lines[i], _colors[i], _weights[i]);
  }
# ---------- end c_script_11 ----------

# ---- group: Vertex Positions
c_script_12 = CSharpScript(
    heGraph=c_script_10.result,
    Reference=["C:\USERS\DAVID.RE\APPDATA\ROAMING\GRASSHOPPER\LIBRARIES\SPATIALSLUR\SpatialSlur.dll", "C:\USERS\DAVID.RE\APPDATA\ROAMING\GRASSHOPPER\LIBRARIES\SPATIALSLUR\SlurRhino.dll"])  # -> out, result
# ---------- c_script_12: C# ----------
    var heg = HeGraph3d.TryCast(heGraph);
    result = heg.Vertices.Select(v => new GH_Point(v.Position.ToPoint3d()));
# ---------- end c_script_12 ----------

# ---- group: Edge Lines
c_script_13 = CSharpScript(
    heGraph=c_script_10.result,
    Reference=["C:\USERS\DAVID.RE\APPDATA\ROAMING\GRASSHOPPER\LIBRARIES\SPATIALSLUR\SpatialSlur.dll", "C:\USERS\DAVID.RE\APPDATA\ROAMING\GRASSHOPPER\LIBRARIES\SPATIALSLUR\SlurRhino.dll"])  # -> out, result
# ---------- c_script_13: C# ----------
    var heg = HeGraph3d.TryCast(heGraph);
    result = heg.Edges.Select(he => new GH_Line(he.ToLine(v => v.Position)));
# ---------- end c_script_13 ----------

# ---- group: Display Edge Depth
c_script_14 = CSharpScript(
    heGraph=c_script_10.result,
    minWeight=Slider(1, range=0..10),
    maxWeight=Slider(20, range=0..100),
    colors=interp,
    Reference=["C:\USERS\DAVID.RE\APPDATA\ROAMING\GRASSHOPPER\LIBRARIES\SPATIALSLUR\SpatialSlur.dll", "C:\USERS\DAVID.RE\APPDATA\ROAMING\GRASSHOPPER\LIBRARIES\SPATIALSLUR\SlurRhino.dll"])  # -> out, result; inputs minWeight: Int32, maxWeight: Int32, colors: list of Color
# ---------- c_script_14: C# ----------
    var graph = HeGraph3d.TryCast(heGraph);
    var verts = graph.Vertices;
    var edges = graph.Edges;

    Func<HeGraph3d.V, Vec3d> getPos = v => v.Position;

    var depths = new int[verts.Count];
    graph.GetVertexDepths(verts.Where(v => v.IsDegree1), v => depths[v], (v, d) => depths[v] = d);

    //reverse search from max depth
    //var max = verts.SelectMax(v => depths[v]);
    //graph.GetVertexDepths(max.Yield(), v => depths[v], (v, d) => depths[v] = d);

    var domain = new Domain(depths.Select(d => (double) d));

    foreach(var he in edges)
    {
      if(he.IsRemoved) continue;
      var t = domain.Normalize(Math.Max(depths[he.Start], depths[he.End]));

      _lines.Add(he.ToLine(getPos));
      _colors.Add(colors.Lerp(t));
      _weights.Add((int) SlurMath.Lerp(minWeight, maxWeight, t));
    }
# ---------- c_script_14: C# additional code ----------
  List<Line> _lines;
  List<Color> _colors;
  List<int> _weights;
  BoundingBox _clippingBox;


  /// <summary>
  ///
  /// </summary>
  public override void BeforeRunScript()
  {
    _lines = new List<Line>();
    _colors = new List<Color>();
    _weights = new List<int>();
    _clippingBox = BoundingBox.Empty;
  }


  /// <summary>
  ///
  /// </summary>
  public override BoundingBox ClippingBox
  {
    get {return _clippingBox;}
  }


  /// <summary>
  ///
  /// </summary>
  public override void DrawViewportWires(IGH_PreviewArgs args)
  {
    if(_lines == null) return;

    for(int i = 0; i < _lines.Count; i++)
      args.Display.DrawLine(_lines[i], _colors[i], _weights[i]);
  }
# ---------- end c_script_14 ----------

# ----
panel_3 = Panel(c_script_11.out)
