# Grasshopper definition 170731_Field_Integration_01.gh (Grasshopper 0.9.76)
# plug-ins: SpatialSlur.SlurGH

number_slider = Slider(0, range=0..3)
pt = Point(Point(10, 10, 10))
pt_2 = Point(Point(0, 0, 0))
number_slider_2 = Slider(0.224, range=0..1)
pt_3 = Point(Point(10, 10, 10))
pt_4 = Point(Point(0, 0, 0))
box = Box2Pt(PointA=pt_2, PointB=pt, Plane=PlaneXY(0, 0, 0))
box_2 = Box2Pt(PointA=pt_4, PointB=pt_3, Plane=PlaneXY(0, 0, 0))
num = Number(0.25)
int = Integer(50)
dispgridvecf = DisplayGridVectorField(Reference=["C:\USERS\DAVID\APPDATA\ROAMING\GRASSHOPPER\LIBRARIES\SPATIALSLUR\SpatialSlur.dll", "C:\USERS\DAVID\APPDATA\ROAMING\GRASSHOPPER\LIBRARIES\SPATIALSLUR\SlurRhino.dll"])  # -> out; inputs colors: list of Color, weight: Int32, scale: Double
# ---------- dispgridvecf: C# ----------
    var vf = (GridVectorField3d) field;
    var d = vf.Domain;
    int index = 0;

    for(int k = 0; k < vf.CountZ; k++)
    {
      for(int j = 0; j < vf.CountY; j++)
      {
        for(int i = 0; i < vf.CountX; i++)
        {
          var p = vf.CoordinateAt(i, j, k);

          _lines.Add(new Line(p.ToPoint3d(), vf.Values[index++].ToVector3d() * scale));
          _colors.Add(colors.Lerp(FieldFunc(d.Normalize(p))));
          _weights.Add(weight);
        }
      }
    }

    _clippingBox.Union(vf.Domain.ToBoundingBox());
# ---------- dispgridvecf: C# additional code ----------
  List<Line> _lines;
  List<Color> _colors;
  List<int> _weights;

  BoundingBox _clippingBox;


  /// <summary>
  /// This method will be called once every solution, before any calls to RunScript.
  /// </summary>
  public override void BeforeRunScript()
  {
    _lines = new List<Line>();
    _colors = new List<Color>();
    _weights = new List<int>();

    _clippingBox = BoundingBox.Empty;
  }


  //
  double FieldFunc(Vec3d point)
  {
    double x = 2.0 * (Math.Abs(point.X - 0.5));
    double y = 2.0 * (Math.Abs(point.Y - 0.5));
    double z = 2.0 * (Math.Abs(point.Z - 0.5));

    x = 1.0 - x * x * x;
    y = 1.0 - y * y * y;
    z = 1.0 - z * z * z;

    return x * y * z;
  }


  //Return a BoundingBox that contains all the geometry you are about to draw.
  public override BoundingBox ClippingBox
  {
    get{return _clippingBox;}
  }


  //Draw all wires and points in this method.
  public override void DrawViewportWires(IGH_PreviewArgs args)
  {
    for(int i = 0; i < _lines.Count; i++)
      args.Display.DrawLine(_lines[i], _colors[i], _weights[i]);
  }
# ---------- end dispgridvecf ----------

# ---- group: Create GridVectorField3d
c_script = CSharpScript(
    bounds=box,
    scaleX=num,
    scaleY=num,
    scaleZ=num,
    sampleMode=1,
    wrapMode=0,
    Reference=["C:\Users\David\AppData\Roaming\Grasshopper\Libraries\SpatialSlur\SpatialSlur.dll", "C:\Users\David\AppData\Roaming\Grasshopper\Libraries\SpatialSlur\SlurRhino.dll"])  # -> out, result; inputs bounds: Box, scaleX: Double, scaleY: Double, scaleZ: Double, wrapMode: Int32
# ---------- c_script: C# ----------
    BoundingBox bbox = bounds.BoundingBox;
    Domain3d domain = bbox.ToDomain3d();

    Vec3d span = domain.Span;
    int nx = (int) Math.Round(span.X / scaleX) + 1;
    int ny = (int) Math.Round(span.Y / scaleY) + 1;
    int nz = (int) Math.Round(span.Z / scaleZ) + 1;

    result = new GH_ObjectWrapper(new GridVectorField3d(domain, nx, ny, nz, (SampleMode) sampleMode, (WrapMode) wrapMode));

    _boxes.Add(bbox);
# ---------- c_script: C# additional code ----------
  List<BoundingBox> _boxes;
  BoundingBox _clippingBox;


  /// <summary>
  /// This method will be called once every solution, before any calls to RunScript.
  /// </summary>
  public override void BeforeRunScript()
  {
    _boxes = new List<BoundingBox>();
  }


  /// <summary>
  /// This method will be called once every solution, after any calls to RunScript.
  /// </summary>
  public override void AfterRunScript()
  {
    _clippingBox = BoundingBox.Empty;

    for(int i = 0; i < _boxes.Count; i++)
      _clippingBox.Union(_boxes[i]);
  }


  //Return a BoundingBox that contains all the geometry you are about to draw.
  public override BoundingBox ClippingBox
  {
    get
    {
      return _clippingBox;
    }
  }


  //Draw all wires and points in this method.
  public override void DrawViewportWires(IGH_PreviewArgs args)
  {
    base.DrawViewportWires(args);

    Color c = Color.Black;
    foreach(BoundingBox b in _boxes)
      args.Display.DrawBoxCorners(b, c);
  }
# ---------- end c_script ----------

c_script_2 = CSharpScript(
    bounds=box_2,
    countX=int,
    countY=int,
    countZ=int,
    sampleMode=1,
    wrapMode=0,
    Reference=["C:\Users\David\AppData\Roaming\Grasshopper\Libraries\SpatialSlur\SpatialSlur.dll", "C:\Users\David\AppData\Roaming\Grasshopper\Libraries\SpatialSlur\SlurRhino.dll"])  # -> out, result; inputs bounds: Box, countX: Int32, countY: Int32, countZ: Int32, wrapMode: Int32
# ---------- c_script_2: C# ----------
    BoundingBox bbox = bounds.BoundingBox;
    Domain3d domain = bbox.ToDomain3d();

    var field = new GridVectorField3d(domain, countX, countY, countZ, (SampleMode) sampleMode, (WrapMode) wrapMode);
    result = new GH_ObjectWrapper(field);

    _boxes.Add(bbox);
# ---------- c_script_2: C# additional code ----------
  List<BoundingBox> _boxes;
  BoundingBox _clippingBox;


  /// <summary>
  /// This method will be called once every solution, before any calls to RunScript.
  /// </summary>
  public override void BeforeRunScript()
  {
    _boxes = new List<BoundingBox>();
  }


  /// <summary>
  /// This method will be called once every solution, after any calls to RunScript.
  /// </summary>
  public override void AfterRunScript()
  {
    _clippingBox = BoundingBox.Empty;

    for(int i = 0; i < _boxes.Count; i++)
      _clippingBox.Union(_boxes[i]);
  }


  //Return a BoundingBox that contains all the geometry you are about to draw.
  public override BoundingBox ClippingBox
  {
    get
    {
      return _clippingBox;
    }
  }


  //Draw all wires and points in this method.
  public override void DrawViewportWires(IGH_PreviewArgs args)
  {
    base.DrawViewportWires(args);

    Color c = Color.Black;
    foreach(BoundingBox b in _boxes)
      args.Display.DrawBoxCorners(b, c);
  }
# ---------- end c_script_2 ----------

# ----
pt_5 = ConstructPoint(XCoordinate=number_slider_2, YCoordinate=number_slider_2, ZCoordinate=number_slider_2)
dom = ConstructDomain(DomainStart=0, DomainEnd=10)
range = Range(Domain=dom, Steps=Slider(1000, range=0..1000))

# ---- group: Curl Noise
c_script_3 = CSharpScript(
    field=c_script.result,
    scale=pt_5,
    Reference=["C:\USERS\DAVID\APPDATA\ROAMING\GRASSHOPPER\LIBRARIES\SPATIALSLUR\SpatialSlur.dll", "C:\USERS\DAVID\APPDATA\ROAMING\GRASSHOPPER\LIBRARIES\SPATIALSLUR\SlurRhino.dll"])  # -> out, result; inputs scale: Point3d; disabled
# ---------- c_script_3: C# ----------
    var f = ((GridVectorField3d) field).Duplicate();
    var t = scale.ToVec3d();

    f.SpatialFunctionXYZ(v => PerlinNoise.CurlAt(v * t), true);

    result = new GH_ObjectWrapper(f);
# ---------- end c_script_3 ----------

# ---- group: Vector Noise
c_script_4 = CSharpScript(
    field=c_script.result,
    scale=pt_5,
    Reference=["C:\USERS\DAVID\APPDATA\ROAMING\GRASSHOPPER\LIBRARIES\SPATIALSLUR\SpatialSlur.dll", "C:\USERS\DAVID\APPDATA\ROAMING\GRASSHOPPER\LIBRARIES\SPATIALSLUR\SlurRhino.dll"])  # -> out, result; inputs scale: Point3d
# ---------- c_script_4: C# ----------
    var f = ((GridVectorField3d) field).Duplicate();
    var t = scale.ToVec3d();

    f.SpatialFunctionXYZ(v => PerlinNoise.VectorAt(v * t), true);

    result = new GH_ObjectWrapper(f);
# ---------- end c_script_4 ----------

# ----
pt_6 = ConstructPoint(XCoordinate=range, YCoordinate=range, ZCoordinate=range)
creategridvecf = CreateGridVectorField(
    sampleMode=1,
    wrapMode=0,
    Reference=["C:\Users\David\AppData\Roaming\Grasshopper\Libraries\SpatialSlur\SpatialSlur.dll", "C:\Users\David\AppData\Roaming\Grasshopper\Libraries\SpatialSlur\SlurRhino.dll"])  # -> out, result; inputs bounds: Box, countX: Int32, countY: Int32, countZ: Int32, wrapMode: Int32; same code as c_script_2
creategridvecf_2 = CreateGridVectorField(
    sampleMode=1,
    wrapMode=0,
    Reference=["C:\Users\David\AppData\Roaming\Grasshopper\Libraries\SpatialSlur\SpatialSlur.dll", "C:\Users\David\AppData\Roaming\Grasshopper\Libraries\SpatialSlur\SlurRhino.dll"])  # -> out, result; inputs bounds: Box, countX: Int32, countY: Int32, countZ: Int32, wrapMode: Int32
# ---------- creategridvecf_2: C# ----------
    BoundingBox bbox = bounds.BoundingBox;
    Domain3d domain = bbox.ToDomain3d();

    var field = new GridScalarField3d(domain, countX, countY, countZ, (SampleMode) sampleMode, (WrapMode) wrapMode);
    result = new GH_ObjectWrapper(field);

    _boxes.Add(bbox);
# ---------- creategridvecf_2: C# additional code ----------
  List<BoundingBox> _boxes;
  BoundingBox _clippingBox;


  /// <summary>
  /// This method will be called once every solution, before any calls to RunScript.
  /// </summary>
  public override void BeforeRunScript()
  {
    _boxes = new List<BoundingBox>();
  }


  /// <summary>
  /// This method will be called once every solution, after any calls to RunScript.
  /// </summary>
  public override void AfterRunScript()
  {
    _clippingBox = BoundingBox.Empty;

    for(int i = 0; i < _boxes.Count; i++)
      _clippingBox.Union(_boxes[i]);
  }


  //Return a BoundingBox that contains all the geometry you are about to draw.
  public override BoundingBox ClippingBox
  {
    get
    {
      return _clippingBox;
    }
  }


  //Draw all wires and points in this method.
  public override void DrawViewportWires(IGH_PreviewArgs args)
  {
    base.DrawViewportWires(args);

    Color c = Color.Black;
    foreach(BoundingBox b in _boxes)
      args.Display.DrawBoxCorners(b, c);
  }
# ---------- end creategridvecf_2 ----------
creategridscalf = CreateGridScalarField(
    sampleMode=1,
    wrapMode=0,
    Reference=["C:\Users\David\AppData\Roaming\Grasshopper\Libraries\SpatialSlur\SpatialSlur.dll", "C:\Users\David\AppData\Roaming\Grasshopper\Libraries\SpatialSlur\SlurRhino.dll"])  # -> out, result; inputs bounds: Box, countX: Int32, countY: Int32, countZ: Int32, wrapMode: Int32; same code as creategridvecf_2
num_2 = Number(Slider(0.581, range=0..1))
pt_7 = Point(pt_6)
data = Data(c_script_4.result)

# ---- group: Create PerlinNoiseField
c_script_5 = CSharpScript(
    scaleX=num_2,
    scaleY=num_2,
    scaleZ=num_2,
    Reference=["C:\Users\David\AppData\Roaming\Grasshopper\Libraries\SpatialSlur\SpatialSlur.dll", "C:\Users\David\AppData\Roaming\Grasshopper\Libraries\SpatialSlur\SlurRhino.dll"])  # -> out, result; inputs scaleX: Double, scaleY: Double, scaleZ: Double
# ---------- c_script_5: C# ----------
    result = new PerlinNoiseField(scaleX, scaleY, scaleZ);
# ---------- end c_script_5 ----------

# ----
number_slider_3 = Slider(29, range=0..1000)
number_slider_4 = Slider(0.5, range=0..1)
data_2 = Data(c_script_5.result)
pt_8 = Point(pt_7)
integrate = IntegrateField(VectorField=data_2, Points=pt_8, StepSize=expr("-x", number_slider_4), StepCount=number_slider_3, IntegrationMode=2)
merge = Merge(
    Data1=ColourSwatch(SwatchColor=RGB(0, 0, 0)),
    Data2=ColourSwatch(SwatchColor=RGB(88, 136, 189)),
    Data3=ColourSwatch(SwatchColor=RGB(255, 255, 255)))  # -> reverse(Result)
integrate_2 = IntegrateField(VectorField=data_2, Points=pt_8, StepSize=number_slider_4, StepCount=number_slider_3, IntegrationMode=2)
data_3 = Data(data)
int_2 = Integer(1)
dispgridvecf_2 = DisplayGridVectorField(
    field=data_3,
    colors=merge,
    weight=int_2,
    scale=Slider(2.635, range=0..10),
    Reference=["C:\USERS\DAVID\APPDATA\ROAMING\GRASSHOPPER\LIBRARIES\SPATIALSLUR\SpatialSlur.dll", "C:\USERS\DAVID\APPDATA\ROAMING\GRASSHOPPER\LIBRARIES\SPATIALSLUR\SlurRhino.dll"])  # -> out; inputs colors: list of Color, weight: Int32, scale: Double; same code as dispgridvecf
