# Grasshopper definition 170912_Steiner_Tree_Finder_01.gh (Grasshopper 0.9.76)
# plug-ins: SpatialSlur.SlurGH

num = Number(0.01)
c_script = CSharpScript(
    minLength=num,
    timeStep=Slider(1, range=0..1),
    damping=Slider(0.1, range=0..1),
    subSteps=Slider(10, range=0..100),
    refineFreq=Slider(5, range=0..10),
    Reference=["C:\Users\david.re\AppData\Roaming\Grasshopper\Libraries\SpatialSlur\SpatialSlur.dll", "C:\Users\david.re\AppData\Roaming\Grasshopper\Libraries\SpatialSlur\SlurRhino.dll"])  # -> out, result; inputs minLength: Double, timeStep: Double, damping: Double, subSteps: Int32, refineFreq: Int32
# ---------- c_script: C# ----------
    var settings = new SteinerFinderSettings();
    settings.MinLength = minLength;
    settings.TimeStep = timeStep;
    settings.Damping = damping;
    settings.Tolerance = 1.0e-2;
    settings.SubSteps = subSteps;
    settings.RefineFrequency = refineFreq;

    result = settings;
# ---------- end c_script ----------
list = ValueList({"Reset": 0, "Play": 1, "Pause": 2}, selected="Pause")
pt = Point([Point(-5, -5, -10), Point(-5, 5, -10), Point(5, -5, -10), Point(5, 5, -10), Point(-5, -10, -5), Point(5, -10, -5), Point(-5, -10, 5), Point(5, -10, 5), Point(10, -5, -5), Point(10, 5, -5), Point(10, -5, 5), Point(10, 5, 5), Point(5, 10, -5), Point(-5, 10, -5), Point(5, 10, 5), Point(-5, 10, 5), Point(-10, 5, -5), Point(-10, -5, -5), Point(-10, 5, 5), Point(-10, -5, 5), Point(-5, -5, 10), Point(5, -5, 10), Point(-5, 5, 10), Point(5, 5, 10)])

# ---- group: Steiner Finder
c_script_2 = CSharpScript(
    points=pt,
    settings=c_script.result,
    simState=list,
    Reference=["C:\USERS\DAVID.RE\APPDATA\ROAMING\GRASSHOPPER\LIBRARIES\SPATIALSLUR\SpatialSlur.dll", "C:\USERS\DAVID.RE\APPDATA\ROAMING\GRASSHOPPER\LIBRARIES\SPATIALSLUR\SlurRhino.dll"])  # -> out, result; inputs points: list of Point3d, simState: Int32
# ---------- c_script_2: C# ----------
    // reset
    if(simState == 0)
    {
      _steiner = null;
      return;
    }

    // setup
    if(_steiner == null)
    {
      _steiner = SteinerFinder.CreateFromPoints(points.Select(p => p.ToVec3d()));
    }

    // update settings
    _steiner.Settings = (SteinerFinderSettings) settings;

    // step
    _steiner.Step();

    // output
    Print((_steiner.IsConverged) ? "Converged" : "Running");
    Print(String.Format("{0} steps", _steiner.StepCount));
    result = HeGraph3d.Factory.CreateCopy(_steiner.Graph, (v0,v1) => v0.Position = v1.Position, delegate{});

    // expire solution if playing
    if(simState == 1)
      Component.ExpireSolution(true);
# ---------- c_script_2: C# additional code ----------
  SteinerFinder _steiner;
# ---------- end c_script_2 ----------

# ----
edgelns = EdgeLines(HeGraph=c_script_2.result)
panel = Panel(c_script_2.out)
