# Grasshopper definition 170914_Sort_Faces_By_Depth_01.gh (Grasshopper 0.9.76)
# plug-ins: SpatialSlur.SlurGH

mesh = Mesh(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)
hemesh = HeMesh(mesh)
dual = CreateDual(HeMesh=hemesh)
merge = Merge(Data1=Slider(38, range=0..100), Data2=Slider(37, range=0..100))

# ---- group: Sort faces by depth
c_script = CSharpScript(
    heMesh=dual,
    faceIndices=merge,
    Reference=["C:\Users\david.re\AppData\Roaming\Grasshopper\Libraries\SpatialSlur\SpatialSlur.dll", "C:\Users\david.re\AppData\Roaming\Grasshopper\Libraries\SpatialSlur\SlurRhino.dll"])  # -> out, result, faceCount; inputs faceIndices: list of Int32
# ---------- c_script: C# ----------
    var hem = ((HeMesh3d) heMesh).Duplicate();
    var faces = hem.Faces;

    // external array to store depths
    var depths = new int[faces.Count];

    // property to get/set depth from a face
    var prop = Property.Create<HeMesh3d.Face, int>(f => depths[f], (f,d) => depths[f] = d);

    // calculate depths
    hem.GetFaceDepths(faceIndices.Select(i => faces[i]), prop);

    // sort faces by depth
    faces.Sort(f => depths[f]);
    // hem.Faces.Sort(prop.Get); // can also use the property's getter lambda which was created above

    result = hem;
    faceCount = faces.Count;
# ---------- end c_script ----------

# ----
range = Range(Domain=Domain(0, 1), Steps=expr("x-1", c_script.faceCount))
merge_2 = Merge(
    Data1=ColourSwatch(SwatchColor=RGB(255, 255, 255)),
    Data2=ColourSwatch(SwatchColor=RGB(255, 0, 100)),
    Data3=ColourSwatch(SwatchColor=RGB(0, 0, 0)))
panel = Panel(c_script.out)
interp = InterpolateData(Data=merge_2, Parameter=range, Interpolation=2)
facecol = DisplayFaceColors(HeMesh=c_script.result, Colors=interp)
