# Grasshopper definition Distance_Transform.gh (Grasshopper 1.0.7)

# Source image: "Hands" by Geoff McFetridge
path = FilePath("C:\Users\David\Google Drive\Repos\SpatialSlur\Examples\Resources\Images\Geoff-McFetridge-Hands.png")

# ---- group: GridField From Image
slurc = SlurCSharpScript(
    path=path,
    read=Toggle(True),
    Reference="C:\Users\David\AppData\Roaming\Grasshopper\Libraries\SpatialSlur\SpatialSlur.dll")  # -> out, result; inputs path: String, read: Boolean
# ---------- slurc: C# usings ----------
using System.Collections.Concurrent;
using System.Threading.Tasks;
using System.Linq;
using System.Drawing;

using SpatialSlur;
using SpatialSlur.Collections;
using SpatialSlur.Meshes;
using SpatialSlur.Fields;
using SpatialSlur.Rhino;

using Vec2d = SpatialSlur.Vector2d;
using Vec3d = SpatialSlur.Vector3d;
using Vec4d = SpatialSlur.Vector4d;
# ---------- slurc: C# ----------
    if(read)
    {
      using(var bitmap = new Bitmap(path))
      {
        result = GridField2d.Double.CreateFromImage(bitmap, c => c.R);
      }
    }
# ---------- end slurc ----------

# ----
img = ImportImage(File=path)
num = Number(100000000)

# ---- group: Bifurcate
slurc_2 = SlurCSharpScript(
    sampledField=slurc.result,
    threshold=Slider(120, range=0..255),
    scale=num,
    Reference="C:\USERS\DAVID\APPDATA\ROAMING\GRASSHOPPER\LIBRARIES\SPATIALSLUR\SpatialSlur.dll")  # -> out, result; inputs threshold: Double, scale: Double
# ---------- slurc_2: C# usings ----------
using System.Collections.Concurrent;
using System.Threading.Tasks;

using SpatialSlur;
using SpatialSlur.Collections;
using SpatialSlur.Meshes;
using SpatialSlur.Fields;
using SpatialSlur.Rhino;

using Vec3d = SpatialSlur.Vector3d;
using Vector3d = Rhino.Geometry.Vector3d;
# ---------- slurc_2: C# ----------
    var sf0 = (ISampledField<double>) sampledField;
    var sf1 = sf0.Duplicate(false);

    sf0.Convert(t => SlurMath.Step(t, threshold) * scale, sf1, true);
    result = sf1;
# ---------- end slurc_2 ----------

# ---- group: Distance Transform
slurc_3 = SlurCSharpScript(
    gridField=slurc_2.result,
    parallel=Toggle(True),
    Reference="C:\USERS\DAVID\APPDATA\ROAMING\GRASSHOPPER\LIBRARIES\SPATIALSLUR\SpatialSlur.dll")  # -> out, result; inputs parallel: Boolean
# ---------- slurc_3: C# ----------
    var f0 = (GridField2d<double>) gridField;
    var f1 = f0.Duplicate(false);

    if(dform == null)
      dform = new DistanceTransform();

    dform.CalculateL2(f0, f1, parallel);
    result = f1;
# ---------- slurc_3: C# additional code ----------
  DistanceTransform dform; // allow reuse of internal buffers
# ---------- end slurc_3 ----------

# ---- group: Contour
slurc_4 = SlurCSharpScript(
    field=slurc_3.result,
    range=Slider(20, range=0..100),
    Reference="C:\USERS\DAVID\APPDATA\ROAMING\GRASSHOPPER\LIBRARIES\SPATIALSLUR\SpatialSlur.dll")  # -> out, result; inputs range: Double
# ---------- slurc_4: C# ----------
    var f = (IField3d<double>) field;

    result = Field3d.Create(p =>
      {
      return SlurMath.Contour(f.ValueAt(p), range);
      });
# ---------- end slurc_4 ----------

# ----
data = Data(slurc_4.result)
merge = Merge(
    Data1=ColourSwatch(SwatchColor=RGB(255, 255, 255)),
    Data2=ColourSwatch(SwatchColor=RGB(70, 150, 150)),
    Data3=ColourSwatch(SwatchColor=RGB(0, 0, 0)))
data_2 = Data(data)

data_3 = Data(slurc.result)

# ---- group: Get Resolution
slurc_5 = SlurCSharpScript(gridField=data_3, Reference="C:\USERS\DAVID\APPDATA\ROAMING\GRASSHOPPER\LIBRARIES\SPATIALSLUR\SpatialSlur.dll")  # -> out, countX, countY
# ---------- slurc_5: C# usings ----------
using System.Collections.Concurrent;
using System.Threading.Tasks;
using System.Drawing;

using SpatialSlur;
using SpatialSlur.Collections;
using SpatialSlur.Meshes;
using SpatialSlur.Fields;
using SpatialSlur.Rhino;

using Vec3d = SpatialSlur.Vector3d;
using Vector3d = Rhino.Geometry.Vector3d;
# ---------- slurc_5: C# ----------
    var gf = (GridField2d<double>) gridField;
    countX = gf.CountX;
    countY = gf.CountY;
# ---------- end slurc_5 ----------

# ---- group: Get Bounds
slurc_6 = SlurCSharpScript(gridField=data_3, Reference="C:\USERS\DAVID\APPDATA\ROAMING\GRASSHOPPER\LIBRARIES\SPATIALSLUR\SpatialSlur.dll")  # -> out, result
# ---------- slurc_6: C# ----------
    var gf = (GridField2d<double>) gridField;
    result = gf.Bounds.ToBoundingBox();
# ---------- end slurc_6 ----------

# ----
mplane = MeshPlane(Boundary=slurc_6.result, WidthCount=slurc_5.countX, HeightCount=slurc_5.countY)  # -> Mesh, Area
num_2 = Number(slurc_5.countX)
mesh = Mesh(mplane.Mesh)

mesh_2 = Mesh(mesh)

# ---- group: Field Painter
slurc_7 = SlurCSharpScript(
    mesh=mesh_2,
    field=data_2,
    colors=merge,
    Reference="C:\Users\David\AppData\Roaming\Grasshopper\Libraries\SpatialSlur\SpatialSlur.dll")  # -> out, result; inputs mesh: Mesh, colors: list of Color
# ---------- slurc_7: C# ----------
    var f = (IField3d<double>) field;
    var verts = mesh.Vertices;

    mesh.ColorVertices(i =>
      {
      Vec3d p = verts[i];
      return colors.Lerp(f.ValueAt(p));
      }, true);

    result = mesh;
# ---------- end slurc_7 ----------

# ----
X = UnitX(Factor=expr("x * 1.2", num_2))
move = Move(Geometry=slurc_7.result, Motion=X)  # -> Geometry, Transform
