# Grasshopper definition Dynamic_Remesher.gh (Grasshopper 1.0.7)
# plug-ins: SpatialSlur.SlurGH, Weaverbird

pt = Point([<point referenced from the Rhino model> x6])

# ---- group: IDW Constant
c_script = CSharpScript(
    distance=Slider(5, range=0..100),
    value=Slider(1, range=0..1),
    Reference="C:\USERS\DAVID.RE\APPDATA\ROAMING\GRASSHOPPER\LIBRARIES\SPATIALSLUR\SpatialSlur.dll")  # -> out, result; inputs distance: Double, value: Double
# ---------- c_script: C# usings ----------
using System.Collections.Concurrent;
using System.Threading.Tasks;
using System.Linq;
using System.Drawing;

using SpatialSlur;
using SpatialSlur.Collections;
using SpatialSlur.Meshes;
using SpatialSlur.Fields;
using SpatialSlur.Rhino;

using Vec3d = SpatialSlur.Vector3d;
using Vector3d = Rhino.Geometry.Vector3d;
# ---------- c_script: C# ----------
    result = IDWConstant3d.Create(distance, value);
# ---------- end c_script ----------

# ---- group: IDW Point
c_script_2 = CSharpScript(
    point=pt,
    value=Slider(0, range=0..1),
    Reference="C:\USERS\DAVID.RE\APPDATA\ROAMING\GRASSHOPPER\LIBRARIES\SPATIALSLUR\SpatialSlur.dll")  # -> out, result; inputs point: Point3d, value: Double
# ---------- c_script_2: C# ----------
    result = IDWPoint3d.Create(point, value);
# ---------- end c_script_2 ----------

# ----
merge = Merge(Data1=c_script_2.result, Data2=c_script.result)

# ---- group: IDWScalarField
# Notes: Field defined by inverse distance weighting
# 
# https://en.wikipedia.org/wiki/Inverse_distance_weighting
c_script_3 = CSharpScript(
    objects=merge,
    power=Slider(3, range=0..10),
    Reference="C:\Users\david.re\AppData\Roaming\Grasshopper\Libraries\SpatialSlur\SpatialSlur.dll")  # -> out, result; inputs objects: list, power: Double
# ---------- c_script_3: C# ----------
    var field = IDWField3d.Double.Create(power);
    field.Objects.AddRange(objects.Select(obj => (IDWObject3d<double>) obj));

    result = new GH_ObjectWrapper(field);
# ---------- end c_script_3 ----------

# ----
dom = ConstructDomain(DomainStart=Slider(0.15, range=0.1..10), DomainEnd=Slider(3, range=0.1..20))

# ---- group: Input Mesh
# Notes: Feature geometry must be coincident with vertices of source mesh
mesh = Mesh(<mesh referenced from the Rhino model>)

# ----
data = Data(c_script_3.result)
wbnaked = WeaverbirdsNakedBoundary(MeshClosedPolylines=mesh)
num = Number(0.01)

# ---- group: Extrude
c_script_4 = CSharpScript(poly=wbnaked, Reference="C:\USERS\DAVID.RE\APPDATA\ROAMING\GRASSHOPPER\LIBRARIES\SPATIALSLUR\SpatialSlur.dll")  # -> out, result; inputs poly: Polyline, dir: Vector3d
# ---------- c_script_4: C# ----------
    result = RhinoFactory.Mesh.CreateExtrusion(poly, dir);
# ---------- end c_script_4 ----------

# ---- group: Remesher Settings
c_script_5 = CSharpScript(
    lengthRange=dom,
    lengthTolerance=Slider(0.05, range=0..1),
    featureWeight=Slider(100, range=0..1000),
    featureTolerance=num,
    refineFrequency=Slider(3, range=0..10),
    Reference="C:\USERS\DAVID.RE\APPDATA\ROAMING\GRASSHOPPER\LIBRARIES\SPATIALSLUR\SpatialSlur.dll")  # -> out, result; inputs lengthTolerance: Double, featureWeight: Double, featureTolerance: Double, refineFrequency: Int32
# ---------- c_script_5: C# usings ----------
using System.Collections.Concurrent;
using System.Threading.Tasks;
using System.Linq;
using System.Drawing;

using SpatialSlur;
using SpatialSlur.Collections;
using SpatialSlur.Meshes;
using SpatialSlur.Fields;
using SpatialSlur.Tools;
using SpatialSlur.Rhino;

using Vec3d = SpatialSlur.Vector3d;
using Vector3d = Rhino.Geometry.Vector3d;
# ---------- c_script_5: C# ----------
    result = new DynamicRemesher.Settings()
      {
        LengthRange = lengthRange,
        LengthTolerance = lengthTolerance,
        FeatureWeight = featureWeight,
        FeatureTolerance = featureTolerance,
        RefineFrequency = refineFrequency
        };
# ---------- end c_script_5 ----------

# ---- group: Create Features
c_script_6 = CSharpScript(geom=c_script_4.result, Reference="C:\USERS\DAVID.RE\APPDATA\ROAMING\GRASSHOPPER\LIBRARIES\SPATIALSLUR\SpatialSlur.dll")  # -> out, result
# ---------- c_script_6: C# usings ----------
using System.Collections.Concurrent;
using System.Threading.Tasks;
using System.Linq;
using System.Drawing;

using SpatialSlur;
using SpatialSlur.Collections;
using SpatialSlur.Meshes;
using SpatialSlur.Tools;
using SpatialSlur.Rhino;

using Vec3d = SpatialSlur.Vector3d;
using Vector3d = Rhino.Geometry.Vector3d;
# ---------- c_script_6: C# ----------
    if(geom is Point3d)
      result = new PointFeature((Point3d) geom);

    if(geom is Mesh)
      result = new MeshFeature((Mesh) geom);

    if(geom is Curve)
      result = new CurveFeature((Curve) geom);
# ---------- end c_script_6 ----------

# ----
data_2 = Data(c_script_6.result)
list = ValueList({"Reset": 0, "Play": 1, "Pause": 2}, selected="Reset")
data_3 = Data(c_script_5.result)
hemesh = HeMesh(mesh)
data_4 = Data(data_2)
mesh_2 = Mesh(mesh)
data_5 = Data(data)

# ---- group: Remesher
c_script_7 = CSharpScript(
    source=hemesh,
    target=mesh_2,
    features=data_4,
    lengthField=data_5,
    settings=data_3,
    subSteps=Slider(10, range=0..100),
    simState=list,
    Reference="C:\USERS\DAVID.RE\APPDATA\ROAMING\GRASSHOPPER\LIBRARIES\SPATIALSLUR\SpatialSlur.dll")  # -> out, result; inputs target: Mesh, features: list, subSteps: Int32, simState: Int32
# ---------- c_script_7: C# ----------
    // reset
    if(simState == 0)
    {
      _solver = null;
      return;
    }

    // setup
    if(_solver == null)
    {
      var mf = target == null ? null : new MeshFeature(target);
      var f = features == null ? null : features.Select(obj => (IFeature) obj);
      _solver = DynamicRemesher.Solver.Create((HeMesh3d) source, mf, f, (DynamicRemesher.Settings) settings);
    }
    else
    {
      _solver.Settings = (DynamicRemesher.Settings) settings;
    }

    features.Convert(obj => (IFeature) obj, _solver.Features);
    _solver.LengthField = (IField3d<double>) lengthField;

    // step
    for(int i = 0; i < subSteps; i++)
      _solver.Step();

    // output
    result = HeMesh3d.Factory.CreateCopy(_solver.Mesh, (v0, v1) => v0.Position = v1.Position);

    if(simState == 1)
      Component.ExpireSolution(true);
# ---------- c_script_7: C# additional code ----------
  DynamicRemesher.Solver _solver;
# ---------- end c_script_7 ----------

# ----
hemesh_2 = HeMesh(c_script_7.result)
panel = Panel(c_script_7.out)
merge_2 = Merge(
    Data1=ColourSwatch(SwatchColor=RGB(255, 255, 255)),
    Data2=ColourSwatch(SwatchColor=RGB(255, 0, 150)),
    Data3=ColourSwatch(SwatchColor=RGB(0, 0, 0)))
mesh_3 = Mesh(hemesh_2)
data_6 = Data(data)

# ---- group: Field Painter
c_script_8 = CSharpScript(
    field3d=data_6,
    mesh=mesh_3,
    colors=merge_2,
    Reference="C:\USERS\DAVID.RE\APPDATA\ROAMING\GRASSHOPPER\LIBRARIES\SPATIALSLUR\SpatialSlur.dll")  # -> out, result; inputs mesh: Mesh, colors: list of Color
# ---------- c_script_8: C# ----------
    var f = (IField3d<double>) field3d;
    var verts = mesh.Vertices;

    mesh.ColorVertices(i => colors.Lerp(f.ValueAt(verts[i])), true);

    result = mesh;
# ---------- end c_script_8 ----------
