# Grasshopper definition Dynamic_Remesher_01.gh (Grasshopper 0.9.76)
# plug-ins: SpatialSlur.SlurGH, Weaverbird

pt = Point([<point referenced from the Rhino model> x6])
# Notes: Field defined by inverse distance weighting
# 
# https://en.wikipedia.org/wiki/Inverse_distance_weighting
long = LongestList(ListA=pt, ListB=Slider(0, range=0..1), PaddingMode=2)  # -> ListA, ListB
pt_2 = Point(long.ListA)
num = Number(long.ListB)

dom = ConstructDomain(DomainStart=Slider(0.2, range=0.1..10), DomainEnd=Slider(2, range=0.1..20))

# ---- group: IDWScalarField
c_script = CSharpScript(
    points=pt_2,
    values=num,
    power=Slider(3, range=0..10),
    defaultValue=Slider(1, range=0..1),
    defaultWeight=Slider(0.01, range=0..0.1),
    Reference="C:\Users\david.re\AppData\Roaming\Grasshopper\Libraries\SpatialSlur\SpatialSlur.dll")  # -> out, result; inputs points: list of Point3d, values: list of Double, power: Double, defaultValue: Double, defaultWeight: Double
# ---------- c_script: C# ----------
    var field = IDWField3d.Double.Create(power);
    field.DefaultValue = defaultValue;
    field.DefaultWeight = defaultWeight;
    field.Points.AddRange(points.Convert((p,i) => IDWPoint3d.Create(p, values[i])));
    result = new GH_ObjectWrapper(field);
# ---------- end c_script ----------

# ---- group: Input Mesh
# Notes: Feature geometry must be coincident with vertices of source mesh
mesh = Mesh(<mesh referenced from the Rhino model>)

# ----
wbnaked = WeaverbirdsNakedBoundary(MeshClosedPolylines=mesh)
panel = Panel(c_script.out)
num_2 = Number(0.01)
data = Data(c_script.result)

# ---- group: Extrude
c_script_2 = CSharpScript(poly=wbnaked, Reference="C:\USERS\DAVID.RE\APPDATA\ROAMING\GRASSHOPPER\LIBRARIES\SPATIALSLUR\SpatialSlur.dll")  # -> out, result; inputs poly: Polyline, dir: Vector3d
# ---------- c_script_2: C# ----------
    result = RhinoFactory.Mesh.CreateExtrusion(poly, dir);
# ---------- end c_script_2 ----------

# ---- group: Remesher Settings
c_script_3 = CSharpScript(
    lengthRange=dom,
    lengthTolerance=Slider(0.05, range=0..1),
    featureWeight=Slider(100, range=0..1000),
    featureTolerance=num_2,
    refineFrequency=Slider(3, range=0..10),
    Reference="C:\USERS\DAVID.RE\APPDATA\ROAMING\GRASSHOPPER\LIBRARIES\SPATIALSLUR\SpatialSlur.dll")  # -> out, result; inputs lengthTolerance: Double, featureWeight: Double, featureTolerance: Double, refineFrequency: Int32
# ---------- c_script_3: C# ----------
    result = new DynamicRemesher.Settings()
      {
        LengthRange = lengthRange,
        LengthTolerance = lengthTolerance,
        FeatureWeight = featureWeight,
        FeatureTolerance=featureTolerance,
        RefineFrequency = refineFrequency
        };
# ---------- end c_script_3 ----------

# ---- group: Create Features
c_script_4 = CSharpScript(geom=c_script_2.result, Reference="C:\USERS\DAVID.RE\APPDATA\ROAMING\GRASSHOPPER\LIBRARIES\SPATIALSLUR\SpatialSlur.dll")  # -> out, result
# ---------- c_script_4: C# ----------
    if(geom is Point3d)
      result = new PointFeature((Point3d) geom);

    if(geom is Mesh)
      result = new MeshFeature((Mesh) geom);

    if(geom is Curve)
      result = new CurveFeature((Curve) geom);
# ---------- end c_script_4 ----------

# ----
data_2 = Data(c_script_4.result)
list = ValueList({"Reset": 0, "Play": 1, "Pause": 2}, selected="Pause")
hemesh = HeMesh(mesh)
mesh_2 = Mesh(mesh)
data_3 = Data(data_2)
data_4 = Data(data)
data_5 = Data(c_script_3.result)

# ---- group: Remesher
c_script_5 = CSharpScript(
    source=hemesh,
    target=mesh_2,
    features=data_3,
    lengthField=data_4,
    settings=data_5,
    subSteps=Slider(20, range=0..100),
    simState=list,
    Reference="C:\USERS\DAVID.RE\APPDATA\ROAMING\GRASSHOPPER\LIBRARIES\SPATIALSLUR\SpatialSlur.dll")  # -> out, result; inputs target: Mesh, features: list, subSteps: Int32, simState: Int32
# ---------- c_script_5: C# ----------
    // reset
    if(simState == 0)
    {
      _solver = null;
      return;
    }

    // setup
    if(_solver == null)
    {
      var mf = target == null ? null : new MeshFeature(target);
      var f = features == null ? null : features.Select(obj => (IFeature) obj);
      _solver = DynamicRemesher.Solver.Create((HeMesh3d) source, mf, f, (DynamicRemesher.Settings) settings);
    }
    else
    {
      _solver.Settings = (DynamicRemesher.Settings) settings;
    }

    features.Convert(obj => (IFeature) obj, _solver.Features);
    _solver.LengthField = (IField3d<double>) lengthField;

    // step
    for(int i = 0; i < subSteps; i++)
      _solver.Step();

    // output
    result = HeMesh3d.Factory.CreateCopy(_solver.Mesh, (v0, v1) => v0.Position = v1.Position);

    if(simState == 1)
      Component.ExpireSolution(true);
# ---------- c_script_5: C# additional code ----------
  DynamicRemesher.Solver _solver;
# ---------- end c_script_5 ----------

# ----
hemesh_2 = HeMesh(c_script_5.result)
panel_2 = Panel(c_script_5.out)
merge = Merge(
    Data1=ColourSwatch(SwatchColor=RGB(255, 255, 255)),
    Data2=ColourSwatch(SwatchColor=RGB(255, 0, 150)),
    Data3=ColourSwatch(SwatchColor=RGB(0, 0, 0)))
data_6 = Data(data)
mesh_3 = Mesh(hemesh_2)

# ---- group: Field Painter
c_script_6 = CSharpScript(
    field3d=data_6,
    mesh=mesh_3,
    colors=merge,
    Reference="C:\USERS\DAVID.RE\APPDATA\ROAMING\GRASSHOPPER\LIBRARIES\SPATIALSLUR\SpatialSlur.dll")  # -> out, result; inputs mesh: Mesh, colors: list of Color
# ---------- c_script_6: C# ----------
    var f = (IField3d<double>) field3d;
    var verts = mesh.Vertices;

    mesh.ColorVertices(i => colors.Lerp(f.ValueAt(verts[i])), true);

    result = mesh;
# ---------- end c_script_6 ----------
