# Grasshopper definition Funicular_Network.gh (Grasshopper 1.0.7)
# plug-ins: SpatialSlur.SlurGH

num = Number(0.001)
crv = Curve([<curve referenced from the Rhino model> x103])

# ---- group: HeGraph From Lines
c_script = CSharpScript(
    lines=crv,
    tolerance=num,
    Reference="C:\USERS\DAVID.RE\APPDATA\ROAMING\GRASSHOPPER\LIBRARIES\SPATIALSLUR\SpatialSlur.dll")  # -> out, result; inputs lines: list of Line, tolerance: Double
# ---------- c_script: C# usings ----------
using System.Collections.Concurrent;
using System.Threading.Tasks;
using System.Linq;

using SpatialSlur;
using SpatialSlur.Collections;
using SpatialSlur.Meshes;
using SpatialSlur.Fields;
using SpatialSlur.Tools;
using SpatialSlur.Rhino;

using Vec3d = SpatialSlur.Vector3d;
using Vector3d = Rhino.Geometry.Vector3d;
# ---------- c_script: C# ----------
    result = lines.ToHeGraph(tolerance);
# ---------- end c_script ----------

# ---- group: Split Edges
c_script_2 = CSharpScript(
    heGraph=c_script.result,
    targetLength=Slider(0.2, range=0.01..1),
    Reference="C:\USERS\DAVID.RE\APPDATA\ROAMING\GRASSHOPPER\LIBRARIES\SPATIALSLUR\SpatialSlur.dll")  # -> out, result; inputs targetLength: Double
# ---------- c_script_2: C# ----------
    var heg = new HeGraph3d((HeGraph3d) heGraph);

    var edges = heg.Edges;
    var ne = edges.Count;

    for(int i = 0; i < ne; i++)
    {
      var he = edges[i];

      var p = he.Start.Position;
      var d = he.End.Position - p;

      var n = (int) Math.Round(d.Length / targetLength) - 1;
      if(n < 1) continue;

      heg.DivideEdge(he, n);

      // set vertex positions
      var t = 1.0 / (n + 1);
      for(int j = 0; j <= n; j++)
      {
        he.Start.Position = p + d * (t * j);
        he = he.Twin.NextAtStart;
      }
    }

    result = heg;
# ---------- end c_script_2 ----------

# ----
hegraph = HeGraph(c_script_2.result)
hegraph_2 = HeGraph(hegraph)
Z = UnitZ(Factor=Slider(0.002, range=-0.01..0.01))

# ---- group: Linear Weights
c_script_3 = CSharpScript(
    heGraph=hegraph_2,
    direction=Z,
    massPerLength=Slider(1, range=0..10),
    Reference="C:\USERS\DAVID.RE\APPDATA\ROAMING\GRASSHOPPER\LIBRARIES\SPATIALSLUR\SpatialSlur.dll")  # -> out, result; inputs direction: Vector3d, massPerLength: Double
# ---------- c_script_3: C# usings ----------
using System.Collections.Concurrent;
using System.Threading.Tasks;
using System.Linq;

using SpatialSlur;
using SpatialSlur.Collections;
using SpatialSlur.Dynamics.Forces;
using SpatialSlur.Meshes;
using SpatialSlur.Fields;
using SpatialSlur.Rhino;

using Vec3d = SpatialSlur.Vector3d;
using Vector3d = Rhino.Geometry.Vector3d;
# ---------- c_script_3: C# ----------
    var heg = (HeGraph3d) heGraph;
    result = new GH_ObjectWrapper(heg.Edges.Select(he => new LinearWeight(he.Start, he.End, direction, massPerLength)));
# ---------- end c_script_3 ----------

# ---- group: Length Constraints
c_script_4 = CSharpScript(
    heGraph=hegraph_2,
    lengthFactor=Slider(1, range=0..2),
    weight=Slider(1, range=0..10),
    Reference="C:\USERS\DAVID.RE\APPDATA\ROAMING\GRASSHOPPER\LIBRARIES\SPATIALSLUR\SpatialSlur.dll")  # -> out, result; inputs lengthFactor: Double, weight: Double
# ---------- c_script_4: C# usings ----------
using System.Collections.Concurrent;
using System.Threading.Tasks;
using System.Linq;

using SpatialSlur;
using SpatialSlur.Collections;
using SpatialSlur.Dynamics.Constraints;
using SpatialSlur.Meshes;
using SpatialSlur.Fields;
using SpatialSlur.Tools;
using SpatialSlur.Rhino;

using Vec3d = SpatialSlur.Vector3d;
using Vector3d = Rhino.Geometry.Vector3d;
# ---------- c_script_4: C# ----------
    var heg = (HeGraph3d) heGraph;

    result = new GH_ObjectWrapper(heg.Edges.Select(he =>
      {
      var target = he.GetLength() * lengthFactor;
      return new Distance(he.Start, he.End, target, weight);
      }));
# ---------- end c_script_4 ----------

# ---- group: Create Bodies
c_script_5 = CSharpScript(heGraph=hegraph_2, Reference="C:\Users\david.re\AppData\Roaming\Grasshopper\Libraries\SpatialSlur\SpatialSlur.dll")  # -> out, result
# ---------- c_script_5: C# usings ----------
using System.Collections.Concurrent;
using System.Threading.Tasks;
using System.Linq;

using SpatialSlur;
using SpatialSlur.Collections;
using SpatialSlur.Dynamics;
using SpatialSlur.Meshes;
using SpatialSlur.Fields;
using SpatialSlur.Tools;
using SpatialSlur.Rhino;

using Vec3d = SpatialSlur.Vector3d;
using Vector3d = Rhino.Geometry.Vector3d;
# ---------- c_script_5: C# ----------
    var g = (HeGraph3d) heGraph;
    result = new GH_ObjectWrapper(g.Vertices.Select(v => new Body(v.Position)));
# ---------- end c_script_5 ----------

# ---- group: Position Constraints
c_script_6 = CSharpScript(
    heGraph=hegraph_2,
    weight=Slider(100, range=0..1000),
    Reference="C:\USERS\DAVID.RE\APPDATA\ROAMING\GRASSHOPPER\LIBRARIES\SPATIALSLUR\SpatialSlur.dll")  # -> out, result; inputs weight: Double
# ---------- c_script_6: C# ----------
    var heg = (HeGraph3d) heGraph;
    result = new GH_ObjectWrapper(heg.Vertices.Where(v => v.IsDegree1).Select(v => new OnPosition(v.Index, v.Position, weight)));
# ---------- end c_script_6 ----------

# ----
num_2 = Number(0.0001)
data = Data(c_script_5.result)

# ---- group: Gather Constraints
c_script_7 = CSharpScript(
    constraints=flatten([c_script_4.result, c_script_3.result, c_script_6.result]),
    Reference="C:\USERS\DAVID.RE\APPDATA\ROAMING\GRASSHOPPER\LIBRARIES\SPATIALSLUR\SpatialSlur.dll")  # -> out, result; inputs constraints: list
# ---------- c_script_7: C# usings ----------
using System.IO;
using System.Linq;
using System.Data;
using System.Drawing;
using System.Reflection;
using System.Windows.Forms;
using System.Xml;
using System.Xml.Linq;
using System.Runtime.InteropServices;

using Rhino.DocObjects;
using Rhino.Collections;
using GH_IO;
using GH_IO.Serialization;
using SpatialSlur;
using SpatialSlur.Tools;
using SpatialSlur.Meshes;
using SpatialSlur.Meshes.Impl;
using SpatialSlur.Rhino;
using SpatialSlur.Fields;
using SpatialSlur.Dynamics;
using SpatialSlur.Dynamics.Forces;
using SpatialSlur.Dynamics.Constraints;
using SpatialSlur.Collections;
# ---------- c_script_7: C# ----------
    result = new GH_ObjectWrapper(constraints.SelectMany(obj => (IEnumerable<IConstraint>) obj).ToArray());
# ---------- end c_script_7 ----------

# ---- group: Settings
c_script_8 = CSharpScript(
    timeStep=Slider(1, range=0..2),
    damping=Slider(0.01, range=0..1),
    tolerance=num_2,
    Reference="C:\USERS\DAVID.RE\APPDATA\ROAMING\GRASSHOPPER\LIBRARIES\SPATIALSLUR\SpatialSlur.dll")  # -> out, result; inputs timeStep: Double, damping: Double, tolerance: Double
# ---------- c_script_8: C# usings ----------
using System.Collections.Concurrent;
using System.Threading.Tasks;
using System.Linq;

using SpatialSlur;
using SpatialSlur.Collections;
using SpatialSlur.Dynamics;
using SpatialSlur.Meshes;
using SpatialSlur.Fields;
using SpatialSlur.Rhino;

using Vec3d = SpatialSlur.Vector3d;
using Vector3d = Rhino.Geometry.Vector3d;
# ---------- c_script_8: C# ----------
    result = new ConstraintSolverSettings(){TimeStep = timeStep, LinearDamping = damping, LinearTolerance = tolerance};
# ---------- end c_script_8 ----------

# ----
data_2 = Data(c_script_8.result)
data_3 = Data(c_script_7.result)
list = ValueList({"Reset": 0, "Play": 1, "Pause": 2}, selected="Reset")
data_4 = Data(data)
data_5 = Data(data_3)
data_6 = Data(data_2)
c_script_9 = CSharpScript(
    bodies=data_4,
    constraints=data_5,
    settings=data_6,
    subSteps=Slider(20, range=0..100),
    parallel=Toggle(False),
    simState=list,
    Reference="C:\USERS\DAVID.RE\APPDATA\ROAMING\GRASSHOPPER\LIBRARIES\SPATIALSLUR\SpatialSlur.dll")  # -> out, result; inputs subSteps: Int32, parallel: Boolean, simState: Int32
# ---------- c_script_9: C# ----------
    //reset
    if(simState == 0)
    {
      Reset();
      return;
    }

    // setup
    if(IsReset)
    {
      Init((IEnumerable<Body>) bodies);
    }

    // update constraints & settings
    var consts = (IConstraint[]) constraints;
    _solver.Settings = (ConstraintSolverSettings) settings;

    // step solver
    for(int i = 0; i < subSteps; i++)
      _solver.Step(_bodies, consts, parallel);

    // output
    Print(String.Format("Step {0}", _solver.StepCount));

    if(_solver.IsConverged)
      Print("Converged!");
    else
      Print("Solving...");

    result = new GH_ObjectWrapper(_bodies.Select(b => b.Position.Current));

    // expire solution
    if(simState == 1)
      Component.ExpireSolution(true);
# ---------- c_script_9: C# additional code ----------
  Body[] _bodies;
  ConstraintSolver _solver;


  /// <summary>
  ///
  /// </summary>
  bool IsReset
  {
    get{return _solver == null;}
  }


  /// <summary>
  ///
  /// </summary>
  void Reset()
  {
    _solver = null;
  }


  /// <summary>
  ///
  /// </summary>
  void Init(IEnumerable<Body> bodies)
  {
    _bodies = bodies.Select(b => b.Duplicate()).ToArray();
    _solver = new ConstraintSolver();
  }
# ---------- end c_script_9 ----------
panel = Panel(c_script_9.out)
data_7 = Data(c_script_9.result)
hegraph_3 = HeGraph(hegraph_2)
data_8 = Data(data_7)

# ---- group: Set Vertex Positions
c_script_10 = CSharpScript(
    heGraph=hegraph_3,
    positions=data_8,
    Reference="C:\USERS\DAVID.RE\APPDATA\ROAMING\GRASSHOPPER\LIBRARIES\SPATIALSLUR\SpatialSlur.dll")  # -> out, result
# ---------- c_script_10: C# ----------
    var heg = new HeGraph3d((HeGraph3d) heGraph);
    var vpos = (IEnumerable<Vec3d>) positions;

    var verts = heg.Vertices;
    int i = 0;

    foreach(var p in vpos)
      verts[i++].Position = p;

    result = heg;
# ---------- end c_script_10 ----------

# ----
merge = Merge(
    Data1=ColourSwatch(SwatchColor=RGB(255, 255, 255)),
    Data2=ColourSwatch(SwatchColor=RGB(255, 0, 150)),
    Data3=ColourSwatch(SwatchColor=RGB(0, 0, 0)))

# ---- group: Display Edge Depth
c_script_11 = CSharpScript(
    heGraph=c_script_10.result,
    minWeight=Slider(1, range=0..10),
    maxWeight=Slider(24, range=0..100),
    colors=merge,
    Reference="C:\USERS\DAVID.RE\APPDATA\ROAMING\GRASSHOPPER\LIBRARIES\SPATIALSLUR\SpatialSlur.dll")  # -> out; inputs minWeight: Int32, maxWeight: Int32, colors: list of Color
# ---------- c_script_11: C# usings ----------
using System.Collections.Concurrent;
using System.Threading.Tasks;
using System.Linq;
using System.Drawing;

using SpatialSlur;
using SpatialSlur.Collections;
using SpatialSlur.Dynamics;
using SpatialSlur.Meshes;
using SpatialSlur.Fields;
using SpatialSlur.Rhino;

using Vec3d = SpatialSlur.Vector3d;
using Vector3d = Rhino.Geometry.Vector3d;
# ---------- c_script_11: C# ----------
    var graph = (HeGraph3d) heGraph;
    var verts = graph.Vertices;
    var edges = graph.Edges;

    var depths = new int[verts.Count];
    var depthProp = new Property<HeGraph3d.Vertex, int>(v => depths[v], (v, d) => depths[v] = d);
    graph.GetVertexDepths(verts.Where(v => v.IsDegree1), depthProp);

    var interv = new Intervald(depths.Select(d => (double) d));
    Func<HeGraph3d.Vertex, Vec3d> getPos = v => v.Position;

    foreach(var he in edges)
    {
      if(he.IsUnused) continue;
      var t = interv.Normalize(Math.Min(depths[he.Start], depths[he.End]));

      _lines.Add(he.ToLine(getPos));
      _colors.Add(colors.Lerp(t));
      _weights.Add((int) SlurMath.Lerp(minWeight, maxWeight, t));
    }

    _clippingBox.Union(new BoundingBox(verts.Select(v => (Point3d) v.Position)));
# ---------- c_script_11: C# additional code ----------
  List<Line> _lines;
  List<Color> _colors;
  List<int> _weights;
  BoundingBox _clippingBox;


  /// <summary>
  ///
  /// </summary>
  public override void BeforeRunScript()
  {
    _lines = new List<Line>();
    _colors = new List<Color>();
    _weights = new List<int>();
    _clippingBox = BoundingBox.Empty;
  }


  /// <summary>
  ///
  /// </summary>
  public override BoundingBox ClippingBox
  {
    get {return _clippingBox;}
  }


  /// <summary>
  ///
  /// </summary>
  public override void DrawViewportWires(IGH_PreviewArgs args)
  {
    if(_lines == null) return;

    for(int i = 0; i < _lines.Count; i++)
      args.Display.DrawLine(_lines[i], _colors[i], _weights[i]);
  }
# ---------- end c_script_11 ----------
