# Grasshopper definition Funicular_Network_01.gh (Grasshopper 0.9.76)
# plug-ins: SpatialSlur.SlurGH

num = Number(0.001)
crv = Curve([<curve referenced from the Rhino model> x103])

# ---- group: HeGraph From Lines
c_script = CSharpScript(
    lines=crv,
    tolerance=num,
    Reference="C:\USERS\DAVID.RE\APPDATA\ROAMING\GRASSHOPPER\LIBRARIES\SPATIALSLUR\SpatialSlur.dll")  # -> out, result; inputs lines: list of Line, tolerance: Double
# ---------- c_script: C# ----------
    result = lines.ToHeGraph(tolerance);
# ---------- end c_script ----------

# ---- group: Split Edges
c_script_2 = CSharpScript(
    heGraph=c_script.result,
    targetLength=Slider(0.1, range=0.01..1),
    Reference="C:\USERS\DAVID.RE\APPDATA\ROAMING\GRASSHOPPER\LIBRARIES\SPATIALSLUR\SpatialSlur.dll")  # -> out, result; inputs targetLength: Double
# ---------- c_script_2: C# ----------
    var heg = new HeGraph3d((HeGraph3d) heGraph);

    var edges = heg.Edges;
    var ne = edges.Count;

    for(int i = 0; i < ne; i++)
    {
      var he = edges[i];

      var p = he.Start.Position;
      var d = he.End.Position - p;

      var n = (int) Math.Round(d.Length / targetLength) - 1;
      if(n < 1) continue;

      heg.DivideEdge(he, n);

      // set vertex positions
      var t = 1.0 / (n + 1);
      for(int j = 0; j <= n; j++)
      {
        he.Start.Position = p + d * (t * j);
        he = he.Twin.NextAtStart;
      }
    }

    result = heg;
# ---------- end c_script_2 ----------

# ----
hegraph = HeGraph(c_script_2.result)
hegraph_2 = HeGraph(hegraph)
Z = UnitZ(Factor=Slider(0.002, range=-0.01..0.01))

# ---- group: Linear Weights
c_script_3 = CSharpScript(
    heGraph=hegraph_2,
    direction=Z,
    massPerLength=Slider(1, range=0..10),
    Reference="C:\USERS\DAVID.RE\APPDATA\ROAMING\GRASSHOPPER\LIBRARIES\SPATIALSLUR\SpatialSlur.dll")  # -> out, result; inputs direction: Vector3d, massPerLength: Double
# ---------- c_script_3: C# ----------
    var heg = (HeGraph3d) heGraph;
    result = new GH_ObjectWrapper(heg.Edges.Select(he => new LinearWeight(he.Start, he.End, direction, massPerLength)));
# ---------- end c_script_3 ----------

# ---- group: Length Constraints
c_script_4 = CSharpScript(
    heGraph=hegraph_2,
    lengthFactor=Slider(1.194, range=0..2),
    weight=Slider(1, range=0..10),
    Reference="C:\USERS\DAVID.RE\APPDATA\ROAMING\GRASSHOPPER\LIBRARIES\SPATIALSLUR\SpatialSlur.dll")  # -> out, result; inputs lengthFactor: Double, weight: Double
# ---------- c_script_4: C# ----------
    var heg = (HeGraph3d) heGraph;
    Func<HeGraph3d.Vertex, Vec3d> getPos = v => v.Position;

    result = new GH_ObjectWrapper(heg.Edges.Select(he =>
      {
      var length = he.GetLength(getPos) * lengthFactor;
      return new Distance(he.Start, he.End, length, weight);
      }));
# ---------- end c_script_4 ----------

# ---- group: Create Particles
c_script_5 = CSharpScript(heGraph=hegraph_2, Reference="C:\Users\david.re\AppData\Roaming\Grasshopper\Libraries\SpatialSlur\SpatialSlur.dll")  # -> out, result
# ---------- c_script_5: C# ----------
    var heg = (HeGraph3d) heGraph;
    result = new GH_ObjectWrapper(heg.Vertices.Select(v => new SpatialSlur.SlurDynamics.Particle(v.Position)));
# ---------- end c_script_5 ----------

# ---- group: Position Constraints
c_script_6 = CSharpScript(
    heGraph=hegraph_2,
    weight=Slider(100, range=0..1000),
    Reference="C:\USERS\DAVID.RE\APPDATA\ROAMING\GRASSHOPPER\LIBRARIES\SPATIALSLUR\SpatialSlur.dll")  # -> out, result; inputs weight: Double
# ---------- c_script_6: C# ----------
    var heg = (HeGraph3d) heGraph;
    result = new GH_ObjectWrapper(heg.Vertices.Where(v => v.IsDegree1).Select(v => new OnPosition(v.Index, v.Position, weight)));
# ---------- end c_script_6 ----------

# ----
num_2 = Number(0.0001)
data = Data(c_script_5.result)

# ---- group: Settings
c_script_7 = CSharpScript(
    timeStep=Slider(1, range=0..2),
    damping=Slider(0.01, range=0..1),
    tolerance=num_2,
    Reference="C:\USERS\DAVID.RE\APPDATA\ROAMING\GRASSHOPPER\LIBRARIES\SPATIALSLUR\SpatialSlur.dll")  # -> out, result; inputs timeStep: Double, damping: Double, tolerance: Double
# ---------- c_script_7: C# ----------
    result = new ConstraintSolverSettings(){TimeStep = timeStep, Damping = damping, Tolerance = tolerance};
# ---------- end c_script_7 ----------

# ---- group: Gather Constraints
c_script_8 = CSharpScript(
    constraints=flatten([c_script_4.result, c_script_3.result, c_script_6.result]),
    Reference="C:\USERS\DAVID.RE\APPDATA\ROAMING\GRASSHOPPER\LIBRARIES\SPATIALSLUR\SpatialSlur.dll")  # -> out, result; inputs constraints: list
# ---------- c_script_8: C# ----------
    result = new GH_ObjectWrapper(constraints.SelectMany(obj => (IEnumerable<IConstraint>) obj));
# ---------- end c_script_8 ----------

# ----
data_2 = Data(c_script_7.result)
data_3 = Data(c_script_8.result)
list = ValueList({"Reset": 0, "Play": 1, "Pause": 2}, selected="Pause")
data_4 = Data(data)
data_5 = Data(data_3)
data_6 = Data(data_2)
panel = Panel(data_5)
c_script_9 = CSharpScript(
    particles=data_4,
    constraints=data_5,
    settings=data_6,
    subSteps=Slider(20, range=0..100),
    parallel=Toggle(True),
    simState=list,
    Reference="C:\USERS\DAVID.RE\APPDATA\ROAMING\GRASSHOPPER\LIBRARIES\SPATIALSLUR\SpatialSlur.dll")  # -> out, result; inputs subSteps: Int32, parallel: Boolean, simState: Int32
# ---------- c_script_9: C# ----------
    //reset
    if(simState == 0)
    {
      Reset();
      return;
    }

    // setup
    if(IsReset)
    {
      Init((IEnumerable<IBody>) particles);
    }

    // update constraints & settings
    _constraints = ((IEnumerable<IConstraint>) constraints).ToList();
    _solver.Settings = (ConstraintSolverSettings) settings;

    // step solver
    for(int i = 0; i < subSteps; i++)
      _solver.Step(_particles, _constraints, parallel);

    // output
    Print(String.Format("Step {0}", _solver.StepCount));

    if(_solver.IsConverged)
      Print("Converged!");
    else
      Print("Solving...");

    result = new GH_ObjectWrapper(_particles.Select(p => p.Position));

    // expire solution
    if(simState == 1)
      Component.ExpireSolution(true);
# ---------- c_script_9: C# additional code ----------
  List<IBody> _particles;
  List<IConstraint> _constraints;
  ConstraintSolver _solver;


  /// <summary>
  ///
  /// </summary>
  bool IsReset
  {
    get{return _solver == null;}
  }


  /// <summary>
  ///
  /// </summary>
  void Reset()
  {
    _solver = null;
  }


  /// <summary>
  ///
  /// </summary>
  void Init(IEnumerable<IBody> particles)
  {
    _particles = particles.Select(p => p.Duplicate()).ToList();
    _solver = new ConstraintSolver();
  }
# ---------- end c_script_9 ----------
data_7 = Data(c_script_9.result)
panel_2 = Panel(c_script_9.out)
hegraph_3 = HeGraph(hegraph_2)
data_8 = Data(data_7)

# ---- group: Set Vertex Positions
c_script_10 = CSharpScript(
    heGraph=hegraph_3,
    positions=data_8,
    Reference="C:\USERS\DAVID.RE\APPDATA\ROAMING\GRASSHOPPER\LIBRARIES\SPATIALSLUR\SpatialSlur.dll")  # -> out, result
# ---------- c_script_10: C# ----------
    var heg = new HeGraph3d((HeGraph3d) heGraph);
    var vpos = (IEnumerable<Vec3d>) positions;

    var verts = heg.Vertices;
    int i = 0;

    foreach(var p in vpos)
      verts[i++].Position = p;

    result = heg;
# ---------- end c_script_10 ----------

# ----
merge = Merge(
    Data1=ColourSwatch(SwatchColor=RGB(255, 255, 255)),
    Data2=ColourSwatch(SwatchColor=RGB(255, 0, 150)),
    Data3=ColourSwatch(SwatchColor=RGB(0, 0, 0)))
hegraph_4 = HeGraph(c_script_10.result)
bbox = BoundingBox(Content=hegraph_4, Plane=PlaneXY(0, 0, 0))  # -> Box, Box_2

# ---- group: Display Edge Depth
c_script_11 = CSharpScript(
    heGraph=c_script_10.result,
    minWeight=Slider(1, range=0..10),
    maxWeight=Slider(36, range=0..100),
    colors=merge,
    Reference="C:\USERS\DAVID.RE\APPDATA\ROAMING\GRASSHOPPER\LIBRARIES\SPATIALSLUR\SpatialSlur.dll")  # -> out, result; inputs minWeight: Int32, maxWeight: Int32, colors: list of Color
# ---------- c_script_11: C# ----------
    var graph = (HeGraph3d) heGraph;
    var verts = graph.Vertices;
    var edges = graph.Edges;

    var depths = new int[verts.Count];
    var depthProp = new Property<HeGraph3d.Vertex, int>(v => depths[v], (v, d) => depths[v] = d);
    graph.GetVertexDepths(verts.Where(v => v.IsDegree1), depthProp);

    var interv = new Intervald(depths.Select(d => (double) d));
    Func<HeGraph3d.Vertex, Vec3d> getPos = v => v.Position;

    foreach(var he in edges)
    {
      if(he.IsUnused) continue;
      var t = interv.Normalize(Math.Min(depths[he.Start], depths[he.End]));

      _lines.Add(he.ToLine(getPos));
      _colors.Add(colors.Lerp(t));
      _weights.Add((int) SlurMath.Lerp(minWeight, maxWeight, t));
    }

    _clippingBox.Union(new BoundingBox(verts.Select(v => (Point3d) v.Position)));
# ---------- c_script_11: C# additional code ----------
  List<Line> _lines;
  List<Color> _colors;
  List<int> _weights;
  BoundingBox _clippingBox;


  /// <summary>
  ///
  /// </summary>
  public override void BeforeRunScript()
  {
    _lines = new List<Line>();
    _colors = new List<Color>();
    _weights = new List<int>();
    _clippingBox = BoundingBox.Empty;
  }


  /// <summary>
  ///
  /// </summary>
  public override BoundingBox ClippingBox
  {
    get {return _clippingBox;}
  }


  /// <summary>
  ///
  /// </summary>
  public override void DrawViewportWires(IGH_PreviewArgs args)
  {
    if(_lines == null) return;

    for(int i = 0; i < _lines.Count; i++)
      args.Display.DrawLine(_lines[i], _colors[i], _weights[i]);
  }
# ---------- end c_script_11 ----------
