# Grasshopper definition Geodesic_Field.gh (Grasshopper 1.0.7)
# plug-ins: SpatialSlur.SlurGH

mesh = Mesh([<mesh referenced from the Rhino model> x2])
mjoin = MeshJoin(Meshes=mesh)

# ---- group: Cost Field
mesh_2 = Mesh(mjoin)
dom = ConstructDomain(DomainStart=0, DomainEnd=Slider(7.675, range=0..10))
dom_2 = ConstructDomain(DomainStart=0, DomainEnd=1)
dom_3 = ConstructDomain(DomainStart=Slider(9.305, range=0..100), DomainEnd=Slider(1, range=0..10))

# ---- group: Cost Field / Distance to Mesh
slurc = SlurCSharpScript(mesh=mesh_2, Reference="C:\USERS\DAVID.RE\APPDATA\ROAMING\GRASSHOPPER\LIBRARIES\SPATIALSLUR\SpatialSlur.dll")  # -> out, result; inputs mesh: Mesh
# ---------- slurc: C# usings ----------
using System.Collections.Concurrent;
using System.Threading.Tasks;

using SpatialSlur;
using SpatialSlur.Collections;
using SpatialSlur.Meshes;
using SpatialSlur.Fields;
using SpatialSlur.Rhino;

using Vec3d = SpatialSlur.Vector3d;
using Vector3d = Rhino.Geometry.Vector3d;
# ---------- slurc: C# ----------
    result = Field3d.CreateDistance(mesh);
# ---------- end slurc ----------

# ---- group: Grid
number_slider = Slider(100, range=0..1000)
pt = Point(<point referenced from the Rhino model>)
pt_2 = Point(<point referenced from the Rhino model>)
box = Box2Pt(PointA=pt, PointB=pt_2, Plane=PlaneXY(0, 0, 0))
gridfield = CreateGridField(BoundingBox=box, CountX=number_slider, CountY=number_slider)
data = Data(gridfield)

# ---- group: Cost Field / SmoothStep
slurc_2 = SlurCSharpScript(
    field=slurc.result,
    range=dom,
    Reference="C:\USERS\DAVID.RE\APPDATA\ROAMING\GRASSHOPPER\LIBRARIES\SPATIALSLUR\SpatialSlur.dll")  # -> out, result
# ---------- slurc_2: C# ----------
    var f = (IField3d<double>) field;

    var t0 = range.T0;
    var t1 = range.T1;

    result = Field3d.Create(p => SlurMath.SmoothStep(f.ValueAt(p), t0, t1));
# ---------- end slurc_2 ----------

# ----
int = Integer(100)

# ---- group: Cost Field / Remap
slurc_3 = SlurCSharpScript(
    field=slurc_2.result,
    from=dom_2,
    to=dom_3,
    Reference="C:\USERS\DAVID.RE\APPDATA\ROAMING\GRASSHOPPER\LIBRARIES\SPATIALSLUR\SpatialSlur.dll")  # -> out, result
# ---------- slurc_3: C# ----------
    var f = (IField3d<double>) field;

    var a0 = from.T0;
    var a1 = from.T1;

    var b0 = to.T0;
    var b1 = to.T1;

    result = Field3d.Create(p =>
      {
      var t = f.ValueAt(p);
      return SlurMath.Remap(t, a0, a1, b0, b1);
      });
# ---------- end slurc_3 ----------

# ----
mplane = MeshPlane(Boundary=box, WidthCount=int, HeightCount=int)  # -> Mesh, Area
mesh_3 = Mesh(mplane.Mesh)
data_2 = Data(slurc_3.result)
number_slider_2 = Slider(0.1, range=0..1)
mesh_4 = Mesh(<mesh referenced from the Rhino model>)
slurc_4 = SlurCSharpScript(mesh=mesh_4, Reference="C:\USERS\DAVID.RE\APPDATA\ROAMING\GRASSHOPPER\LIBRARIES\SPATIALSLUR\SpatialSlur.dll")  # -> out, result; inputs mesh: Mesh; same code as slurc
dom_4 = ConstructDomain(DomainStart=expr("-x", number_slider_2), DomainEnd=number_slider_2)
data_3 = Data(data)
data_4 = Data(data_2)
resample = ResampleField(Source=data_4, Target=data_3)
slurc_5 = SlurCSharpScript(
    grid=data_3,
    field=slurc_4.result,
    range=dom_4,
    Reference="C:\USERS\DAVID.RE\APPDATA\ROAMING\GRASSHOPPER\LIBRARIES\SPATIALSLUR\SpatialSlur.dll")  # -> out, result
# ---------- slurc_5: C# usings ----------
using System.Collections.Concurrent;
using System.Threading.Tasks;
using System.Linq;

using SpatialSlur;
using SpatialSlur.Collections;
using SpatialSlur.Meshes;
using SpatialSlur.Fields;
using SpatialSlur.Rhino;

using Vec3d = SpatialSlur.Vector3d;
using Vector3d = Rhino.Geometry.Vector3d;
# ---------- slurc_5: C# ----------
    var g = (Grid2d) grid;
    var f = (IField2d<double>) field;
    var n = g.CountXY;

    var indices = Enumerable.Range(0, n).Where(i =>
      {
      var p = g.ToWorldSpace(i);
      return range.IncludesParameter(f.ValueAt(p));
      });

    result = new GH_ObjectWrapper(indices);
# ---------- end slurc_5 ----------

# ---- group: Geodesic
slurc_6 = SlurCSharpScript(
    costField=resample,
    sources=slurc_5.result,
    Reference="C:\USERS\DAVID.RE\APPDATA\ROAMING\GRASSHOPPER\LIBRARIES\SPATIALSLUR\SpatialSlur.dll")  # -> out, result
# ---------- slurc_6: C# ----------
    var cost = (GridField2d<double>) costField;
    var src = (IEnumerable<int>) sources;

    var dist = GridField2d.Double.Create(cost);
    Geodesic.GetDistanceL2(cost, src, dist);

    result = dist;
# ---------- end slurc_6 ----------

# ----
data_5 = Data(slurc_6.result)
data_6 = Data(data_5)
data_7 = Data(data_5)

# ---- group: Smooth Pulse
slurc_7 = SlurCSharpScript(
    field=data_6,
    range=Slider(27.676, range=0..100),
    Reference="C:\USERS\DAVID.RE\APPDATA\ROAMING\GRASSHOPPER\LIBRARIES\SPATIALSLUR\SpatialSlur.dll")  # -> out, result; inputs range: Double
# ---------- slurc_7: C# ----------
    var f = (IField3d<double>) field;

    result = Field3d.Create(p =>
      {
      var t = SlurMath.Contour(f.ValueAt(p), range);
      return SlurMath.SmoothPulse(t, 0.5, 0.5);
      });
# ---------- end slurc_7 ----------

# ---- group: Gradient
slurc_8 = SlurCSharpScript(gridField=data_7, Reference="C:\USERS\DAVID.RE\APPDATA\ROAMING\GRASSHOPPER\LIBRARIES\SPATIALSLUR\SpatialSlur.dll")  # -> out, result
# ---------- slurc_8: C# ----------
    var f = (GridField2d<double>) gridField;
    var g = f.GetGradient(true);

    //g.Unitize(g, true);
    result = g;
# ---------- end slurc_8 ----------

# ----
pt_3 = Point([<point referenced from the Rhino model> x9])
merge = Merge(Data1=ColourSwatch(SwatchColor=RGB(255, 255, 255)), Data2=ColourSwatch(SwatchColor=RGB(148, 148, 148)))

# ---- group: Integrate Field
slurc_9 = SlurCSharpScript(
    field=slurc_8.result,
    point=pt_3,
    stepSize=Slider(-1, range=-10..10),
    stepCount=Slider(500, range=0..1000),
    Reference="C:\USERS\DAVID.RE\APPDATA\ROAMING\GRASSHOPPER\LIBRARIES\SPATIALSLUR\SpatialSlur.dll")  # -> out, result; inputs point: Point3d, stepSize: Double, stepCount: Int32
# ---------- slurc_9: C# usings ----------
using System.Collections.Concurrent;
using System.Threading.Tasks;
using System.Linq;

using SpatialSlur;
using SpatialSlur.Collections;
using SpatialSlur.Meshes;
using SpatialSlur.Fields;
using SpatialSlur.Rhino;

using Vec2d = SpatialSlur.Vector2d;
using Vector2d = Rhino.Geometry.Vector2d;

using Vec3d = SpatialSlur.Vector3d;
using Vector3d = Rhino.Geometry.Vector3d;
# ---------- slurc_9: C# ----------
    var f = (IField2d<Vec2d>) field;
    var path = new Polyline();

    var pts = Streamline.IntegrateFrom(f, new Vec2d(point.X, point.Y), stepSize, IntegrationMode.Euler);
    path.AddRange(pts.Take(stepCount).Select(p => new Point3d(p.X, p.Y, 0.0)));

    result = path;
# ---------- end slurc_9 ----------

# ----
mesh_5 = Mesh(mplane.Mesh)
data_8 = Data(slurc_7.result)

# ---- group: Field Painter
slurc_10 = SlurCSharpScript(
    mesh=mesh_5,
    field=data_8,
    colors=merge,
    Reference="C:\Users\david.re\AppData\Roaming\Grasshopper\Libraries\SpatialSlur\SpatialSlur.dll")  # -> out, result; inputs mesh: Mesh, colors: list of Color
# ---------- slurc_10: C# usings ----------
using System.Collections.Concurrent;
using System.Threading.Tasks;
using System.Drawing;

using SpatialSlur;
using SpatialSlur.Collections;
using SpatialSlur.Meshes;
using SpatialSlur.Fields;
using SpatialSlur.Rhino;

using Vec3d = SpatialSlur.Vector3d;
using Vector3d = Rhino.Geometry.Vector3d;
# ---------- slurc_10: C# ----------
    var f = (IField3d<double>) field;
    var verts = mesh.Vertices;

    mesh.ColorVertices(i =>
      {
      Vec3d p = verts[i];
      return colors.Lerp(f.ValueAt(p));
      });

    result = mesh;
# ---------- end slurc_10 ----------
