# Grasshopper definition Geodesic_Field_3d.gh (Grasshopper 1.0.7)
# plug-ins: SpatialSlur.SlurGH

mesh = Mesh(<mesh referenced from the Rhino model>)
mjoin = MeshJoin(Meshes=mesh)

# ---- group: Cost Field
mesh_2 = Mesh(mjoin)
dom = ConstructDomain(DomainStart=0, DomainEnd=Slider(2, range=0..10))
dom_2 = ConstructDomain(DomainStart=0, DomainEnd=1)
dom_3 = ConstructDomain(DomainStart=Slider(50, range=0..100), DomainEnd=Slider(1, range=0..10))

# ---- group: Cost Field / Distance to Mesh
slurc = SlurCSharpScript(mesh=mesh_2, Reference="C:\USERS\DAVID\APPDATA\ROAMING\GRASSHOPPER\LIBRARIES\SPATIALSLUR\SpatialSlur.dll")  # -> out, result; inputs mesh: Mesh
# ---------- slurc: C# usings ----------
using System.Collections.Concurrent;
using System.Threading.Tasks;

using SpatialSlur;
using SpatialSlur.Collections;
using SpatialSlur.Meshes;
using SpatialSlur.Fields;
using SpatialSlur.Rhino;

using Vec3d = SpatialSlur.Vector3d;
using Vector3d = Rhino.Geometry.Vector3d;
# ---------- slurc: C# ----------
    result = Field3d.CreateDistance(mesh);
# ---------- end slurc ----------

# ---- group: Cost Field / SmoothStep
slurc_2 = SlurCSharpScript(
    field=slurc.result,
    range=dom,
    Reference="C:\USERS\DAVID\APPDATA\ROAMING\GRASSHOPPER\LIBRARIES\SPATIALSLUR\SpatialSlur.dll")  # -> out, result
# ---------- slurc_2: C# ----------
    var f = (IField3d<double>) field;

    var t0 = range.T0;
    var t1 = range.T1;

    result = Field3d.Create(p => SlurMath.SmoothStep(f.ValueAt(p), t0, t1));
# ---------- end slurc_2 ----------

# ----
num = Number(1)

# ---- group: Grid
number_slider = Slider(50, range=0..1000)
pt = Point(<point referenced from the Rhino model>)
pt_2 = Point(<point referenced from the Rhino model>)
box = Box2Pt(PointA=pt, PointB=pt_2, Plane=PlaneXY(0, 0, 0))
gridfield = CreateGridField(BoundingBox=box, CountX=number_slider, CountY=number_slider, CountZ=number_slider, Values=num)
data = Data(gridfield)

# ---- group: Cost Field / Remap
slurc_3 = SlurCSharpScript(
    field=slurc_2.result,
    from=dom_2,
    to=dom_3,
    Reference="C:\USERS\DAVID\APPDATA\ROAMING\GRASSHOPPER\LIBRARIES\SPATIALSLUR\SpatialSlur.dll")  # -> out, result
# ---------- slurc_3: C# ----------
    var f = (IField3d<double>) field;

    var a0 = from.T0;
    var a1 = from.T1;

    var b0 = to.T0;
    var b1 = to.T1;

    result = Field3d.Create(p =>
      {
      var t = f.ValueAt(p);
      return SlurMath.Remap(t, a0, a1, b0, b1);
      });
# ---------- end slurc_3 ----------

# ----
data_2 = Data(slurc_3.result)
number_slider_2 = Slider(1, range=0..10)
mesh_3 = Mesh(<mesh referenced from the Rhino model>)
slurc_4 = SlurCSharpScript(mesh=mesh_3, Reference="C:\USERS\DAVID\APPDATA\ROAMING\GRASSHOPPER\LIBRARIES\SPATIALSLUR\SpatialSlur.dll")  # -> out, result; inputs mesh: Mesh; same code as slurc
dom_4 = ConstructDomain(DomainStart=expr("-x", number_slider_2), DomainEnd=number_slider_2)
data_3 = Data(data)
data_4 = Data(data_2)
resample = ResampleField(Source=data_4, Target=data_3)
slurc_5 = SlurCSharpScript(
    grid=data_3,
    field=slurc_4.result,
    range=dom_4,
    Reference="C:\USERS\DAVID\APPDATA\ROAMING\GRASSHOPPER\LIBRARIES\SPATIALSLUR\SpatialSlur.dll")  # -> out, result
# ---------- slurc_5: C# usings ----------
using System.Collections.Concurrent;
using System.Threading.Tasks;
using System.Linq;

using SpatialSlur;
using SpatialSlur.Collections;
using SpatialSlur.Meshes;
using SpatialSlur.Fields;
using SpatialSlur.Rhino;

using Vec3d = SpatialSlur.Vector3d;
using Vector3d = Rhino.Geometry.Vector3d;
# ---------- slurc_5: C# ----------
    var g = (Grid3d) grid;
    var f = (IField3d<double>) field;
    var n = g.CountXYZ;

    var indices = Enumerable.Range(0, n).Where(i =>
      {
      var p = g.ToWorldSpace(i);
      return range.IncludesParameter(f.ValueAt(p));
      });

    result = new GH_ObjectWrapper(indices);
# ---------- end slurc_5 ----------

# ---- group: Geodesic Distance L2
slurc_6 = SlurCSharpScript(
    costField=resample,
    sources=slurc_5.result,
    Reference="C:\USERS\DAVID\APPDATA\ROAMING\GRASSHOPPER\LIBRARIES\SPATIALSLUR\SpatialSlur.dll")  # -> out, result
# ---------- slurc_6: C# ----------
    var cost = (GridField3d<double>) costField;
    var src = (IEnumerable<int>) sources;

    var dist = GridField3d.Double.Create(cost);
    GeodesicDistance.CalculateL2(cost, src, dist);

    result = dist;
# ---------- end slurc_6 ----------

# ----
data_5 = Data(slurc_6.result)
data_6 = Data(data_5)
data_7 = Data(data_5)
slurc_7 = SlurCSharpScript(gridField=data_6, Reference="C:\USERS\DAVID\APPDATA\ROAMING\GRASSHOPPER\LIBRARIES\SPATIALSLUR\SpatialSlur.dll")  # -> out, result
# ---------- slurc_7: C# usings ----------
using System.Collections.Concurrent;
using System.Threading.Tasks;

using SpatialSlur;
using SpatialSlur.Collections;
using SpatialSlur.Meshes;
using SpatialSlur.Fields;
using SpatialSlur.Rhino;

using Vec2d = SpatialSlur.Vector2d;
using Vec3d = SpatialSlur.Vector3d;
using Vec4d = SpatialSlur.Vector4d;
# ---------- slurc_7: C# ----------
    var f = (GridField3d<double>) gridField;
    result = f.GetGradient(true);
# ---------- end slurc_7 ----------

# ---- group: Gradient
slurc_8 = SlurCSharpScript(gridField=data_7, Reference="C:\USERS\DAVID\APPDATA\ROAMING\GRASSHOPPER\LIBRARIES\SPATIALSLUR\SpatialSlur.dll")  # -> out, result
# ---------- slurc_8: C# ----------
    var f = (GridField3d<double>) gridField;
    var g = f.GetGradient(true);

    //g.Unitize(g, true);
    result = g;
# ---------- end slurc_8 ----------

# ----
pt_3 = Point([<point referenced from the Rhino model> x21])

# ---- group: Integrate Field
slurc_9 = SlurCSharpScript(
    field=slurc_8.result,
    point=pt_3,
    stepSize=Slider(-0.1, range=-10..10),
    stepCount=Slider(1000, range=0..1000),
    Reference="C:\USERS\DAVID\APPDATA\ROAMING\GRASSHOPPER\LIBRARIES\SPATIALSLUR\SpatialSlur.dll")  # -> out, result; inputs point: Point3d, stepSize: Double, stepCount: Int32
# ---------- slurc_9: C# usings ----------
using System.Collections.Concurrent;
using System.Threading.Tasks;
using System.Linq;

using SpatialSlur;
using SpatialSlur.Collections;
using SpatialSlur.Meshes;
using SpatialSlur.Fields;
using SpatialSlur.Rhino;

using Vec2d = SpatialSlur.Vector2d;
using Vector2d = Rhino.Geometry.Vector2d;

using Vec3d = SpatialSlur.Vector3d;
using Vector3d = Rhino.Geometry.Vector3d;
# ---------- slurc_9: C# ----------
    var f = (IField3d<Vec3d>) field;
    var path = new Polyline();

    var pts = Streamline.IntegrateFrom(f, point, stepSize, IntegrationMode.Euler);
    path.AddRange(pts.Take(stepCount).Select(p => (Point3d) p));

    result = path;
# ---------- end slurc_9 ----------

# ----
slurc_10 = SlurCSharpScript(
    gridField=data_6,
    gradient=slurc_7.result,
    threshold=Slider(27.223, range=0.001..100),
    Reference="C:\USERS\DAVID\APPDATA\ROAMING\GRASSHOPPER\LIBRARIES\SPATIALSLUR\SpatialSlur.dll")  # -> out, result; inputs threshold: Double
# ---------- slurc_10: C# ----------
    var f = (GridField3d<double>) gridField;
    var g = (GridField3d<Vec3d>) gradient;

    result = Isosurface.MarchingCubes.Evaluate(f, g, threshold);
# ---------- end slurc_10 ----------
merge = Merge(Data1=ColourSwatch(SwatchColor=RGB(255, 255, 255)), Data2=ColourSwatch(SwatchColor=RGB(94, 94, 94)))
normshade = NormalShader(Mesh=slurc_10.result, Colors=merge, Direction=Vector(0, 0, 1))
