# Grasshopper definition HeMesh_Unroll.gh (Grasshopper 1.0.7)
# plug-ins: SpatialSlur.SlurGH

# ---- group: PQ Mesh
mesh = Mesh(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)

# ----
hemesh = HeMesh(mesh)
slurc = SlurCSharpScript(
    heMesh=hemesh,
    startFace=Slider(0, range=0..15),
    factor=Slider(1, range=0..1),
    Reference="C:\USERS\DAVID.RE\APPDATA\ROAMING\GRASSHOPPER\LIBRARIES\SPATIALSLUR\SpatialSlur.dll")  # -> out, result; inputs startFace: Int32, factor: Double
# ---------- slurc: C# usings ----------
using System.Collections.Concurrent;
using System.Threading.Tasks;
using System.Linq;
using System.IO;

using SpatialSlur;
using SpatialSlur.Collections;
using SpatialSlur.Meshes;
using SpatialSlur.Fields;
using SpatialSlur.Rhino;

using Vec2d = SpatialSlur.Vector2d;
using Vector2d = Rhino.Geometry.Vector2d;

using Vec3d = SpatialSlur.Vector3d;
using Vector3d = Rhino.Geometry.Vector3d;
# ---------- slurc: C# ----------
    var mesh = new HeMesh3d((HeMesh3d) heMesh);
    var verts = mesh.Vertices;
    var f = mesh.Faces[startFace];

    // ensures mesh is unrollable
    HeMeshUnroller.DetachFaceCycles(mesh, f);

    // perform unroll
    var unrolled = new Vector3d[mesh.Vertices.Count];
    HeMeshUnroller.Unroll(mesh, f, (v, p) => unrolled[v] = p, he => factor);

    // update vertex attributes
    verts.Action(v => v.Position = unrolled[v]);

    result = mesh;
# ---------- end slurc ----------
hemesh_2 = HeMesh(slurc.result)
holebnds = HoleBoundaries(HeMesh=hemesh_2)
mesh_2 = Mesh(hemesh_2)
preview = CustomPreview(Geometry=holebnds, Shader=ColourSwatch(SwatchColor=RGB(0, 0, 0)))
preview_2 = CustomPreview(Geometry=mesh_2, Shader=ColourSwatch(SwatchColor=RGBA(204, 202, 202, 150)))
