# Grasshopper definition HeMesh_Unroll_01.gh (Grasshopper 0.9.76)
# plug-ins: SpatialSlur.SlurGH

# ---- group: PQ Mesh
mesh = Mesh(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)

# ----
hemesh = HeMesh(mesh)
unroll = HeMeshUnroll(HeMesh=hemesh, StartFace=Slider(0, range=0..15), UnrollFactor=Slider(1, range=0..1))
hemesh_2 = HeMesh(unroll)
holebnds = HoleBoundaries(HeMesh=hemesh_2)
mesh_2 = Mesh(hemesh_2)
preview = CustomPreview(Geometry=holebnds, Shader=ColourSwatch(SwatchColor=RGB(0, 0, 0)))
preview_2 = CustomPreview(Geometry=mesh_2, Shader=ColourSwatch(SwatchColor=RGBA(204, 202, 202, 150)))
