# Grasshopper definition IDWField_Example.gh (Grasshopper 1.0.7)

mesh = Mesh(<mesh referenced from the Rhino model>)
pt = Point([<point referenced from the Rhino model> x2])
merge = Merge(Data1=pt, Data2=mesh)
merge_2 = Merge(Data1=Slider(1, range=0..1), Data2=Slider(0.5, range=0..1), Data3=Slider(0, range=0..1))

# ---- group: Create IDWObject
c_script = CSharpScript(
    geom=merge,
    value=merge_2,
    Reference="C:\USERS\DAVID.RE\APPDATA\ROAMING\GRASSHOPPER\LIBRARIES\SPATIALSLUR\SpatialSlur.dll")  # -> out, result; inputs value: Double
# ---------- c_script: C# usings ----------
using System.Collections.Concurrent;
using System.Threading.Tasks;
using System.Linq;

using SpatialSlur;
using SpatialSlur.Collections;
using SpatialSlur.Meshes;
using SpatialSlur.Fields;
using SpatialSlur.Rhino;

using Vec3d = SpatialSlur.Vector3d;
using Vector3d = Rhino.Geometry.Vector3d;
# ---------- c_script: C# ----------
    IDWObject3d<double> obj = null;

    if(geom is Point3d)
    {
      obj = IDWPoint3d.Create((Point3d) geom, value);
    }
    else if(geom is Mesh)
    {
      obj = IDWMesh3d.Create((Mesh) geom, value);
    }

    result = new GH_ObjectWrapper(obj);
# ---------- end c_script ----------

# ---- group: Create IDWField
c_script_2 = CSharpScript(
    objects=c_script.result,
    power=Slider(3, range=0..10),
    Reference="C:\Users\david.re\AppData\Roaming\Grasshopper\Libraries\SpatialSlur\SpatialSlur.dll")  # -> out, result; inputs objects: list, power: Double
# ---------- c_script_2: C# ----------
    var field = IDWField3d.Double.Create(power);
    field.Objects.AddRange(objects.Select(obj => (IDWObject3d<double>) obj));
    result = new GH_ObjectWrapper(field);
# ---------- end c_script_2 ----------

# ----
merge_3 = Merge(
    Data1=ColourSwatch(SwatchColor=RGB(255, 255, 255)),
    Data2=ColourSwatch(SwatchColor=RGB(255, 0, 150)),
    Data3=ColourSwatch(SwatchColor=RGB(0, 0, 0)))
data = Data(c_script_2.result)
mesh_2 = Mesh(<mesh referenced from the Rhino model>)

# ---- group: Field Painter
c_script_3 = CSharpScript(
    field=data,
    mesh=mesh_2,
    colors=merge_3,
    Reference="C:\USERS\DAVID.RE\APPDATA\ROAMING\GRASSHOPPER\LIBRARIES\SPATIALSLUR\SpatialSlur.dll")  # -> out, result; inputs mesh: Mesh, colors: list of Color
# ---------- c_script_3: C# usings ----------
using System.Collections.Concurrent;
using System.Threading.Tasks;
using System.Drawing;

using SpatialSlur;
using SpatialSlur.Collections;
using SpatialSlur.Meshes;
using SpatialSlur.Fields;
using SpatialSlur.Rhino;

using Vec3d = SpatialSlur.Vector3d;
using Vector3d = Rhino.Geometry.Vector3d;
# ---------- c_script_3: C# ----------
    var f = (IField3d<double>) field;
    var verts = mesh.Vertices;

    mesh.ColorVertices(i => colors.Lerp(f.ValueAt(verts[i])), true);

    result = mesh;
# ---------- end c_script_3 ----------
