# Grasshopper definition IDWField_Integration.gh (Grasshopper 1.0.7)
# plug-ins: SpatialSlur.SlurGH

crv = Curve(<curve referenced from the Rhino model>)
pt = Point(<point referenced from the Rhino model>)
merge = Merge(Data1=Slider(1, range=0..1), Data2=Slider(0.667, range=0..1))
scale = Scale(Geometry=crv, Center=pt, Factor=merge)  # -> Geometry, Transform
divide = DivideCurve(Curve=scale.Geometry, Count=Slider(3, range=0..100), Kinks=False)  # -> Points, Tangents, Parameters
pt_2 = Point(flatten(divide.Points))
num = Number(0)
num_2 = Number(1)
num_3 = Number(10)
pt_3 = Point(pt_2)

# ---- group: Create IDWConstant
c_script = CSharpScript(
    distance=num_3,
    value=num,
    Reference="C:\USERS\DAVID.RE\APPDATA\ROAMING\GRASSHOPPER\LIBRARIES\SPATIALSLUR\SpatialSlur.dll")  # -> out, result; inputs distance: Double, value: Double
# ---------- c_script: C# usings ----------
using System.Collections.Concurrent;
using System.Threading.Tasks;
using System.Linq;

using SpatialSlur;
using SpatialSlur.Collections;
using SpatialSlur.Meshes;
using SpatialSlur.Fields;
using SpatialSlur.Rhino;

using Vec3d = SpatialSlur.Vector3d;
using Vector3d = Rhino.Geometry.Vector3d;
# ---------- c_script: C# ----------
    var obj = IDWConstant3d.Create(distance, value);
    result = new GH_ObjectWrapper(obj);
# ---------- end c_script ----------

# ---- group: Create IDWPoint
c_script_2 = CSharpScript(point=pt_3, value=num_2, Reference="C:\USERS\DAVID.RE\APPDATA\ROAMING\GRASSHOPPER\LIBRARIES\SPATIALSLUR\SpatialSlur.dll")  # -> out, result; inputs point: Point3d, value: Double
# ---------- c_script_2: C# ----------
    var obj = IDWPoint3d.Create(point, value);
    result = new GH_ObjectWrapper(obj);
# ---------- end c_script_2 ----------

# ----
merge_2 = Merge(Data1=c_script_2.result, Data2=c_script.result)  # -> flatten(Result)

# ---- group: Create IDWField
c_script_3 = CSharpScript(
    objects=merge_2,
    power=Slider(1, range=0..10),
    Reference="C:\Users\david.re\AppData\Roaming\Grasshopper\Libraries\SpatialSlur\SpatialSlur.dll")  # -> out, result; inputs objects: list, power: Double
# ---------- c_script_3: C# ----------
    var field = IDWField3d.Double.Create(power);
    field.Objects.AddRange(objects.Select(obj => (IDWObject3d<double>) obj));
    
    result = new GH_ObjectWrapper(field);
# ---------- end c_script_3 ----------

# ----
data = Data(c_script_3.result)
number_slider = Slider(100, range=0..100)
dom = ConstructDomain(DomainStart=Slider(0.245, range=0..1), DomainEnd=0)
data_2 = Data(data)
crv_2 = Curve(<curve referenced from the Rhino model>)
rec = Rectangle(crv_2)
slurc = SlurCSharpScript(field=data_2, range=dom, Reference="C:\USERS\DAVID.RE\APPDATA\ROAMING\GRASSHOPPER\LIBRARIES\SPATIALSLUR\SpatialSlur.dll")  # -> out, result
# ---------- slurc: C# usings ----------
using System.Collections.Concurrent;
using System.Threading.Tasks;
using System.Linq;
using System.IO;

using SpatialSlur;
using SpatialSlur.Collections;
using SpatialSlur.Meshes;
using SpatialSlur.Fields;
using SpatialSlur.Rhino;

using Vec2d = SpatialSlur.Vector2d;
using Vector2d = Rhino.Geometry.Vector2d;

using Vec3d = SpatialSlur.Vector3d;
using Vector3d = Rhino.Geometry.Vector3d;
# ---------- slurc: C# ----------
    var f = (IField3d<double>) field;
    var t0 = range.T0;
    var t1 = range.T1;
    
    result = Field3d.Create(p => SlurMath.Normalize(f.ValueAt(p), t0, t1));
# ---------- end slurc ----------
mplane = MeshPlane(Boundary=rec, WidthCount=number_slider, HeightCount=number_slider)  # -> Mesh, Area
merge_3 = Merge(Data1=ColourSwatch(SwatchColor=RGB(255, 255, 255)), Data2=ColourSwatch(SwatchColor=RGB(255, 0, 100)))

# ---- group: Field Painter
c_script_4 = CSharpScript(
    field=slurc.result,
    mesh=mplane.Mesh,
    colors=merge_3,
    Reference="C:\USERS\DAVID.RE\APPDATA\ROAMING\GRASSHOPPER\LIBRARIES\SPATIALSLUR\SpatialSlur.dll")  # -> out, result; inputs mesh: Mesh, colors: list of Color
# ---------- c_script_4: C# usings ----------
using System.Collections.Concurrent;
using System.Threading.Tasks;
using System.Linq;
using System.Drawing;

using SpatialSlur;
using SpatialSlur.Collections;
using SpatialSlur.Meshes;
using SpatialSlur.Fields;
using SpatialSlur.Rhino;

using Vec3d = SpatialSlur.Vector3d;
using Vector3d = Rhino.Geometry.Vector3d;
# ---------- c_script_4: C# ----------
    var f = (IField3d<double>) field;
    var verts = mesh.Vertices;

    mesh.ColorVertices(i => colors.Lerp(f.ValueAt(verts[i])), true);

    result = mesh;
# ---------- end c_script_4 ----------

# ----
pt_4 = Point(pt_2)
data_3 = Data(data)
num_4 = Number(0.001)
cir = Circle(Plane=pt_4, Radius=Slider(5, range=0..10))

# ---- group: Get Gradient
c_script_5 = CSharpScript(
    field=data_3,
    epsilon=num_4,
    Reference="C:\USERS\DAVID.RE\APPDATA\ROAMING\GRASSHOPPER\LIBRARIES\SPATIALSLUR\SpatialSlur.dll")  # -> out, result; inputs epsilon: Double
# ---------- c_script_5: C# ----------
    var f = (IField3d<double>) field;
    var fg = Field3d.Create(p => Geometry.GetGradient(f.ValueAt, p, epsilon));

    result = new GH_ObjectWrapper(fg);
# ---------- end c_script_5 ----------

# ----
divide_2 = DivideCurve(Curve=cir, Count=Slider(50, range=0..100), Kinks=False)  # -> flatten(Points), Tangents, Parameters
num_5 = Number(-2000)
integrate = IntegrateField(VectorField=c_script_5.result, Points=divide_2.Points, StepSize=num_5, StepCount=Slider(500, range=0..1000))
preview = CustomPreview(Geometry=integrate, Material=ColourSwatch(SwatchColor=RGB(0, 0, 0)))
