# Grasshopper definition Noise_Field_Integration.gh (Grasshopper 1.0.7)
# plug-ins: SpatialSlur.SlurGH

number_slider = Slider(1.5, range=0..2)
pt = ConstructPoint(XCoordinate=0, YCoordinate=0, ZCoordinate=0)
pt_2 = ConstructPoint(XCoordinate=number_slider, YCoordinate=number_slider, ZCoordinate=number_slider)
crv = Curve(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)

# ---- group: Create PerlinNoise field
slurc = CreatePerlinNoiseField(origin=pt, scale=pt_2, Reference="C:\USERS\DAVID.RE\APPDATA\ROAMING\GRASSHOPPER\LIBRARIES\SPATIALSLUR\SpatialSlur.dll")  # -> out, result; inputs origin: Point3d, scale: Point3d
# ---------- slurc: C# usings ----------
using System.Collections.Concurrent;
using System.Threading.Tasks;
using System.Linq;
using System.IO;

using SpatialSlur;
using SpatialSlur.Collections;
using SpatialSlur.Meshes;
using SpatialSlur.Fields;
using SpatialSlur.Rhino;

using Vec2d = SpatialSlur.Vector2d;
using Vector2d = Rhino.Geometry.Vector2d;

using Vec3d = SpatialSlur.Vector3d;
using Vector3d = Rhino.Geometry.Vector3d;
# ---------- slurc: C# ----------
    result = new PerlinNoise3d(scale, origin);
# ---------- end slurc ----------

# ----
divide = DivideCurve(Curve=crv, Count=Slider(250, range=0..1000), Kinks=False)  # -> Points, Tangents, Parameters
panel = Panel(slurc.result)
integrate = IntegrateField(VectorField=slurc.result, Points=divide.Points, StepSize=Slider(0.1, range=0..1), StepCount=Slider(500, range=0..1000))
