# Grasshopper definition Noise_Field_Integration_01.gh (Grasshopper 0.9.76)
# plug-ins: SpatialSlur.SlurGH

number_slider = Slider(1, range=0..1)
crv = Curve(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)
perlinf = CreatePerlinNoiseField(
    scaleX=number_slider,
    scaleY=number_slider,
    scaleZ=number_slider,
    Reference="C:\Users\david.re\AppData\Roaming\Grasshopper\Libraries\SpatialSlur\SpatialSlur.dll")  # -> out, result; inputs scaleX: Double, scaleY: Double, scaleZ: Double
# ---------- perlinf: C# ----------
    var f = new PerlinNoiseField()
    {
        ScaleX = scaleX,
        ScaleY = scaleY,
        ScaleZ = scaleZ
    };
    
    result = f;
# ---------- end perlinf ----------
divide = DivideCurve(Curve=crv, Count=Slider(100, range=0..1000), Kinks=False)  # -> Points, Tangents, Parameters
panel = Panel(perlinf.result)
integrate = IntegrateField(
    VectorField=perlinf.result,
    Points=divide.Points,
    StepSize=Slider(0.1, range=0..1),
    StepCount=Slider(500, range=0..1000),
    IntegrationMode=2)
