# Grasshopper definition Quad_Strips.gh (Grasshopper 1.0.7)
# plug-ins: SpatialSlur.SlurGH

mesh = Mesh(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)
hemesh = HeMesh(mesh)

# ---- group: Strips
c_script = CSharpScript(
    heMesh=hemesh,
    flip=Toggle(False),
    Reference="C:\Users\david.re\AppData\Roaming\Grasshopper\Libraries\SpatialSlur\SpatialSlur.dll")  # -> out, result; inputs flip: Boolean
# ---------- c_script: C# usings ----------
using System.Collections.Concurrent;
using System.Threading.Tasks;
using System.Linq;
using System.IO;

using SpatialSlur;
using SpatialSlur.Collections;
using SpatialSlur.Meshes;
using SpatialSlur.Fields;
using SpatialSlur.Rhino;

using Vec2d = SpatialSlur.Vector2d;
using Vector2d = Rhino.Geometry.Vector2d;

using Vec3d = SpatialSlur.Vector3d;
using Vector3d = Rhino.Geometry.Vector3d;
# ---------- c_script: C# ----------
    var mesh = (HeMesh3d) heMesh; // convenience method for casting from object
    var strips = Selection.GetQuadStrips(mesh, flip);
    
    result = strips.Select(strip => strip.ToMesh(v => (Point3f) v.Position));
# ---------- end c_script ----------

# ----
mesh_2 = Mesh(c_script.result)
lng = ListLength(List=mesh_2)
range = Range(Domain=Domain(0, 1), Steps=expr("x - 1", lng))
merge = Merge(Data1=ColourSwatch(SwatchColor=RGB(255, 16, 255)), Data2=ColourSwatch(SwatchColor=RGB(0, 255, 255)))
interp = InterpolateData(Data=merge, Parameter=range, Interpolation=2)
merge_2 = Merge(Data1=ColourSwatch(SwatchColor=RGB(255, 255, 255)), Data2=ColourSwatch(SwatchColor=RGB(0, 0, 0)))
jitter = Jitter(List=interp, Jitter=1, Seed=2)  # -> Values, Indices
ins = InsertItems(List=merge_2, Item=graft(jitter.Values), Indices=1, Wrap=True)
panel = Panel("""0.2
0.5
0.8""")
interp_2 = InterpolateData(Data=ins, Parameter=panel, Interpolation=2)
normshade = NormalShader(Mesh=graft(c_script.result), Colors=interp_2, Direction=Vector(1, 1, 1))
