# Grasshopper definition Sort_Faces_By_Depth.gh (Grasshopper 1.0.7)
# plug-ins: SpatialSlur.SlurGH

mesh = Mesh(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)
dual = CreateDual(HeMesh=mesh)
merge = Merge(Data1=Slider(7, range=0..100), Data2=Slider(136, range=0..200))

# ---- group: Sort faces by depth
c_script = CSharpScript(
    heMesh=dual,
    sources=merge,
    Reference="C:\Users\david.re\AppData\Roaming\Grasshopper\Libraries\SpatialSlur\SpatialSlur.dll")  # -> out, result, faceCount; inputs sources: list of Int32
# ---------- c_script: C# usings ----------
using System.Collections.Concurrent;
using System.Threading.Tasks;
using System.Linq;
using System.IO;

using SpatialSlur;
using SpatialSlur.Collections;
using SpatialSlur.Meshes;
using SpatialSlur.Fields;
using SpatialSlur.Rhino;

using Vec2d = SpatialSlur.Vector2d;
using Vector2d = Rhino.Geometry.Vector2d;

using Vec3d = SpatialSlur.Vector3d;
using Vector3d = Rhino.Geometry.Vector3d;
# ---------- c_script: C# ----------
    var hem = new HeMesh3d((HeMesh3d) heMesh);
    var faces = hem.Faces;

    // external array to store depths
    var depths = new int[faces.Count];

    // property to get/set depth from a face
    var prop = HeMesh3d.Face.CreateProperty(depths);

    // calculate depths
    hem.GetFaceDepths(sources.Select(i => faces[i]), prop);

    // sort faces by depth
    faces.Sort(f => depths[f]);
    // hem.Faces.Sort(prop.Get); // can also use the property's getter lambda which was created above

    result = hem;
    faceCount = faces.Count;
# ---------- end c_script ----------

# ----
panel = Panel(c_script.out)
range = Range(Domain=Domain(0, 1), Steps=expr("x-1", c_script.faceCount))
merge_2 = Merge(
    Data1=ColourSwatch(SwatchColor=RGB(255, 255, 255)),
    Data2=ColourSwatch(SwatchColor=RGB(255, 0, 100)),
    Data3=ColourSwatch(SwatchColor=RGB(0, 0, 0)))
interp = InterpolateData(Data=merge_2, Parameter=range, Interpolation=2)
facecol = DisplayFaceColors(HeMesh=c_script.result, Colors=interp)
