# Grasshopper definition Sphere_Collide.gh (Grasshopper 1.0.7)

mesh = Mesh([<mesh referenced from the Rhino model> x3])
facen = FaceNormals(Mesh=mesh)  # -> Centers, Normals
pt = Point(<point referenced from the Rhino model>)
pt_2 = Point(<point referenced from the Rhino model>)
pl = PlaneNormal(Origin=facen.Centers, ZAxis=facen.Normals)
vdis = VectorDisplay(Anchor=facen.Centers, Vector=expr("x * 3", facen.Normals))
box = Box2Pt(PointA=pt_2, PointB=pt, Plane=PlaneXY(0, 0, 0))
pln = Plane(flatten(pl))

# ---- group: Particle Count
int = Integer(Slider(30000, range=0..100000))

# ----
box_2 = Box(box)
int_2 = Integer(int)
pln_2 = Plane(pln)
int_3 = Integer(int)

# ---- group: SphereCollide
c_script = CSharpScript(
    count=int_2,
    radius=Slider(1, range=0..10),
    strength=Slider(1, range=0..10),
    parallel=Toggle(True),
    Reference="C:\USERS\DAVID.RE\APPDATA\ROAMING\GRASSHOPPER\LIBRARIES\SPATIALSLUR\SpatialSlur.dll")  # -> out, result; inputs count: Int32, radius: Double, strength: Double, parallel: Boolean
# ---------- c_script: C# usings ----------
using System.Collections.Concurrent;
using System.Threading.Tasks;
using System.Linq;
using System.IO;

using SpatialSlur;
using SpatialSlur.Collections;
using SpatialSlur.Meshes;
using SpatialSlur.Fields;
using SpatialSlur.Dynamics.Forces;
using SpatialSlur.Rhino;

using Vec2d = SpatialSlur.Vector2d;
using Vector2d = Rhino.Geometry.Vector2d;

using Vec3d = SpatialSlur.Vector3d;
using Vector3d = Rhino.Geometry.Vector3d;
# ---------- c_script: C# ----------
    var c = new SphereCollide(Enumerable.Range(0, count), radius, strength, parallel);
    result = new GH_ObjectWrapper(c.Yield());
# ---------- end c_script ----------

# ---- group: AbovePlane
c_script_2 = CSharpScript(
    count=int_3,
    plane=pln_2,
    weight=Slider(100, range=0..100),
    Reference="C:\USERS\DAVID.RE\APPDATA\ROAMING\GRASSHOPPER\LIBRARIES\SPATIALSLUR\SpatialSlur.dll")  # -> out, result; inputs count: Int32, plane: Plane, weight: Double
# ---------- c_script_2: C# usings ----------
using System.Collections.Concurrent;
using System.Threading.Tasks;
using System.Linq;
using System.IO;

using SpatialSlur;
using SpatialSlur.Collections;
using SpatialSlur.Meshes;
using SpatialSlur.Fields;
using SpatialSlur.Dynamics.Constraints;
using SpatialSlur.Rhino;

using Vec2d = SpatialSlur.Vector2d;
using Vector2d = Rhino.Geometry.Vector2d;

using Vec3d = SpatialSlur.Vector3d;
using Vector3d = Rhino.Geometry.Vector3d;
# ---------- c_script_2: C# ----------
    var o = (Vec3d) plane.Origin;
    var n = (Vec3d) plane.Normal;

    result = new GH_ObjectWrapper(
      Enumerable.Range(0, count)
      .Select(i => new AbovePlane(i, o, n, weight))
      );
# ---------- end c_script_2 ----------

# ----
int_4 = Integer(int)
box_3 = Box(box_2)

# ---- group: Settings
c_script_3 = CSharpScript(
    timeStep=Slider(1, range=0..1),
    damping=Slider(0.05, range=0..1),
    Reference="C:\USERS\DAVID.RE\APPDATA\ROAMING\GRASSHOPPER\LIBRARIES\SPATIALSLUR\SpatialSlur.dll")  # -> out, result; inputs timeStep: Double, damping: Double
# ---------- c_script_3: C# usings ----------
using System.Collections.Concurrent;
using System.Threading.Tasks;
using System.Linq;
using System.IO;

using SpatialSlur;
using SpatialSlur.Collections;
using SpatialSlur.Meshes;
using SpatialSlur.Fields;
using SpatialSlur.Dynamics;
using SpatialSlur.Rhino;

using Vec2d = SpatialSlur.Vector2d;
using Vector2d = Rhino.Geometry.Vector2d;

using Vec3d = SpatialSlur.Vector3d;
using Vector3d = Rhino.Geometry.Vector3d;
# ---------- c_script_3: C# ----------
    result = new ConstraintSolverSettings(){TimeStep = timeStep, LinearDamping = damping};
# ---------- end c_script_3 ----------

# ---- group: Create Bodies
c_script_4 = CSharpScript(
    bounds=box_3,
    count=int_4,
    seed=Slider(1, range=0..10),
    Reference="C:\USERS\DAVID.RE\APPDATA\ROAMING\GRASSHOPPER\LIBRARIES\SPATIALSLUR\SpatialSlur.dll")  # -> out, result; inputs bounds: Box, count: Int32, seed: Int32
# ---------- c_script_4: C# ----------
    var bodies = new Body[count];
    var rnd = new Random(seed);
    var d = bounds.BoundingBox.ToInterval3d();

    for(int i = 0; i < count; i++)
      bodies[i] = new Body(rnd.NextVector3d(d));

    result = new GH_ObjectWrapper(bodies);
# ---------- end c_script_4 ----------

# ---- group: Gather Constraints
c_script_5 = CSharpScript(
    constraints=flatten([c_script.result, c_script_2.result]),
    Reference="C:\USERS\DAVID.RE\APPDATA\ROAMING\GRASSHOPPER\LIBRARIES\SPATIALSLUR\SpatialSlur.dll")  # -> out, result; inputs constraints: list
# ---------- c_script_5: C# ----------
    result = new GH_ObjectWrapper(constraints.SelectMany(obj => (IEnumerable<IConstraint>) obj).ToArray());
# ---------- end c_script_5 ----------

# ----
data = Data(c_script_5.result)
list = ValueList({"Reset": 0, "Play": 1, "Pause": 2}, selected="Pause")
data_2 = Data(c_script_4.result)
data_3 = Data(c_script_3.result)
data_4 = Data(data)

# ---- group: Constraint Solver
c_script_6 = CSharpScript(
    bodies=data_2,
    constraints=data_4,
    settings=data_3,
    subSteps=Slider(1, range=0..100),
    simState=list,
    Reference="C:\USERS\DAVID.RE\APPDATA\ROAMING\GRASSHOPPER\LIBRARIES\SPATIALSLUR\SpatialSlur.dll")  # -> out, result; inputs subSteps: Int32, simState: Int32
# ---------- c_script_6: C# usings ----------
using System.Collections.Concurrent;
using System.Threading.Tasks;
using System.Linq;
using System.IO;
using System.Drawing;

using SpatialSlur;
using SpatialSlur.Collections;
using SpatialSlur.Meshes;
using SpatialSlur.Fields;
using SpatialSlur.Dynamics;
using SpatialSlur.Rhino;

using Vec2d = SpatialSlur.Vector2d;
using Vector2d = Rhino.Geometry.Vector2d;

using Vec3d = SpatialSlur.Vector3d;
using Vector3d = Rhino.Geometry.Vector3d;
# ---------- c_script_6: C# ----------
    //reset
    if(simState == 0)
    {
      Reset();
      return;
    }

    // setup
    if(_solver == null)
    {
      Init((IEnumerable<Body>) bodies);
    }

    // update constraints & settings
    var consts = (IConstraint[]) constraints;
    _solver.Settings = (ConstraintSolverSettings) settings;

    // step solver
    for(int i = 0; i < subSteps; i++)
      _solver.Step(_bodies, consts);

    // print details
    Print(String.Format("Step {0}", _solver.StepCount));

    // expire solution
    if(simState == 1)
      Component.ExpireSolution(true);

    result = new GH_ObjectWrapper(_bodies);

    // update display
    //UpdateDisplay(colors, pointSize);
    // UpdateDisplay();
# ---------- c_script_6: C# additional code ----------
  Body[] _bodies;
  ConstraintSolver _solver;


  /// <summary>
  ///
  /// </summary>
  /// <returns></returns>
  void Reset()
  {
    _solver = null;
  }


  /// <summary>
  ///
  /// </summary>
  /// <param name="particlePositions"></param>
  /// <param name="constraints"></param>
  /// <returns></returns>
  void Init(IEnumerable<Body> bodies)
  {
    _bodies = bodies.Select(b => b.Duplicate()).ToArray();
    _solver = new ConstraintSolver();
  }
# ---------- end c_script_6 ----------

# ----
merge = Merge(
    Data1=ColourSwatch(SwatchColor=RGB(255, 255, 255)),
    Data2=ColourSwatch(SwatchColor=RGB(255, 0, 150)),
    Data3=ColourSwatch(SwatchColor=RGB(0, 0, 0)))
dup = DuplicateData(Data=merge, Number=Slider(2, range=0..100), Order=True)

# ---- group: Display Bodies
slurc = SlurCSharpScript(
    bodies=c_script_6.result,
    colors=dup,
    pointSize=Slider(6, range=0..16),
    Reference="C:\USERS\DAVID.RE\APPDATA\ROAMING\GRASSHOPPER\LIBRARIES\SPATIALSLUR\SpatialSlur.dll")  # -> out, result; inputs colors: list of Color, pointSize: Int32
# ---------- slurc: C# ----------
    var src = (Body[]) bodies;

    if(src != _bodies)
      InitDisplay(src);

    UpdateDisplay(colors, pointSize);
# ---------- slurc: C# additional code ----------
  Body[] _bodies;

  PointCloud _pointCloud;
  double[] _distances;

  BoundingBox _clippingBox;
  int _pointSize = 8;

  Point3d _cameraPos;


  /// <summary>
  ///
  /// </summary>
  /// <returns></returns>
  void InitDisplay(Body[] bodies)
  {
    _bodies = bodies;
    _pointCloud = new PointCloud(bodies.Select(b => (Point3d) b.Position.Current));
    _distances = new double[bodies.Length];
  }


  /// <summary>
  ///
  /// </summary>
  void UpdateDisplay(List<Color> colors, int pointSize)
  {
    var bodies = _bodies;
    var cloud = _pointCloud;

    var dists = _distances;
    var camPos = _cameraPos;
    var distRange = new Intervald(camPos.DistanceTo(bodies[0].Position.Current));

    // update distances
    for(int i = 0; i < bodies.Length; i++)
    {
      var d = camPos.DistanceTo(bodies[i].Position.Current);
      distRange.Include(dists[i] = d);
    }

    // update pointcloud attributes
    for(int i = 0; i < bodies.Length; i++)
    {
      var p = cloud[i];
      p.Location = bodies[i].Position.Current;
      p.Color = colors.Lerp(distRange.Normalize(dists[i]));
    }

    /*
    // Parallel update causes crash in Rhino 6
    Parallel.ForEach(Partitioner.Create(0, bodies.Length), range =>
      {
      for(int i = range.Item1; i < range.Item2; i++)
      {
        var p = cloud[i];
        p.Location = bodies[i].Position.Current;
        p.Color = colors.Lerp(distRange.Normalize(dists[i]));
      }
      });
    */

    // set display parameters
    _clippingBox = cloud.GetBoundingBox(false);
    _pointSize = pointSize;
  }


  /// <summary>
  /// This method will be called once every solution, before any calls to RunScript.
  /// </summary>
  public override void BeforeRunScript()
  {
    if(RhinoDocument != null)
      _cameraPos = RhinoDocument.Views.ActiveView.ActiveViewport.CameraLocation;
  }


  /// <summary>
  ///
  /// </summary>
  public override BoundingBox ClippingBox
  {
    get {return _clippingBox;}
  }


  /// <summary>
  ///
  /// </summary>
  public override void DrawViewportMeshes(IGH_PreviewArgs args)
  {
    if(_pointCloud != null)
      args.Display.DrawPointCloud(_pointCloud, _pointSize);
  }
# ---------- end slurc ----------
