# Grasshopper definition Steiner_Tree_Finder.gh (Grasshopper 1.0.7)
# plug-ins: SpatialSlur.SlurGH

num = Number(0.01)

# ---- group: Settings
c_script = CSharpScript(
    minLength=num,
    timeStep=Slider(1, range=0..1),
    damping=Slider(0.75, range=0..1),
    refineFreq=Slider(5, range=0..10),
    Reference="C:\USERS\DAVID.RE\APPDATA\ROAMING\GRASSHOPPER\LIBRARIES\SPATIALSLUR\SpatialSlur.dll")  # -> out, result; inputs minLength: Double, timeStep: Double, damping: Double, refineFreq: Int32
# ---------- c_script: C# usings ----------
using System.Collections.Concurrent;
using System.Threading.Tasks;
using System.Linq;
using System.IO;

using SpatialSlur;
using SpatialSlur.Collections;
using SpatialSlur.Meshes;
using SpatialSlur.Fields;
using SpatialSlur.Tools;
using SpatialSlur.Rhino;

using Vec3d = SpatialSlur.Vector3d;
using Vector3d = Rhino.Geometry.Vector3d;
# ---------- c_script: C# ----------
    var settings = new SteinerFinder.Settings()
      {
        MinLength = minLength,
        TimeStep = timeStep,
        Damping = damping,
        RefineFrequency = refineFreq
        };

    result = settings;
# ---------- end c_script ----------

# ----
list = ValueList({"Reset": 0, "Play": 1, "Pause": 2}, selected="Pause")
pt = Point([Point(-5, -5, -10), Point(-5, 5, -10), Point(5, -5, -10), Point(5, 5, -10), Point(-5, -10, -5), Point(5, -10, -5), Point(-5, -10, 5), Point(5, -10, 5), Point(10, -5, -5), Point(10, 5, -5), Point(10, -5, 5), Point(10, 5, 5), Point(5, 10, -5), Point(-5, 10, -5), Point(5, 10, 5), Point(-5, 10, 5), Point(-10, 5, -5), Point(-10, -5, -5), Point(-10, 5, 5), Point(-10, -5, 5), Point(-5, -5, 10), Point(5, -5, 10), Point(-5, 5, 10), Point(5, 5, 10)])

# ---- group: Steiner Finder
c_script_2 = CSharpScript(
    points=pt,
    settings=c_script.result,
    subSteps=Slider(5, range=0..100),
    simState=list,
    Reference="C:\Users\david.re\AppData\Roaming\Grasshopper\Libraries\SpatialSlur\SpatialSlur.dll")  # -> out, result; inputs points: list of Point3d, subSteps: Int32, simState: Int32
# ---------- c_script_2: C# ----------
    // reset
    if(simState == 0)
    {
      _solver = null;
      return;
    }

    // setup
    if(_solver == null)
    {
      _solver = SteinerFinder.Solver.CreateFromPoints(points.Select(p => (Vec3d) p));
    }

    // update settings
    _solver.Settings = (SteinerFinder.Settings) settings;

    // step
    for(int i = 0; i < subSteps; i++)
      _solver.Step();

    // output
    Print((_solver.IsConverged) ? "Converged" : "Running");
    Print(String.Format("{0} steps", _solver.StepCount));
    result = HeGraph3d.Factory.CreateCopy(_solver.Graph, (v0,v1) => v0.Position = v1.Position, delegate{});

    // expire solution if playing
    if(simState == 1)
      Component.ExpireSolution(true);
# ---------- c_script_2: C# additional code ----------
  SteinerFinder.Solver _solver;
# ---------- end c_script_2 ----------

# ----
hegraph = HeGraph(c_script_2.result)
merge = Merge(Data1=ColourSwatch(SwatchColor=RGB(255, 0, 100)), Data2=ColourSwatch(SwatchColor=RGB(0, 0, 0)))
panel = Panel(c_script_2.out)
vertpos = VertexPositions(HeGraph=hegraph)  # disabled
edgelns = EdgeLines(HeGraph=hegraph)  # disabled

# ---- group: Display Edge Depth
c_script_3 = CSharpScript(
    heGraph=hegraph,
    minWeight=Slider(4, range=0..10),
    maxWeight=Slider(12, range=0..100),
    colors=merge,
    Reference="C:\USERS\DAVID.RE\APPDATA\ROAMING\GRASSHOPPER\LIBRARIES\SPATIALSLUR\SpatialSlur.dll")  # -> out; inputs minWeight: Int32, maxWeight: Int32, colors: list of Color
# ---------- c_script_3: C# usings ----------
using System.Collections.Concurrent;
using System.Threading.Tasks;
using System.Linq;
using System.IO;
using System.Drawing;

using SpatialSlur;
using SpatialSlur.Collections;
using SpatialSlur.Meshes;
using SpatialSlur.Fields;
using SpatialSlur.Tools;
using SpatialSlur.Rhino;

using Vec3d = SpatialSlur.Vector3d;
using Vector3d = Rhino.Geometry.Vector3d;
# ---------- c_script_3: C# ----------
    var graph = (HeGraph3d) heGraph;
    var verts = graph.Vertices;
    var edges = graph.Edges;

    var depths = new int[verts.Count];
    var depthProp = new Property<HeGraph3d.Vertex, int>(v => depths[v], (v, d) => depths[v] = d);

    graph.GetVertexDepths(verts.Where(v => v.IsDegree1), depthProp);
    var rng = new Intervald(depths.Select(d => (double) d));

    foreach(var he in edges)
    {
      if(he.IsUnused) continue;

      var t = rng.Normalize(Math.Min(depths[he.Start], depths[he.End]));

      _lines.Add(he.ToLine());
      _colors.Add(colors.Lerp(t));
      _weights.Add((int) SlurMath.Lerp(minWeight, maxWeight, t));
    }

    _clippingBox.Union(new BoundingBox(verts.Select(v => (Point3d) v.Position)));
# ---------- c_script_3: C# additional code ----------
  List<Line> _lines;
  List<Color> _colors;
  List<int> _weights;
  BoundingBox _clippingBox;


  /// <summary>
  ///
  /// </summary>
  public override void BeforeRunScript()
  {
    _lines = new List<Line>();
    _colors = new List<Color>();
    _weights = new List<int>();
    _clippingBox = BoundingBox.Empty;
  }


  /// <summary>
  ///
  /// </summary>
  public override BoundingBox ClippingBox
  {
    get {return _clippingBox;}
  }


  /// <summary>
  ///
  /// </summary>
  public override void DrawViewportWires(IGH_PreviewArgs args)
  {
    if(_lines == null) return;

    for(int i = 0; i < _lines.Count; i++)
      args.Display.DrawLine(_lines[i], _colors[i], _weights[i]);
  }
# ---------- end c_script_3 ----------

# ----
panel_2 = Panel(c_script_3)
