# Grasshopper definition 170801_Divide_Edges_01.gh (Grasshopper 0.9.76)

# ---- group: Boundary Curves
crv = Curve()

# ----
num = Number(1e-06)

# ---- group: HeMesh From Polylines
c_script = CSharpScript(
    polylines=crv,
    tolerance=num,
    Reference=["C:\USERS\DAVID.RE\APPDATA\ROAMING\GRASSHOPPER\LIBRARIES\SPATIALSLUR\SlurRhino.dll", "C:\USERS\DAVID.RE\APPDATA\ROAMING\GRASSHOPPER\LIBRARIES\SPATIALSLUR\SpatialSlur.dll"])  # -> out, result; inputs polylines: list of Polyline, tolerance: Double
# ---------- c_script: C# ----------
 
    result = polylines.ToHeMesh(tolerance);
# ---------- end c_script ----------

# ---- group: Divide Edges
c_script_2 = CSharpScript(
    heMesh=c_script.result,
    targetLength=Slider(0.025, range=0.01..1),
    Reference=["C:\USERS\DAVID.RE\APPDATA\ROAMING\GRASSHOPPER\LIBRARIES\SPATIALSLUR\SlurRhino.dll", "C:\USERS\DAVID.RE\APPDATA\ROAMING\GRASSHOPPER\LIBRARIES\SPATIALSLUR\SpatialSlur.dll"])  # -> out, result; inputs targetLength: Double
# ---------- c_script_2: C# ----------
    var mesh = HeMesh3d.TryCast(heMesh).Duplicate();

    var edges = mesh.Edges;
    var ne = edges.Count;

    for(int i = 0; i < ne; i++)
    {
      var he = edges[i];

      var p = he.Start.Position;
      var d = he.End.Position - p;

      var n = (int) Math.Round(d.Length / targetLength) - 1;
      if(n < 1) continue;

      mesh.DivideEdge(he, n);

      // set vertex positions
      he = he.NextInFace;
      var t = 1.0 / (n + 1);
      
      for(int j = 1; j <= n; j++)
      {
        he.Start.Position = p + d * (t * j);
        he = he.NextInFace;
      }
    }
    

    result = mesh;
# ---------- end c_script_2 ----------

# ---- group: Face Polylines
c_script_3 = CSharpScript(
    heMesh=c_script_2.result,
    Reference=["C:\USERS\DAVID.RE\APPDATA\ROAMING\GRASSHOPPER\LIBRARIES\SPATIALSLUR\SlurRhino.dll", "C:\USERS\DAVID.RE\APPDATA\ROAMING\GRASSHOPPER\LIBRARIES\SPATIALSLUR\SpatialSlur.dll"])  # -> out, result
# ---------- c_script_3: C# ----------
    if(heMesh == null)
      return;

    var mesh = (HeMesh<HeMesh3d.V, HeMesh3d.E, HeMesh3d.F>) heMesh;

    var polys = new List<Polyline>();
    mesh.GetFacePolylines(v => v.Position, (f, p) => polys.Add(p));

    result = polys;
# ---------- end c_script_3 ----------

# ----
cp = ControlPoints(Curve=c_script_3.result)  # -> Points, Weights, Knots
