# Grasshopper definition 170801_Dual_Boundary_01.gh (Grasshopper 0.9.76)
# plug-ins: SpatialSlur.SlurGH

mesh = Mesh(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)
hemesh = HeMesh(mesh)

# ---- group: Add Boundary Faces
c_script = CSharpScript(
    heMesh=hemesh,
    Reference=["C:\USERS\DAVID.RE\APPDATA\ROAMING\GRASSHOPPER\LIBRARIES\SPATIALSLUR\SlurRhino.dll", "C:\USERS\DAVID.RE\APPDATA\ROAMING\GRASSHOPPER\LIBRARIES\SPATIALSLUR\SpatialSlur.dll"])  # -> out, result
# ---------- c_script: C# ----------
    var mesh = ((HeMesh<HeMesh3d.V, HeMesh3d.E, HeMesh3d.F>) heMesh).Duplicate();

    AddBoundaryFaces(mesh);
    result = mesh;
# ---------- c_script: C# additional code ----------
  /// <summary>
  ///
  /// </summary>
  void AddBoundaryFaces(HeMesh<HeMesh3d.V, HeMesh3d.E, HeMesh3d.F> mesh)
  {
    var holes = mesh.GetHoles().ToList();
    var verts = mesh.Vertices;

    foreach(var he0 in holes)
    {
      int nv = mesh.Vertices.Count;
      int n = 0;

      // add verts
      foreach(var he1 in he0.CirculateFace)
      {
        var v = mesh.AddVertex();
        v.Position = he1.Start.Position;
        n++;
      }

      // add faces
      {
        var he1 = he0;

        for(int i = 0; i < n; i++)
        {
          var he2 = he1.NextInFace;
          int j = (i + 1) % n;

          mesh.AddFace(he1.Start, he2.Start, j + nv, i + nv);
          he1 = he2;
        }
      }
    }
  }
# ---------- end c_script ----------

# ---- group: Dual
c_script_2 = CSharpScript(
    heMesh=c_script.result,
    Reference=["C:\USERS\DAVID.RE\APPDATA\ROAMING\GRASSHOPPER\LIBRARIES\SPATIALSLUR\SlurRhino.dll", "C:\USERS\DAVID.RE\APPDATA\ROAMING\GRASSHOPPER\LIBRARIES\SPATIALSLUR\SpatialSlur.dll"])  # -> out, result
# ---------- c_script_2: C# ----------
    var mesh = (HeMesh<HeMesh3d.V, HeMesh3d.E, HeMesh3d.F>) heMesh;
    result = mesh.GetDual();
# ---------- end c_script_2 ----------

# ---- group: Face Polylines
c_script_3 = CSharpScript(
    heMesh=c_script_2.result,
    Reference=["C:\USERS\DAVID.RE\APPDATA\ROAMING\GRASSHOPPER\LIBRARIES\SPATIALSLUR\SlurRhino.dll", "C:\USERS\DAVID.RE\APPDATA\ROAMING\GRASSHOPPER\LIBRARIES\SPATIALSLUR\SpatialSlur.dll"])  # -> out, result
# ---------- c_script_3: C# ----------
    if(heMesh == null)
      return;

    var mesh = (HeMesh<HeMesh3d.V, HeMesh3d.E, HeMesh3d.F>) heMesh;

    var polys = new List<Polyline>();
    mesh.GetFacePolylines(v => v.Position, (f, p) => polys.Add(p));

    result = polys;
# ---------- end c_script_3 ----------

# ----
crv = Curve(c_script_3.result)
