# Grasshopper definition 170918_Add_Boundary_Faces_01.gh (Grasshopper 0.9.76)
# plug-ins: SpatialSlur.SlurGH

pt = Point([<point referenced from the Rhino model> x4])

# ---- group: Add Boundary Faces
c_script = CSharpScript(
    corners=pt,
    tolerance=Slider(0.1, range=0..1),
    Reference=["C:\USERS\DAVID.RE\APPDATA\ROAMING\GRASSHOPPER\LIBRARIES\SPATIALSLUR\SlurRhino.dll", "C:\USERS\DAVID.RE\APPDATA\ROAMING\GRASSHOPPER\LIBRARIES\SPATIALSLUR\SpatialSlur.dll"])  # -> out, result; inputs corners: list of Point3d, tolerance: Double
# ---------- c_script: C# ----------
    var mesh = ((HeMesh3d) heMesh).Duplicate();
    var verts = mesh.Vertices;

    // get corner status
    var isCorner = new bool[mesh.Vertices.Count];
    foreach(var id in DataUtil.GetFirstCoincident(corners, p => p.ToVec3d(), verts, v => v.Position, tolerance))
    {
      if(id != -1)
        isCorner[id] = true;
    }

    AddBoundaryFaces(mesh, v => isCorner[v]);
    result = mesh;
# ---------- c_script: C# additional code ----------
  /// <summary>
  ///
  /// </summary>
  void AddBoundaryFaces(HeMesh3d mesh, Func<HeMesh3d.Vertex, bool> isCorner)
  {
    var holes = mesh.GetHoles().ToList();
    var verts = mesh.Vertices;

    foreach(var he0 in holes)
    {
      int nhe = mesh.Halfedges.Count;
      int nv = mesh.Vertices.Count;

      // add verts
      foreach(var he1 in he0.CirculateFace)
      {
        var v1 = he1.Start;

        var v2 = mesh.AddVertex();
        v2.Position = v1.Position;

        if(isCorner(v1))
        {
          var v3 = mesh.AddVertex();
          v3.Position = v1.Position;
        }
      }

      // add faces
      {
        var he1 = he0;
        int i = nv;

        while(true)
        {
          var v1 = he1.Start;

          // add vertex face if corner
          if(isCorner(v1))
            mesh.AddFace(v1, i + 1, i++);

          // add edge face
          var he2 = he1.NextInFace;
          var v2 = he2.Start;

          // if he2 is newly added...
          if(he2 >= nhe)
          {
            mesh.AddFace(i, v1, v2, nv); // add last face
            break;
          }

          mesh.AddFace(i, v1, v2, ++i);
          he1 = he2;
        }
      }
    }
  }
# ---------- end c_script ----------

# ----
hemesh = HeMesh(c_script.result)
