# Grasshopper definition 170919_Variable_Offset_01.gh (Grasshopper 0.9.76)

xy = XYPlane(Origin=Point(0, 0, 0))
c_script = CSharpScript(
    plane=xy,
    Reference=["C:\Users\david.re\AppData\Roaming\Grasshopper\Libraries\SpatialSlur\SlurRhino.dll", "C:\Users\david.re\AppData\Roaming\Grasshopper\Libraries\SpatialSlur\SpatialSlur.dll"])  # -> out, result; inputs polyline: Polyline, offsets: list of Double, plane: Plane
# ---------- c_script: C# ----------
    int n = polyline.SegmentCount;

    // create segment planes
    var frames = new Orient3d[n];
    var normal = plane.ZAxis.ToVec3d();

    for(int i = 0; i < n; i++)
    {
      var ln = polyline.SegmentAt(i);
      var axes = new Rotation3d(ln.Direction.ToVec3d(), normal);
      var orig = ln.From.ToVec3d() + axes.Z * offsets[i];
      frames[i] = new Orient3d(axes, orig);
    }

    // calculate offset points
    for(int i = 1; i < n; i++)
    {
      var f0 = frames[i];
      var f1 = frames[i - 1];

      var p = GeometryUtil.ProjectToPlane(f0.Translation, f1.Translation, f1.Rotation.Z, f0.Rotation.X);
      polyline[i] = p.ToPoint3d();
    }

    // handle start/end 
    {
      var f0 = frames[0];
      var f1 = frames[n - 1];

      if(polyline.IsClosed)
      {
        var p = GeometryUtil.ProjectToPlane(f0.Translation, f1.Translation, f1.Rotation.Z, f0.Rotation.X);
        polyline[0] = polyline[n] = p.ToPoint3d();
      }
      else
      {
        polyline[0] = f0.Translation.ToPoint3d();
        polyline[n - 1] = f1.Translation.ToPoint3d();
      }
    }

    result = polyline;
# ---------- end c_script ----------
