# Grasshopper definition 171011_Mesh_MeanCurvature_01.gh (Grasshopper 0.9.76)
# plug-ins: SpatialSlur.SlurGH

mesh = Mesh(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)
hemesh = HeMesh(mesh)

# ---- group: Mean curvature field
c_script = CSharpScript(
    heMesh=hemesh,
    Reference=["C:\USERS\DAVID.RE\APPDATA\ROAMING\GRASSHOPPER\LIBRARIES\SPATIALSLUR\SpatialSlur.dll", "C:\USERS\DAVID.RE\APPDATA\ROAMING\GRASSHOPPER\LIBRARIES\SPATIALSLUR\SlurRhino.dll"])  # -> out, result
# ---------- c_script: C# ----------
    var hem = ((HeMesh3d) heMesh).Duplicate();
    var hedges = hem.Halfedges;
    var verts = hem.Vertices;

    var areas = new double[verts.Count];
    var weights = new double[hedges.Count];

    var areaProp = Property.Create<HeMesh3d.Vertex, double>(v => areas[v], (v, a) => areas[v] = a);
    var weightProp = Property.Create<HeMesh3d.Halfedge, double>(he => weights[he], (he,w) => weights[he] = w);

    // calculate cotangent weighted laplacian
    var lapl = new Vec3d[verts.Count];
    hem.GetHalfedgeCotanWeights(v => v.Position, areaProp, weightProp);
    hem.GetVertexLaplacian(v => v.Position, he => weights[he], (v,n) => lapl[v] = n, true);

    // set field
    var field = new MeshScalarField(hem);
    var vals = field.Values;
    lapl.Convert(n => n.Length, vals);

    // inherit boundary values
    foreach(var v in hem.GetBoundaryVertices())
      vals[v] = v.ConnectedVertices.Where(cv => !cv.IsBoundary).Mean(cv => vals[cv]);

    result = field;
# ---------- end c_script ----------

# ---- group: Cotangent smooth
c_script_2 = CSharpScript(
    meshField=c_script.result,
    steps=Slider(5, range=0..100),
    strength=Slider(0.9, range=0..2),
    Reference=["C:\USERS\DAVID.RE\APPDATA\ROAMING\GRASSHOPPER\LIBRARIES\SPATIALSLUR\SpatialSlur.dll", "C:\USERS\DAVID.RE\APPDATA\ROAMING\GRASSHOPPER\LIBRARIES\SPATIALSLUR\SlurRhino.dll"])  # -> out, result; inputs steps: Int32, strength: Double
# ---------- c_script_2: C# ----------
    var field = ((MeshScalarField) meshField).Duplicate(true);
    var mesh = field.Mesh;
    var vals = field.Values;

    var areas = new double[mesh.Vertices.Count];
    var weights = new double[mesh.Halfedges.Count];

    var areaProp = Property.Create<HeMesh3d.Vertex,double>(v => areas[v], (v, a) => areas[v] = a);
    var weightProp = Property.Create<HeMesh3d.Halfedge,double>(he => weights[he], (he,w) => weights[he] = w);

    mesh.GetHalfedgeCotanWeights(v => v.Position, areaProp, weightProp);
    mesh.NormalizeAtVertices(weightProp, true);

    var deltas = areas;
    for(int i = 0; i < steps; i++)
    {
      mesh.GetVertexLaplacian(v => vals[v], weightProp.Get, (v,d) => deltas[v] = d, true);
      ArrayMath.AddScaledParallel(vals, deltas, strength, vals);
    }

    result = field;
# ---------- end c_script_2 ----------

# ----
data = Data(c_script_2.result)
merge = Merge(
    Data1=ColourSwatch(SwatchColor=RGB(255, 255, 255)),
    Data2=ColourSwatch(SwatchColor=RGB(255, 0, 100)),
    Data3=ColourSwatch(SwatchColor=RGB(0, 0, 0)))
dom = ConstructDomain(DomainStart=0, DomainEnd=Slider(1.052, range=0..10))
c_script_3 = CSharpScript(
    meshField=data,
    colors=merge,
    interval=dom,
    Reference=["C:\USERS\DAVID.RE\APPDATA\ROAMING\GRASSHOPPER\LIBRARIES\SPATIALSLUR\SpatialSlur.dll", "C:\USERS\DAVID.RE\APPDATA\ROAMING\GRASSHOPPER\LIBRARIES\SPATIALSLUR\SlurRhino.dll"])  # -> out, result; inputs colors: list of Color
# ---------- c_script_3: C# ----------
    var field = (MeshScalarField) meshField;
    var vals = field.Values;
    var d = interval.ToInterval1d();

    Print(new Interval1d(vals).ToString());

    var m = field.Mesh.ToMesh();
    m.ColorVertices(i => colors.Lerp(d.Normalize(vals[i])));


    result = m;
# ---------- end c_script_3 ----------
