# Grasshopper definition Volumetric_Clustering.gh (Grasshopper 1.0.7)
# plug-ins: SpatialSlur.SlurGH, Weaverbird

pi = Pi(Factor=Slider(2, range=1..10))
num = Number(pi)
num_2 = Number(num)
dom = ConstructDomain(DomainStart=0, DomainEnd=num_2)
number_slider = Slider(64, range=0..100)
box = DomainBox(Base=PlaneXY(0, 0, 0), X=dom, Y=dom, Z=dom)
number_slider_2 = Slider(1, range=0..1)
gridfield = CreateGridField(BoundingBox=box, CountX=number_slider, CountY=number_slider, CountZ=number_slider)
vec = VectorXYZ(XComponent=number_slider_2, YComponent=number_slider_2, ZComponent=number_slider_2)  # -> Vector, Length

# ---- group: Implicit Function
c_script = CSharpScript(
    field=gridfield,
    scale=vec.Vector,
    Reference="C:\USERS\DAVID.RE\APPDATA\ROAMING\GRASSHOPPER\LIBRARIES\SPATIALSLUR\SpatialSlur.dll")  # -> out, result; inputs scale: Vector3d
# ---------- c_script: C# usings ----------
using System.Collections.Concurrent;
using System.Threading.Tasks;
using System.Linq;
using System.IO;

using SpatialSlur;
using SpatialSlur.Collections;
using SpatialSlur.Meshes;
using SpatialSlur.Fields;
using SpatialSlur.Rhino;

using Vec2d = SpatialSlur.Vector2d;
using Vector2d = Rhino.Geometry.Vector2d;

using Vec3d = SpatialSlur.Vector3d;
using Vector3d = Rhino.Geometry.Vector3d;
# ---------- c_script: C# ----------
    var f = (GridField3d<double>) field;
    f = f.Duplicate(false);

    var invScale = 1.0 / (Vec3d) scale;

    f.WorldSpaceFunction(p => ImplicitSurfaces.IWP(p * invScale), true);
    result = f;
# ---------- end c_script ----------

# ----
data = Data(c_script.result)
slurc = SlurCSharpScript(Reference="C:\USERS\DAVID.RE\APPDATA\ROAMING\GRASSHOPPER\LIBRARIES\SPATIALSLUR\SpatialSlur.dll")  # -> out, result
# ---------- end slurc ----------

# ---- group: Get Gradient
c_script_2 = CSharpScript(field=data, Reference="C:\USERS\DAVID.RE\APPDATA\ROAMING\GRASSHOPPER\LIBRARIES\SPATIALSLUR\SpatialSlur.dll")  # -> out, result
# ---------- c_script_2: C# ----------
    var f = (GridField3d<double>) field;
    result = f.GetGradient();
# ---------- end c_script_2 ----------

# ---- group: Decompose
c_script_3 = CSharpScript(field=c_script_2.result, Reference="C:\USERS\DAVID.RE\APPDATA\ROAMING\GRASSHOPPER\LIBRARIES\SPATIALSLUR\SpatialSlur.dll")  # -> out, x, y, z
# ---------- c_script_3: C# ----------
    var f = (GridField3d<Vec3d>) field;
    x = GridField3d.Double.CreateCopy(f, v => v.X);
    y = GridField3d.Double.CreateCopy(f, v => v.Y);
    z = GridField3d.Double.CreateCopy(f, v => v.Z);
# ---------- end c_script_3 ----------

# ---- group: Select
c_script_4 = CSharpScript(
    scalarField=data,
    t0=Slider(-10, range=-10..10),
    t1=Slider(0, range=-10..10),
    Reference="C:\USERS\DAVID.RE\APPDATA\ROAMING\GRASSHOPPER\LIBRARIES\SPATIALSLUR\SpatialSlur.dll")  # -> out, result; inputs t0: Double, t1: Double
# ---------- c_script_4: C# ----------
    var sf = (GridField3d<double>) scalarField;
    var vals = sf.Values;

    var d = new Intervald(t0, t1);
    var selection = new List<int>();

    for(int i = 0; i < vals.Length; i++)
    {
      if(d.Contains(vals[i]))
        selection.Add(i);
    }

    result = new GH_ObjectWrapper(selection);
# ---------- end c_script_4 ----------

# ----
merge = Merge(Data1=data, Data2=c_script_3.x, Data3=c_script_3.y, Data4=c_script_3.z)
data_2 = Data(merge)
data_3 = Data(c_script_4.result)
number_slider_3 = Slider(0.1, range=0..1)
merge_2 = Merge(Data1=Slider(0.2, range=0..1), Data2=number_slider_3, Data3=number_slider_3, Data4=number_slider_3)
data_4 = Data(data_2)

# ---- group: Scale
c_script_5 = CSharpScript(
    field=data_4,
    factor=merge_2,
    Reference="C:\USERS\DAVID.RE\APPDATA\ROAMING\GRASSHOPPER\LIBRARIES\SPATIALSLUR\SpatialSlur.dll")  # -> out, result; inputs factor: Double
# ---------- c_script_5: C# ----------
    var f = ((ISampledField<double>) field).Duplicate(true);
    f.Multiply(factor, f);
    result = f;
# ---------- end c_script_5 ----------

# ---- group: Create Data Points
c_script_6 = CSharpScript(
    fields=c_script_5.result,
    Reference="C:\USERS\DAVID.RE\APPDATA\ROAMING\GRASSHOPPER\LIBRARIES\SPATIALSLUR\SpatialSlur.dll")  # -> out, result; inputs fields: list
# ---------- c_script_6: C# ----------
    var pts = CreateDataPoints(fields.Select(f => ((ISampledField<double>) f).Values).ToList());
    result = new GH_ObjectWrapper(pts);
# ---------- c_script_6: C# additional code ----------
  /// <summary>
  ///
  /// </summary>
  double[][] CreateDataPoints(List<ArrayView<double>> fields)
  {
    int count = fields[0].Count;
    int size = fields.Count;

    var result = new double[count][];

    for(int i = 0; i < count; i++)
    {
      var p = result[i] = new double[size];

      for(int j = 0; j < size; j++)
        p[j] = fields[j].Get(i);
    }

    return result;
  }
# ---------- end c_script_6 ----------

# ----
data_5 = Data(c_script_6.result)
panel = Panel(c_script_6.out)
data_6 = Data(data_3)
data_7 = Data(data_5)

# ---- group: KMeans
c_script_7 = CSharpScript(
    dataPoints=data_7,
    selection=data_6,
    clusterCount=Slider(12, range=0..200),
    maxSteps=Slider(1000, range=0..1000),
    seed=Slider(51, range=0..100),
    parallel=Toggle(True),
    Reference="C:\USERS\DAVID.RE\APPDATA\ROAMING\GRASSHOPPER\LIBRARIES\SPATIALSLUR\SpatialSlur.dll")  # -> out, result; inputs clusterCount: Int32, maxSteps: Int32, seed: Int32, parallel: Boolean
# ---------- c_script_7: C# ----------
    var dp = (double[][]) dataPoints;
    var parent = (List<int>) selection;
    var kmeans = new KMeans(dp.TakeSelection(parent), clusterCount, seed);

    // cluster points
    int steps = kmeans.Cluster(maxSteps, parallel);

    if(steps == -1)
      Print("Clustering did not converge after the maximum number of steps");
    else
      Print(String.Format("Clustering converged in {0} steps", steps));

    result = SelectClusters(kmeans, parent);
# ---------- c_script_7: C# additional code ----------
  /// <summary>
  /// Creates a new selection for each cluster
  /// </summary>
  /// <returns></returns>
  List<int>[] SelectClusters(KMeans kmeans, List<int> selection)
  {
    var result = new List<int>[kmeans.ClusterCount];

    for(int i = 0; i < result.Length; i++)
      result[i] = new List<int>();

    for(int i = 0; i < kmeans.PointCount; i++)
      result[kmeans.GetNearestCluster(i)].Add(selection[i]);

    return result;
  }
# ---------- end c_script_7 ----------

# ----
panel_2 = Panel(c_script_7.out)
data_8 = Data(c_script_7.result)
data_9 = Data(data_8)
data_10 = Data(data)

# ---- group: Mesh Selection
c_script_8 = CSharpScript(
    grid=data_10,
    selection=data_9,
    Reference="C:\USERS\DAVID.RE\APPDATA\ROAMING\GRASSHOPPER\LIBRARIES\SPATIALSLUR\SpatialSlur.dll")  # -> out, result
# ---------- c_script_8: C# ----------
    var g = (Grid3d) grid;
    result = g.ToPolySoup((IEnumerable<int>) selection);
# ---------- end c_script_8 ----------

# ----
data_11 = Data(data)
mesh = Mesh(flatten(c_script_8.result))

# ---- group: Get Gradient
c_script_9 = CSharpScript(field=data_11, Reference="C:\USERS\DAVID.RE\APPDATA\ROAMING\GRASSHOPPER\LIBRARIES\SPATIALSLUR\SpatialSlur.dll")  # -> out, result; same code as c_script_2

# ----
number_slider_4 = Slider(1, range=0..1)
lng = ListLength(List=mesh)

# ---- group: Isosurface 2
c_script_10 = CSharpScript(
    field=data_11,
    gradient=c_script_9.result,
    threshold=Slider(0, range=-1..2),
    Reference="C:\USERS\DAVID.RE\APPDATA\ROAMING\GRASSHOPPER\LIBRARIES\SPATIALSLUR\SpatialSlur.dll")  # -> out, result; inputs threshold: Double
# ---------- c_script_10: C# ----------
    var f = (GridField3d<double>) field;
    var g = (GridField3d<Vec3d>) gradient;
    result = Isosurface.MarchingCubes.Evaluate(f, g, threshold);
# ---------- end c_script_10 ----------

# ----
merge_3 = Merge(
    Data1=ColourSwatch(SwatchColor=RGB(255, 255, 255)),
    Data2=ColourSwatch(SwatchColor=RGB(255, 0, 100)),
    Data3=ColourSwatch(SwatchColor=RGB(100, 0, 100)))
range = Range(Domain=Domain(0, 1), Steps=expr("x-1", lng))
dom_2 = ConstructDomain(DomainStart=expr("1.0-x", number_slider_4), DomainEnd=number_slider_4)
num_3 = Number(1)
vec_2 = VectorXYZ(XComponent=num_3, YComponent=num_3, ZComponent=num_3)  # -> Vector, Length
remap = RemapNumbers(Value=range, Source=Domain(0, 1), Target=dom_2)  # -> Mapped, Clipped
unit = UnitVector(Vector=vec_2.Vector)
merge_4 = Merge(Data1=ColourSwatch(SwatchColor=RGB(0, 0, 0)), Data2=ColourSwatch(SwatchColor=RGB(255, 255, 255)))
interp = InterpolateData(Data=merge_3, Parameter=remap.Mapped, Interpolation=2)
normshade = NormalShader(Mesh=c_script_10.result, Colors=merge_4, Direction=unit)
num_4 = Number(expr("x * 1.5", num))
mcol = MeshColours(Mesh=graft(mesh), Colours=graft(interp))
X = UnitX(Factor=num_4)
trim = TrimTree(Tree=mcol, Depth=1)
move = Move(Geometry=normshade, Motion=X)  # -> Geometry, Transform
mesh_2 = Mesh(trim)
wbnaked = WeaverbirdsNakedBoundary(MeshClosedPolylines=mesh_2)
mesh_3 = Mesh(mesh_2)
num_5 = Number(pi)
lng_2 = ListLength(List=mesh_3)
multiplication = Multiplication(A=num_5, B=Slider(0.25, range=0..2))
series = Series(Start=0, Step=multiplication, Count=lng_2)
num_6 = Number(expr("x * -1.5", num))
vec_3 = VectorXYZ(XComponent=num_6, YComponent=series, ZComponent=series)  # -> Vector, Length
move_2 = Move(Geometry=mesh_3, Motion=vec_3.Vector)  # -> Geometry, Transform
wbnaked_2 = WeaverbirdsNakedBoundary(MeshClosedPolylines=move_2.Geometry)
