# Grasshopper definition 170717_Remesher_Example_01.gh (Grasshopper 0.9.76)
# plug-ins: SpatialSlur.SlurGH

pt = Point([<point referenced from the Rhino model> x6])
long = LongestList(ListA=pt, ListB=Slider(0, range=0..1), PaddingMode=2)  # -> ListA, ListB

# ---- group: Input Mesh
mesh = Mesh(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)

# ----
pt_2 = Point(long.ListA)
num = Number(long.ListB)

dom = ConstructDomain(DomainStart=Slider(0.2, range=0.1..10), DomainEnd=Slider(2, range=0.1..20))

# ---- group: IDWScalarField
c_script = CSharpScript(
    points=pt_2,
    values=num,
    power=Slider(3, range=0..10),
    defaultValue=Slider(1, range=0..1),
    defaultWeight=Slider(0.0142, range=0..0.1),
    Reference=["C:\Users\david.re\AppData\Roaming\Grasshopper\Libraries\SpatialSlur\SpatialSlur.dll", "C:\Users\david.re\AppData\Roaming\Grasshopper\Libraries\SpatialSlur\SlurRhino.dll"])  # -> out, result; inputs points: list of Point3d, values: list of Double, power: Double, defaultValue: Double, defaultWeight: Double
# ---------- c_script: C# ----------
    var field = new IDWScalarField3d(power);
    field.DefaultValue = defaultValue;
    field.DefaultWeight = defaultWeight;

    var pts = field.Points;
    for(int i = 0 ; i < points.Count; i++)
      pts.Add(IDWPoint3d.Create(values[i], points[i].ToVec3d()));

    result = (IField3d<double>) field;
# ---------- end c_script ----------

# ----
merge = Merge(
    Data1=ColourSwatch(SwatchColor=RGB(255, 255, 255)),
    Data2=ColourSwatch(SwatchColor=RGB(255, 0, 150)),
    Data3=ColourSwatch(SwatchColor=RGB(0, 0, 0)))
data = Data(c_script.result)
mesh_2 = Mesh(mesh)
crv = Curve(<curve referenced from the Rhino model>)  # disabled

# ---- group: Field Painter
c_script_2 = CSharpScript(
    field3d=data,
    mesh=mesh_2,
    colors=merge,
    Reference=["C:\USERS\DAVID.RE\APPDATA\ROAMING\GRASSHOPPER\LIBRARIES\SPATIALSLUR\SpatialSlur.dll", "C:\USERS\DAVID.RE\APPDATA\ROAMING\GRASSHOPPER\LIBRARIES\SPATIALSLUR\SlurRhino.dll"])  # -> out, result; inputs mesh: Mesh, colors: list of Color
# ---------- c_script_2: C# ----------
    var f = (IField3d<double>) field3d;
    mesh.PaintByVertexPosition(p => colors.Lerp(f.ValueAt(p.ToVec3d())), true);
    result = mesh;
# ---------- end c_script_2 ----------

# ----
settings = DynamicRemesherSettings(
    LengthRange=dom,
    LengthTolerance=Slider(0.1, range=0..1),
    FeatureWeight=Slider(100, range=0..100),
    SmoothWeight=Slider(1, range=0..10),
    TimeStep=1,
    Damping=0.5,
    SubSteps=Slider(5, range=0..10),
    RefineFrequency=Slider(3, range=0..10))

# ---- group: Create Point Features
c_script_3 = CSharpScript(
    polyline=crv,
    Reference=["C:\USERS\DAVID.RE\APPDATA\ROAMING\GRASSHOPPER\LIBRARIES\SPATIALSLUR\SlurRhino.dll", "C:\USERS\DAVID.RE\APPDATA\ROAMING\GRASSHOPPER\LIBRARIES\SPATIALSLUR\SpatialSlur.dll"])  # -> out, result; inputs polyline: Polyline; disabled
# ---------- c_script_3: C# ----------
    if(polyline.IsClosed)
      polyline.RemoveAt(polyline.Count - 1);

    result = polyline.Select(p => new PointFeature(p.ToVec3d()));
# ---------- end c_script_3 ----------

# ----
list = ValueList({"Reset": 0, "Play": 1, "Pause": 2}, selected="Pause")
hemesh = HeMesh(mesh)
mesh_3 = Mesh(mesh)
data_2 = Data(c_script_3.result)
data_3 = Data(data)
data_4 = Data(settings)
remesher = DynamicRemesher(Source=hemesh, Target=mesh_3, Features=data_2, LengthField=data_3, Settings=data_4, SimState=list)  # -> Out, Result
hemesh_2 = HeMesh(remesher.Result)
merge_2 = Merge(Data1=ColourSwatch(SwatchColor=RGB(255, 255, 255)), Data2=ColourSwatch(SwatchColor=RGB(102, 102, 102)))
Z = UnitZ(Factor=1)
mesh_4 = Mesh(hemesh_2)
normshade = NormalShader(Mesh=mesh_4, Colors=merge_2, Direction=Z)
